# Grasshopper definition 01_SimpleBeam.gh (Grasshopper 0.9.76)
# Copyright: B+G Engineers
# plug-ins: Karamba

# create geometry
pt = Point(Point(0.6132713423, 1.260593929, 0))
pt_2 = Point(Point(5.613271342, 1.260593929, 0))
f = Slider(-7.3, range=-10..10)
i = Slider(4, range=0..10)
crosecrselect = CrossSectionRangeSelectorKaramba(MaximumHeight_cm=-1, MaximumWidth_cm=-1, menu=[dropdown(0), dropdown(1), dropdown(3)])
# convert line to beam
ln = Line(StartPoint=pt, EndPoint=pt_2)
aligndim = AlignedDimension(Plane=PlaneXY(0, 0, 0), PointA=pt, PointB=pt_2, Offset=-1, Text="{0:0.00}", Size=0.2)
Z = UnitZ(Factor=f)
# define materials
matselect = MaterialSelectionKaramba(menu=[dropdown(1), dropdown(2)])
# define cross sections
crosecselect = CrossSectionSelectorKaramba(NameOrListIndexOfCrossSection=i, CrossSections=crosecrselect)  # -> CrossSection, Info
# define loads
loads = LoadsKaramba(ForceVector=Z, Local=True, PosInd=pt_2, LCase=0, mode="Point")
# define supports
supp = SupportKaramba(PosInd=pt, menu=[buttons(on, on, on, on, on, on)])
# 01 - Simple Beam
# Difficulty: Simple
# A simple cantilevering beam with one fixed support and one point load, using the Cross Section and Material Selector
linetobeam = LineToBeamKaramba(Line=ln, New=True, Remove=True, LimitDistance_m=0.005)  # -> Points, Element, Info
# assemble model
assemble = AssembleModelKaramba(
    Elem=linetobeam.Element,
    Support=supp,
    Load=loads,
    CrossSection=crosecselect.CrossSection,
    Material=matselect,
    LimitDistance_m=0.005)  # -> Model, Info, Mass_kg, CenterOfGravity
# analyze model
analyzethi = AnalyzeThIKaramba(Model=assemble.Model)  # -> CalculatedModel, MaximumDisplacement_m, ResultingForceOfGravity_kN, ElasticEnergy_kNm
# view results
modelview = ModelViewKaramba(Model=analyzethi.CalculatedModel, LoadCaseFactorsForLinearSuperposition=1, IndexIncrementOfVisibleLoadcase=0)  # -> Model, DeformedMesh, DeformedAxes, DeformedModel
beamview = BeamViewKaramba(Model=modelview.Model)  # -> Model, MeshesOfRenderedBeams, DeformedBeamAxes, LegendColors, LegendTags
legend = Legend(Colour=beamview.LegendColors, Tags=beamview.LegendTags, LegendType=1)
