# Grasshopper definition 02_ParametricTruss.gh (Grasshopper 0.9.76)
# Copyright: B+G Engineers
# plug-ins: Karamba

truss_height = Slider(1.2, range=0..5)
truss_divisions = Slider(12, range=2..20)
pt = Point(Point(10.61327134, 1.260593929, 0))
pt_2 = Point(Point(0.6132713423, 1.260593929, 0))
aligndim = AlignedDimension(Plane=PlaneXY(0, 0, 0), PointA=pt_2, PointB=pt, Offset=2, Text="{0:0.00}", Size=0.2)
ln = Line(StartPoint=pt_2, EndPoint=pt)
Z = UnitZ(Factor=truss_height)
position_of_load = Slider(0.498, range=0..1)
# create geometry
extr = Extrude(Base=ln, Direction=Z)
crosecrselect = CrossSectionRangeSelectorKaramba(MaximumHeight_cm=-1, MaximumWidth_cm=-1, menu=[dropdown(0), dropdown(1), dropdown(3)])
# 01 - Parametric Truss
# Difficulty: Simple (TRIAL/PRO versions only)
# A truss set up parametrically where the height and number of divisions can be altered. The Beam Joint component releases the joints of the diagonal members and the Tension Compression Eliminator eliminates all members
# under tension. Assigning beam ids allows various cross sections in one model. Reduce the truss divisions to view in the Trial version.
cluster = Cluster(S=extr, V=truss_divisions)  # -> T, N
load_multiplier = Slider(-350, range=-500..0)
vec = VectorXYZ(XComponent="1", YComponent=position_of_load, ZComponent=0)  # -> Vector, Length
panel = Panel("""A
B
C1
C2""")
panel_2 = Panel("""0,0,0
0,1,0""")
evalsrf = EvaluateSurface(Surface=reparameterize(extr), Point=vec.Vector)  # -> Point, Normal, Frame
i = Slider(7, range=0..20)
i_2 = Slider(0, range=0..20)
i_3 = Slider(2, range=0..20)
# convert line to beam
linetobeam = LineToBeamKaramba(Line=cluster.T, New=True, Remove=True, LimitDistance_m=0.005, BeamIdentifier=graft(panel))  # -> Points, Element, Info
# define cross sections
panel_3 = Panel("A")
panel_4 = Panel("B")
panel_5 = Panel("""C1
C2""")
# define supports
evalsrf_2 = EvaluateSurface(Surface=reparameterize(extr), Point=panel_2)  # -> Point, Normal, Frame
pull = PullPoint(Point=evalsrf.Point, Geometry=flatten(linetobeam.Points), ClosestOnly=True)  # -> ClosestPoint, Distance
panel_6 = Panel("""B
C1
C2""")
Z_2 = UnitZ(Factor=load_multiplier)
# define materials
matselect = MaterialSelectionKaramba(menu=[dropdown(1), dropdown(2)])
crosecselect = CrossSectionSelectorKaramba(ElementsIdentifiers=panel_3, NameOrListIndexOfCrossSection=i, CrossSections=crosecrselect)  # -> CrossSection, Info
crosecselect_2 = CrossSectionSelectorKaramba(ElementsIdentifiers=panel_4, NameOrListIndexOfCrossSection=i_3, CrossSections=crosecrselect)  # -> CrossSection, Info
crosecselect_3 = CrossSectionSelectorKaramba(ElementsIdentifiers=panel_5, NameOrListIndexOfCrossSection=i_2, CrossSections=crosecrselect)  # -> CrossSection, Info
orientate = OrientateBeamKaramba(Beam=linetobeam.Element, ZOrientation=cluster.N, Alpha_deg=90)  # -> flatten(Beam)
# define joints
beam_joints = BeamJointsKaramba(
    ElementIdentifiers=panel_6,
    CtKNMAtStartingNode=Vector(0, 0, 0),
    CrKNmRadAtStartingNode=Vector(0, 0, 0),
    CtKNMAtEndNode=Vector(0, 0, 0),
    CrKNmRadAtEndNode=Vector(0, 0, 0),
    menu=[buttons(off, off, off, off, on, off), buttons(off, off, off, off, on, off)])
# define loads
loads = LoadsKaramba(ForceVector=Z_2, Local=True, PosInd=pull.ClosestPoint, LCase=0, mode="Point")
supp = SupportKaramba(PosInd=evalsrf_2.Point, PlaneOfReference=evalsrf_2.Frame, menu=[buttons(on, on, on, off, on, off)])
crosec = CrossSectionKaramba([crosecselect.CrossSection, crosecselect_2.CrossSection, crosecselect_3.CrossSection])
# assemble model
assemble = AssembleModelKaramba(
    Elem=orientate,
    Support=supp,
    Load=loads,
    CrossSection=crosec,
    Material=matselect,
    Joint=beam_joints,
    LimitDistance_m=0.005)  # -> Model, Info, Mass_kg, CenterOfGravity
# eliminate members
# under tension
panel_7 = Panel("""C1
C2""")
tencomelim = TensionCompressionEliminator(
    Model=assemble.Model,
    MaximumIerations=20,
    BeamIdentifiers=panel_7,
    LoadCaseToConsider=0,
    CompressionElementsOnly=Toggle(False))  # -> MaximumDisplacement, OptimizedModel, ElementIsActive
# analyze model
analyzethi = AnalyzeThIKaramba(Model=tencomelim.OptimizedModel)  # -> CalculatedModel, MaximumDisplacement_m, ResultingForceOfGravity_kN, ElasticEnergy_kNm
# view results
modelview = ModelViewKaramba(Model=analyzethi.CalculatedModel, LoadCaseFactorsForLinearSuperposition=1, IndexIncrementOfVisibleLoadcase=0)  # -> Model, DeformedMesh, DeformedAxes, DeformedModel
beamview = BeamViewKaramba(Model=modelview.Model)  # -> Model, MeshesOfRenderedBeams, DeformedBeamAxes, LegendColors, LegendTags

# ==== cluster Cluster
S = ClusterInput()
V = ClusterInput()
merge = Merge(Data1=V, Data2="0")
sdivide = DivideSurface(Surface=S, UCount="1", VCount=V)  # -> Points, Normals, Parameters
cull_i = CullIndex(List=sdivide.Points, Indices=reverse(graft(merge)), Wrap=True)
cull_i_2 = CullIndex(List=sdivide.Points, Indices=graft(merge), Wrap=True)
flip = FlipMatrix(Data=cull_i)
flip_2 = FlipMatrix(Data=sdivide.Points)
flip_3 = FlipMatrix(Data=cull_i_2)
pline = PolyLine(Vertices=sdivide.Points, Closed=False)
pline_2 = PolyLine(Vertices=flip_2, Closed=False)
pline_3 = PolyLine(Vertices=flip_3, Closed=False)
pline_4 = PolyLine(Vertices=flip, Closed=False)
entwine = Entwine(Branch00=pline, Branch01=pline_2, Branch02=pline_3, Branch03=pline_4, FlattenInputs=True)
explode = Explode(Curve=entwine, Recursive=True)  # -> Segments, Vertices
trim = TrimTree(Tree=explode.Segments, Depth=1)
curvepoint = PointOnCurve(trim, parameter=0.5)
srf_cp = SurfaceClosestPoint(Point=curvepoint, Surface=S)  # -> Point, UVPoint, Distance
evalsrf = EvaluateSurface(Surface=S, Point=srf_cp.UVPoint)  # -> Point, Normal, Frame
T = ClusterOutput(trim)
N = ClusterOutput(evalsrf.Normal)
