# Grasshopper definition 03_SingleSpanBeam.gh (Grasshopper 0.9.76)
# Copyright: B+G Engineers
# plug-ins: Karamba

i = Slider(17, range=10..30)
# create geometry
pt = Point(Point(0.6132713423, 1.260593929, 0))
pt_2 = Point(Point(10.61327134, 1.260593929, 0))
aligndim = AlignedDimension(Plane=PlaneXY(0, 0, 0), PointA=pt, PointB=pt_2, Offset=-2, Text="{0:0.00}", Size=0.2)
range = Range(Domain=Domain(0, 1), Steps=i)
ln = Line(StartPoint=pt, EndPoint=pt_2)
f = Slider(-7.2, range=-10..10)
i_2 = Slider(0, range=0..10)
# define cross sections
crosecrselect = CrossSectionRangeSelectorKaramba(MaximumHeight_cm=-1, MaximumWidth_cm=-1, menu=[dropdown(0), dropdown(1), dropdown(1)])
# 01 - Single Span Beam
# Difficulty: Simple (TRIAL/PRO versions only)
# A single span beam with two supports and a uniform line load is analyzed using the cross section optimizer to find the optimal cross sections for each element. The moment section forces can be visualized in the Beam View component.
# The FREE version does not include the Cross Section Optimizer.
# convert line to beam
shatter = Shatter(Curve=ln, Parameters=range)
# define supports
hframe = HorizontalFrame(Curve=ln, Parameter=0)
Z = UnitZ(Factor=f)
# define materials
matselect = MaterialSelectionKaramba(menu=[dropdown(1), dropdown(2)])
crosecselect = CrossSectionSelectorKaramba(NameOrListIndexOfCrossSection=i_2, CrossSections=crosecrselect)  # -> CrossSection, Info
# define loads
loads = LoadsKaramba(Vector=Z, LCase=0, mode="Uniform Line", menu=[buttons(off, on, off)])
linetobeam = LineToBeamKaramba(Line=shatter, New=True, Remove=True, LimitDistance_m=0.005)  # -> Points, Element, Info
supp = SupportKaramba(PosInd=[pt, pt_2], PlaneOfReference=hframe, menu=[buttons(on, on, on, on, off, off)])
# assemble model
assemble = AssembleModelKaramba(
    Elem=linetobeam.Element,
    Support=supp,
    Load=loads,
    CrossSection=crosecselect.CrossSection,
    Material=matselect,
    LimitDistance_m=0.005)  # -> Model, Info, Mass_kg, CenterOfGravity
# analyze model (FREE version)
analyzethi = AnalyzeThIKaramba(Model=assemble.Model)  # -> CalculatedModel, MaximumDisplacement_m, ResultingForceOfGravity_kN, ElasticEnergy_kNm; disabled
# optimize cross sections
opticrosec = OptimizeCrossSectionKaramba(
    Model=assemble.Model,
    CrossSections=crosecrselect,
    MaximumUtilization=1,
    MaximumDisplacement_m=-1,
    UltimateLimitStateIterations=5,
    DisplacementIterations=5,
    NumberOfSamplePoints=3,
    ElasticDesign=True,
    GammaM0=1,
    GammaM1=1)  # -> ModelWithOptimizedCrossSections, Info, Mass_kg, MaximumDisplacement_m, ElasticEnergy_kNm
# view results
modelview = ModelViewKaramba(
    Model=opticrosec.ModelWithOptimizedCrossSections,
    LoadCaseFactorsForLinearSuperposition=1,
    IndexIncrementOfVisibleLoadcase=0)  # -> Model, DeformedMesh, DeformedAxes, DeformedModel
# view results
modelview_2 = ModelViewKaramba(Model=analyzethi.CalculatedModel, LoadCaseFactorsForLinearSuperposition=1, IndexIncrementOfVisibleLoadcase=0)  # -> Model, DeformedMesh, DeformedAxes, DeformedModel; disabled
beamview = BeamViewKaramba(Model=modelview.Model)  # -> Model, MeshesOfRenderedBeams, DeformedBeamAxes, LegendColors, LegendTags
beamview_2 = BeamViewKaramba(Model=modelview_2.Model)  # -> Model, MeshesOfRenderedBeams, DeformedBeamAxes, LegendColors, LegendTags; disabled
