# Grasshopper definition 04_Optimization_TrussDiagonals.gh (Grasshopper 0.9.76)
# Copyright: B+G Engineers
# plug-ins: Karamba

# create geometry
height = Slider(2.7, range=0..10)
supports = Point([Point(5, 5, 0), Point(30, 15, 0)])
item = ListItem(List=supports, Index=0, Wrap=True)  # -> Item, Item1
# parameters for
# diagonal positions
genes = GenePool(
    Decimals=3,
    Maximum=1,
    Minimum=0,
    Value=[0.3326426634, 0.4035162006, 0.461122981, 0.3451533552, 0.7471741153, 0.8528221244, 0.09686245588, 0.2756032712, 0.5772949572, 0.487292093, 0.9233898096, 0.5127084006, 0.2060340313, 0.09750883519, 0.2125902531, 0.2376841759])
aligndim = AlignedDimension(Plane=PlaneXY(0, 0, 0), PointA=item.Item, PointB=item.Item1, Offset=-2, Text="{0:0.00}", Size=0.5)
panel = Panel("""0
1""")
multiplication = Multiplication(A=height, B=panel)
panel_2 = Panel("""0.0
0.0""")
panel_3 = Panel("""1.0
1.0""")
# 03 - Optimization of Truss Diagonals
# Difficulty: Simple (FREE/PRO version only)
# Here Galapagos is set up to play around with the position of the diagonals of a truss to achieve minimum deflection.
# Instead of using line geometry to generate the beams, here indices of the points are used to create the beams and supports.
Z = UnitZ(Factor=multiplication)
merge = Merge(Data1=flatten(panel_2), Data2=flatten(genes), Data3=flatten(panel_3))
partition = PartitionList(List=merge, Size="2")
interp = InterpolateData(Data=supports, Parameter=partition, Interpolation=2)
addition = Addition(A=Z, B=interp)
cluster = Cluster(L=flatten(partition))  # -> S, A
panel_4 = Panel("""0
Int(x-2)""")
lng = ListLength(List=flatten(partition))
eval = Evaluate(F=panel_4, x=lng)
dispatch = Dispatch(List=supports, DispatchPattern=[True, False])  # -> ListA, ListB
panel_5 = Panel(cluster.A)
panel_6 = Panel(cluster.S)
# Here Galapagos is set up to play around with the position of the diagonals of a truss to achieve minimum deflection
number_slider = Slider(20.2, range=5..35)
panel_7 = Panel(eval)
vec2pt = Vector2Pt(PointA=dispatch.ListA, PointB=dispatch.ListB, Unitize=False)  # -> Vector, Length
cull_i = CullIndex(List=reverse(panel_5), Indices=0, Wrap=True)  # -> reverse(List)
# define supports
dispatch_2 = Dispatch(List=panel_7, DispatchPattern=[True, False])  # -> ListA, ListB
align = AlignPlane(Plane=dispatch.ListA, Direction=vec2pt.Vector)  # -> Plane, Angle
cull_i_2 = CullIndex(List=panel_5, Indices=0, Wrap=True)
# convert lines to beams
dispatch_3 = Dispatch(List=panel_6, DispatchPattern=[True, False])  # -> ListA, ListB
ids = Panel("X")
ids_2 = Panel("""A
B""")
ids_3 = Panel("B")
Z_2 = UnitZ(Factor="-5")
cross_sections = CrossSectionsKaramba(Diameter_cm=number_slider, WallThickness_cm=expr("x*0.05", number_slider), mode="Circular Hollow")
indtobeam = IndexToBeamKaramba(IndexA=cull_i_2, IndexB=cull_i, BeamIdentifier=graft(ids_2))
indtobeam_2 = IndexToBeamKaramba(IndexA=dispatch_3.ListA, IndexB=dispatch_3.ListB, BeamIdentifier=ids)
supp = SupportKaramba(PosInd=dispatch_2.ListA, Plane=align.Plane, menu=[buttons(off, on, on, on, off, off)])
supp_2 = SupportKaramba(PosInd=dispatch_2.ListB, Plane=align.Plane, menu=[buttons(on, on, on, on, off, off)])
# define loads
loads = LoadsKaramba(Vector=Z_2, BeamIdentifierS=ids_3, LCase=0, mode="Uniform Line", menu=[buttons(off, on, off)])
pt = Point(flatten(addition))
# assemble model
assemble = AssembleModelKaramba(
    Point=pt,
    Elem=flatten([indtobeam_2, indtobeam]),
    Support=flatten([supp, supp_2]),
    Load=flatten(loads),
    CrossSection=flatten(cross_sections),
    LDist=0.005)  # -> Model, Info, Mass, CenterOfGravity
# optimise diagonal positions
galapagos = Galapagos(fitness=displace, gene=genes)
# analyse model
analyzethi = AnalyzeThIKaramba(Model=assemble.Model)  # -> ModelWithDisplacements, MaximumDisplacement_m, ResultingForceOfGravity_kN, ElasticEnergy_kNm
displace = Number(analyzethi.MaximumDisplacement_m)
# view results
modelview = ModelViewKaramba(Model=analyzethi.ModelWithDisplacements, LoadCaseFactorsForLinearSuperposition=1, IndexIncrementOfVisibleLoadcase=0)  # -> Model, MeshOfRendering, DeformedStructure, DeformedModel
beamview = BeamViewKaramba(Model=modelview.Model)  # -> Model, MeshOfRendering, DeformedBeamAxes, LegendColors, LegendTags

# ==== cluster Cluster
L = ClusterInput()
lng = ListLength(List=L)
series = Series(Start=0, Step=1, Count=lng)
partition = PartitionList(List=L, Size="2")
partition_2 = PartitionList(List=series, Size="2")
flip = FlipMatrix(Data=partition)
flip_2 = FlipMatrix(Data=partition_2)
sort = SortList(Keys=flip, ValuesA=flip_2)  # -> Keys, simplify(ValuesA)
S = ClusterOutput(series)
A = ClusterOutput(sort.ValuesA)
