# Grasshopper definition 05_InputCurvesAsTruss.gh (Grasshopper 0.9.76)
# plug-ins: Karamba

# ---- group: input curves, explode into segments; divide at intersections / rhino input curves
crv = Curve([<curve referenced from the Rhino model> x3])

# ---- group: ROLLER support point; snap to nearest node in model / rhino input points
pt = Point(<point referenced from the Rhino model>)

# ---- group: PIN support point; snap to nearest node in model / rhino input points
pt_2 = Point(<point referenced from the Rhino model>)

# ---- group: LOAD points; snap to nearest node in model / rhino input points
pt_3 = Point([<point referenced from the Rhino model> x3])

# ---- group: input curves, explode into segments; divide at intersections
# This work is licensed under a Creative Commons Attribution 4.0 licence. You are free to copy, communicate and adapt the work, so long as you attribute the work in the manner specified by the author or licensor (but not in any way that suggests that they endorse you or your use of the work). A copy of this licence is available at http://http://creativecommons.org/licenses/by/4.0/ or write to info@creativecommons.org
# to apply to a new model:
# right-click and set multiple curves;
# 
# ** pay close attention to intersections of rhino curves; karamba will not read joints if lines are not intersecting
explode = Explode(Curve=crv, Recursive=True)  # -> flatten(Segments), Vertices
llinter = LineLineIntersectionKaramba(Line=explode.Segments, LengthTolerance=0.01)  # -> IntersectionPoints, flatten(LineSubSegements)

# ----
# Structural Performance Feedback:
# 
# 1.1 BASICS: input curves as truss
# introduces karamba input and analysis
# demonstrates support types
# demonstrates axial restriction on beams
# DOMAIN:      curves analyzed as beams
# 
# ATTRIBUTES: demonstrating utilization/displacement
# 
# OPERATIONS: none: no design operations result from attribute analysis
# All definitions are organized according to:
# DOMAIN (model framework)
# ATTRIBUTES (what is being measured?)
# OPERATIONS (what is changing based on measurements?)
# This definition takes curve input from rhino, converts them to beams and measures performance under loading conditions
# 
# steps to alter:
# 
# 
# 1. change slider that controls loads: notice the behavior of the hinge and roller supports as truss deflects
# 2. toggle the "modify element" component to change beams to axial-only loads; hinged joints
# 3. turn control points on in rhino to adjust the geometry of the truss
panel_2 = Panel(" ")

# ---- group: dead load
Z = UnitZ(Factor="-1")
loads = LoadsKaramba(Vector=Z, LCase=0, mode="Gravity")
panel_3 = Panel(loads)

# ---- group: live load applied as uniform distributed (mesh) loads / extreme load magnitude to show results
live_load = Slider(-24.82, range=-50..-0.04)

# ---- group: (OPTIONAL) apply cross-section / list of karamba standard cross-sections
readcstable = ReadCrossSectionTableFromFileKaramba()  # -> CrossSection, Info
panel_4 = Panel(readcstable.CrossSection)

# ---- group: (OPTIONAL) apply cross-section / smallest W section is #378 in list
panel_5 = Panel("378")

# ---- group: (OPTIONAL) apply cross-section
crosecselect = CrossSectionSelectorKaramba(ElementsIdentifiers="beams", NameOrListIndexOfCrossSection=panel_5, CrossSections=readcstable.CrossSection)  # -> flatten(CrossSection), Info
panel_6 = Panel(crosecselect.CrossSection)

# ----
linetobeam = LineToBeamKaramba(Line=llinter.LineSubSegements, New=True, Remove=True, LimitDistance_m=0.005, BeamIdentifier="beams")  # -> flatten(Points), Element, Info

# ---- group: ROLLER support point; snap to nearest node in model
# to apply to a new model:
# right-click and set multiple points;
# 
# ** points must be near intended supports;
# definition will automatically snap to closest node in model
fsim = FindSimilarMember(Data=pt, Set=linetobeam.Points)  # -> Hit, Index

# ---- group: PIN support point; snap to nearest node in model
# to apply to a new model:
# right-click and set multiple points;
# 
# ** points must be near intended supports;
# definition will automatically snap to closest node in model
fsim_2 = FindSimilarMember(Data=pt_2, Set=linetobeam.Points)  # -> Hit, Index

# ---- group: LOAD points; snap to nearest node in model
fsim_3 = FindSimilarMember(Data=pt_3, Set=linetobeam.Points)  # -> Hit, Index

# ---- group: pin support
supp = SupportKaramba(PosInd=fsim_2.Hit, menu=[buttons(on, on, on, on, off, on)])

# ---- group: out of plane support for all nodes
supp_2 = SupportKaramba(PosInd=linetobeam.Points, menu=[buttons(off, on, off, on, off, on)])

# ---- group: roller support
supp_3 = SupportKaramba(PosInd=fsim.Hit, menu=[buttons(off, on, on, on, off, on)])

# ---- group: live load applied as uniform distributed (mesh) loads
# ** note: low mesh density can
# result in uneven distribution of load
# LIVE LOAD REFERENCE:
# ref: The Structural Basis of Architecture, Sandaker et al.
# residential (typical) 	2 kN/m2  	.04 kip/ft2
# office (tyipcal)  			3 kN/m2  	.06 kip/ft2
# public plazas  	12 kN/m2  	.25 kip/ft2
# athletic facilities (typical)  5 kN/m2  	.1 kip/ft2
# hospitals (operating rooms)  3 kN/m2   .06 kip/ft2
# libraries (book stacks)  7 kN/m2   .15 kip/ft2
# manufacturing (typical)  6 kN/m2   .125 kip/ft2
# heavy equipment   12 kN/m2   .25 kip/ft2
# schools (classrooms)   2 kN/m2   .04 kip/ft2
# schools (hallways)   5 kN/m2   .1 kip/ft2
Z_2 = UnitZ(Factor=live_load)

# ----
# Karamba Input
# ROLLER support can translate in the x
# direction and rotate about the y axis
# PIN support cannot translate in any direction
# but  can rotate about the y axis
# restrain all nodes out of plane for 2d analysis
support = SupportKaramba([supp, supp_3])
loads_2 = LoadsKaramba(ForceVector=Z_2, Local=True, PosInd=fsim_3.Hit, LCase=0, mode="Point")

# ---- group: This toggle restricts beams to axial loads if set to false
# an ideal truss has hinged joints and
#  members carry only axial loads
toggle = BooleanToggle(True)
modifyelem = ModifyElementKaramba(Beam=linetobeam.Element, Bending=toggle, mode="Beam")  # -> flatten(Element)

# ---- group: assemble elements and analyze
assemble = AssembleModelKaramba(
    Elem=modifyelem,
    Support=[support, supp_2],
    Load=[loads, loads_2],
    CrossSection=crosecselect.CrossSection,
    LimitDistance_m=0.005)  # -> Model, Info, Mass_kg, CenterOfGravity
analyzethi = AnalyzeThIKaramba(Model=assemble.Model)  # -> CalculatedModel, MaximumDisplacement_m, ResultingForceOfGravity_kN, ElasticEnergy_kNm

# ---- group: internal forces
# NOTES:
# - You can call a specific group of beams using the 'BeamIds' input
# - adding '3' to the resolution input provides values at the middle of each beam in addition to the two ends (default)
panel_7 = Panel("3")
b_forces = BeamForcesKaramba(
    AnalyzedModel=analyzethi.CalculatedModel,
    LCase=-1,
    MaximumDistanceBetweenResults_m=-1,
    NumberOfResultsPerBeamElement=panel_7)  # -> AnalyzedModel, NormalForce_kN, ShearForceVz_kN, ShearForceVy_kN, BendingMomentMt_kNm, BendingMomentMy_kNm, BendingMomentMz_kNm
panel_8 = Panel(b_forces.NormalForce_kN)

# ---- group: Beam Displacement
# NOTES:
# - You can call a specific group of beams using the 'BeamIds' input
# - adding '3' to the resolution input provides values at the middle of each beam in addition to the two ends (default)
panel_9 = Panel("3")
beamdisp = BeamDisplacementsKaramba(
    AnalyzedModel=analyzethi.CalculatedModel,
    LoadCase=-1,
    MaximumDistanceBetweenResults_ft=-1,
    NumberOfResultsPerElement=panel_9)  # -> AnalyzedModel, simplify(Translations_ft), Rotations_rad
panel_10 = Panel(beamdisp.Translations_ft)

# ---- group: max displacement for the model
panel_11 = Panel(analyzethi.MaximumDisplacement_m)

# ----
# Karamba Output
modelview = ModelViewKaramba(Model=analyzethi.CalculatedModel, LoadCaseFactorsForLinearSuperposition=1, IndexIncrementOfVisibleLoadcase=0)  # -> Model, DeformedMesh, DeformedAxes, DeformedModel

# ----
# This definition is only visualizing analysis results; results are not used to make changes or perform further design operations.
# This definition is only visualizing analyzis results; no specific attributes are measured for further operations.
# NOTE:
# If you want to SEE the deformation with the beam visualization plug in the BeamView AFTER the ModelView. The numerical data is the SAME if you plug BeamView directly into the Analyze component.
beamview = BeamViewKaramba(Model=modelview.Model)  # -> Model, MeshesOfRenderedBeams, DeformedBeamAxes, LegendColors, LegendTags
