# Grasshopper definition 06_InputSurfacesAsShell.gh (Grasshopper 0.9.76)
# plug-ins: Karamba

# ---- group: Custom Weak Material
matprops = MaterialPropertiesKaramba(
    ElementsIdentifiers="shell01",
    YoungsModulus_kN_cm2="500",
    ShearModulus_kN_cm2="200",
    SpecificWeight_kN_m3=78.5,
    CoefficientOfThermalExpansion_1_C=1e-05,
    YieldStrength_kN_cm2="2",
    Name="rubber")
# Plug this into the assemble component to inentionally weaken material (more exaggerated resutls)
panel = Panel(matprops)

# ---- group: input rhino surface
# This work is licensed under a Creative Commons Attribution 4.0 licence. You are free to copy, communicate and adapt the work, so long as you attribute the work in the manner specified by the author or licensor (but not in any way that suggests that they endorse you or your use of the work). A copy of this licence is available at http://http://creativecommons.org/licenses/by/4.0/ or write to info@creativecommons.org
brep = Brep(<brep referenced from the Rhino model>)

# ---- group: mesh division density
number_slider = Slider(19, range=0..100)

# ----
# Structural Performance Feedback:
# 
# 1.2 BASICS: input surface, analyze as shell
# introduces karamba input and analysis
# demonstrates automatic assigning of supports
# demonstrates force flow in shell
# DOMAIN:      surface analyzed as shell
# 
# ATTRIBUTES: demonstrating utilization + force flow,
# no attributes are highlighted for further operations
# 
# OPERATIONS: none: no design operations result from attribute analysis
# All definitions are organized according to:
# DOMAIN (model framework)
# ATTRIBUTES (what is being measured?)
# OPERATIONS (what is changing based on measurements?)
# This definition takes surface input from rhino, converts them to shells and measures performance under loading conditions
# 
# steps to alter:
# 
# 
# 1. change slider that controls the mesh density
# 2. change the support positions: notice the behavior of the principle stress lines
# 3. change the load directions
panel_3 = Panel(" ")

# ----
# to apply to a new model:
# right-click and set multiple curves;
# 
# ** pay close attention to intersections of rhino curves; karamba will not read joints if lines are not intersecting
mesh_uv = MeshSurface(Surface=brep, UCount=number_slider, VCount=number_slider, Overhang=True, Equalize=False)

# ----
# Karamba Input
panel_4 = Panel("shell")
meshtoshell = MeshToShellKaramba(Mesh=mesh_uv, LDist=0.005, Identifier=panel_4)  # -> Point, Element, Info
rdpoints = RemoveDuplicatePointsKaramba(Point=meshtoshell.Point, LDist=0.005)  # -> OutPoint, Info, Indexes
points = PointList(Points=rdpoints.OutPoint, Size=Slider(0.116, range=0..1))

pt = Point(rdpoints.OutPoint)

# ---- group: Add supports at extreme x-value points (either side of shell)
pdecon = Deconstruct(Point=pt)  # -> XComponent, YComponent, ZComponent

# ---- group: Add supports at lowest z-value points (bottom of shell)
pdecon_2 = Deconstruct(Point=pt)  # -> XComponent, YComponent, ZComponent

# ---- group: Add loads at highest z-value
pdecon_3 = Deconstruct(Point=pt)  # -> XComponent, YComponent, ZComponent

# ---- group: Add supports at lowest z-value points (bottom of shell) / find lowest z value
sort = SortList(Keys=pdecon_2.ZComponent)  # -> Keys, ValuesA
item = ListItem(List=sort.Keys, Index="0", Wrap=True)

# ---- group: Add supports at lowest z-value points (bottom of shell) / add tolerance
expression = Expression(x=item, y=Slider(0, range=0..10), Expression="x+y")

# ---- group: Add loads at highest z-value / find highest z-value
sort_2 = SortList(Keys=pdecon_3.ZComponent)  # -> Keys, ValuesA
rev = ReverseList(List=sort_2.Keys)
item_2 = ListItem(List=rev, Index="0", Wrap=True)

# ---- group: Add supports at extreme x-value points (either side of shell) / find lowest x value
sort_3 = SortList(Keys=pdecon.XComponent)  # -> Keys, ValuesA
item_3 = ListItem(List=sort_3.Keys, Index="0", Wrap=True)

# ---- group: Add supports at extreme x-value points (either side of shell) / find highst x value
rev_2 = ReverseList(List=sort_3.Keys)
item_4 = ListItem(List=rev_2, Index="0", Wrap=True)

# ---- group: Add supports at extreme x-value points (either side of shell) / find all points with the same x value
smaller = SmallerThan(FirstNumber=pdecon.XComponent, SecondNumber=item_3)  # -> SmallerThan, OrEqualTo
cull = CullPattern(List=pt, CullPattern=smaller.OrEqualTo)

larger = LargerThan(FirstNumber=pdecon.XComponent, SecondNumber=item_4)  # -> LargerThan, OrEqualTo
cull_2 = CullPattern(List=pt, CullPattern=larger.OrEqualTo)

# ---- group: Add supports at lowest z-value points (bottom of shell) / find all points with the same z value (+ added tolerance)
smaller_2 = SmallerThan(FirstNumber=pdecon_2.ZComponent, SecondNumber=expression)  # -> SmallerThan, OrEqualTo
cull_3 = CullPattern(List=pt, CullPattern=smaller_2.OrEqualTo)

# ---- group: Add loads at highest z-value / find all points with the same z value
larger_2 = LargerThan(FirstNumber=pdecon_3.ZComponent, SecondNumber=item_2)  # -> LargerThan, OrEqualTo
cull_4 = CullPattern(List=pt, CullPattern=larger_2.OrEqualTo)

# ---- group: LOWEST Z supports
supp = SupportKaramba(PosInd=cull_3, menu=[buttons(on, on, on, on, on, off)])

# ---- group: END X supports
supp_2 = SupportKaramba(PosInd=[cull, cull_2], menu=[buttons(on, on, on, on, on, off)])

# ---- group: dead load
Z = UnitZ(Factor="-1")
loads = LoadsKaramba(Vector=Z, LCase=0, mode="Gravity")
panel_5 = Panel(loads)

# ---- group: (OPTIONAL) apply cross-section
cross_sections = CrossSectionsKaramba(ElementsIdentifiers="shell", Heights_in=Slider(4, range=0..10), mode="Shell")

# ---- group: point load applied in negative z axis (vertical load) / extreme load magnitude to show results
live_load = Slider(-9.832, range=-50..-0.04)

# ---- group: point load applied in x axis (lateral load) / extreme load magnitude to show results
live_load_2 = Slider(-4.152, range=-50..-0.04)

# ----
# ALTERNATE support input between
# points on the bottom (lowest z value) and
# either end (extreme x values) of the shell
# by plugging in a different support component on the left
support = SupportKaramba(supp_2)

# ---- group: point load applied in negative z axis (vertical load)
Z_2 = UnitZ(Factor=live_load)
loads_2 = LoadsKaramba(ForceVector=Z_2, Local=True, PosInd=cull_4, LCase=0, mode="Point")

# ---- group: point load applied in x axis (lateral load)
Z_3 = UnitZ(Factor=live_load_2)
loads_3 = LoadsKaramba(ForceVector=Z_3, Local=True, PosInd=cull_4, LCase=0, mode="Point")

# ----
# ALTERNATE loads between vertical and lateral
# by plugging in a different load component below
load = LoadKaramba(flatten([loads_2, loads]))

# ---- group: assemble elements and analyze
assemble = AssembleModelKaramba(Elem=meshtoshell.Element, Support=support, Load=load, LimitDistance_m=0.005)  # -> Model, Info, Mass_kg, CenterOfGravity
analyzethi = AnalyzeThIKaramba(Model=assemble.Model)  # -> CalculatedModel, MaximumDisplacement_m, ResultingForceOfGravity_kN, ElasticEnergy_kNm

# ---- group: max displacement for the model
panel_6 = Panel(analyzethi.MaximumDisplacement_m)

# ----
# Karamba Output
# NOTE:
# If you want to SEE the deformation with the shell visualization,  plug in ShellView AFTER ModelView. The numerical data is the SAME if you plug BeamView directly into the Analyze component.
modelview = ModelViewKaramba(Model=analyzethi.CalculatedModel, LoadCaseFactorsForLinearSuperposition=1, IndexIncrementOfVisibleLoadcase=0)  # -> Model, DeformedMesh, DeformedAxes, DeformedModel

shellview = ShellViewKaramba(Model=modelview.Model)  # -> Model, MeshesOfRenderedShells, LegendColors, LegendTags
legend = Legend(Colour=shellview.LegendColors, Tags=shellview.LegendTags, LegendType=1)

# ---- group: reduce mesh point density with cull pattern
panel_7 = Panel("""0
0
0
0
0
1""")
cull_5 = CullPattern(List=rdpoints.OutPoint, CullPattern=panel_7)

# ---- group: map principal stress lines at each point
shelllineresults = LineResultsOnShellsKaramba(
    AnalyzedModel=shellview.Model,
    Layer=0,
    ListOfSourcesOfPrincipalStressLinesLinesPoints=cull_5,
    SegmentLength_m=0.5,
    DA_deg=5,
    mode="PrincStress")  # -> AnalyzedModel, Lines1, Lines2

# ----
# This definition is only visualizing analysis results; results are not used to make changes or perform further design operations.
panel_8 = Panel("250")

# ---- group: blue
rgb = ColourRGB(Alpha=255, Red=0, Green=0, Blue=panel_8)
preview = CustomPreview(Geometry=shelllineresults.Lines1, Shader=rgb)

# ---- group: red
rgb_2 = ColourRGB(Alpha=255, Red=panel_8, Green=0, Blue=0)
preview_2 = CustomPreview(Geometry=shelllineresults.Lines2, Shader=rgb_2)
