# Grasshopper definition 08_ShellCrossSectionOptimization.gh (Grasshopper 0.9.76)
# plug-ins: Karamba

# create geometry - change the input
# points to create a difference surface
pt = Point([Point(-30.29866546, -3.508493978, 0), Point(-30.29866546, -1.169497993, 0), Point(-30.29866546, 1.169497993, 0), Point(-30.29866546, 3.508493978, 0), Point(-19.80304532, -5.223412372, 3.46494229), Point(-19.80304532, -3.301380148, 0.2402272391)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])
panel = Panel("""{0,0,0}
{0,1,0}""")
panel_2 = Panel("""{1,0,0}
{1,1,0}""")
srfgrid = SurfaceFromPoints(Points=pt, UCount="6", Interpolate=False)
evalsrf = EvaluateSurface(Surface=reparameterize(srfgrid), Point=panel_2)  # -> Point, Normal, Frame
evalsrf_2 = EvaluateSurface(Surface=reparameterize(srfgrid), Point=panel)  # -> Point, Normal, Frame

panel_3 = Panel("""{0,0,0}
{0.125,0.25,0}
{0.25,0.5,0}
{0.375,0.75,0}
{0.5,1,0}
{0.625,1,0}
{0.75,1,0}
{0.875,1,0}
{1,1,0}""")
item = ListItem(List=[evalsrf.Point, evalsrf_2.Point], Index=0, Wrap=True)  # -> Item, Item1, Item2, Item3
iso = IsoCurve(Surface=reparameterize(srfgrid), UVPoint=panel_3)  # -> UIsocurve, VIsocurve
aligndim = AlignedDimension(
    Plane=PlaneXY(0, 0, 0),
    PointA=[item.Item, item.Item2],
    PointB=[item.Item2, item.Item3],
    Offset=Slider(4.2, range=0..10),
    Text="{0:0.00}",
    Size=Slider(0.7, range=0..1))

pline = PolyLine(Vertices=evalsrf.Point, Closed=False)
pline_2 = PolyLine(Vertices=evalsrf_2.Point, Closed=False)
res = Slider(1.5, range=0.5..6)
dom²num = ConstructDomain²(UMin="0", UMax="1", VMin="0.25", VMax="0.75")
# 02 - Shell Cross Section Optimization
# Difficulty: Simple (TRIAL/PRO versions only)
# The cross sections of a concrete shell bridge with an arc form are optimized. A mesh load runs along the center of the bridge. Custom colours can be plugged into the ModelViewer for the mesh preview.
# To view in the TRIAL version, set the Mesh Resolution to 6 and the Edge Refinement Factor to 1.
# convert lines to beams
mesh_breps = MeshBreps(
    Brep=srfgrid,
    MeshResolution=res,
    EdgeRefinementFactor=0.67,
    PointReduction=True,
    SmoothingStepSize=0.8,
    SmoothingIterations=5)  # -> Mesh, Info
subsrf = Isotrim(Surface=reparameterize(srfgrid), Domain=dom²num)
range = Range(Domain="10 to 110", Steps=20)
expression = Expression(x="Shell", y=range, Expression="x&\" \"&y")
mesh_breps_2 = MeshBreps(
    Brep=subsrf,
    MeshResolution=0.5,
    EdgeRefinementFactor=0.67,
    PointReduction=False,
    SmoothingStepSize=0,
    SmoothingIterations=5)  # -> Mesh, Info
# define cross sections
panel_4 = Panel("S")
Z = UnitZ(Factor="-5")
cross_sections = CrossSectionsKaramba(FamilyNameOfCrossSection="Shell", NameOfCrossSection=graft(expression), Heights_cm=graft(range), mode="Shell")  # -> flatten(CrossSection)
# define materials
matselect = MaterialSelectionKaramba(menu=[dropdown(2), dropdown(6)])
crosecselect = CrossSectionSelectorKaramba(ElementsIdentifiers=panel_4, NameOrListIndexOfCrossSection="0", CrossSections=cross_sections)  # -> CrossSection, Info
loads = LoadsKaramba(Vector=Z, Mesh=mesh_breps_2.Mesh, LCase=0, mode="Mesh Load", menu=[buttons(off, on, off), buttons(on, off)])
# define loads
loads_2 = LoadsKaramba(Vector=Vector(0, 0, -1), LCase=0, mode="Gravity")
meshtoshell = MeshToShellKaramba(Mesh=mesh_breps.Mesh, LDist=0.005, Identifier="S")  # -> Point, Element, Info
pt_2 = Point(meshtoshell.Point)
pt_3 = Point(meshtoshell.Point)
pull = PullPoint(Point=pt_2, Geometry=pline, ClosestOnly=True)  # -> ClosestPoint, Distance
pull_2 = PullPoint(Point=pt_3, Geometry=pline_2, ClosestOnly=True)  # -> ClosestPoint, Distance
smaller = SmallerThan(FirstNumber=pull.Distance, SecondNumber=0.01)  # -> SmallerThan, OrEqualTo
smaller_2 = SmallerThan(FirstNumber=pull_2.Distance, SecondNumber=0.01)  # -> SmallerThan, OrEqualTo
# define supports
cull = CullPattern(List=pt_2, CullPattern=smaller.SmallerThan)
cull_2 = CullPattern(List=pt_3, CullPattern=smaller_2.SmallerThan)
supp = SupportKaramba(PosInd=cull, menu=[buttons(on, on, on, off, off, off)])
supp_2 = SupportKaramba(PosInd=cull_2, menu=[buttons(on, on, on, off, off, off)])
# assemble model
assemble = AssembleModelKaramba(
    Elem=flatten(meshtoshell.Element),
    Support=flatten([supp, supp_2]),
    Load=flatten([loads_2, loads]),
    CrossSection=flatten(crosecselect.CrossSection),
    Material=flatten(matselect),
    LimitDistance_m=0.005)  # -> Model, Info, Mass_kg, CenterOfGravity
range_2 = Range(Domain=Domain(0, 1), Steps=10)
panel_5 = Panel("0.20")
gradient = Gradient(
    LowerLimit=0,
    UpperLimit=1,
    Parameter=range_2,
    stops=[0: RGB(243, 57, 0), 0.1: RGB(236, 27, 60), 0.2: RGB(210, 0, 118), 0.3: RGB(103, 0, 120), 0.4: RGB(39, 72, 161), 0.5: RGB(1, 192, 229), 0.6: RGB(18, 178, 90), 0.7: RGB(79, 186, 8), 0.8: RGB(220, 237, 32), 0.9: RGB(247, 159, 20), 1: RGB(243, 57, 0)])
panel_6 = Panel("""255
255
255
175
0
0
0""")
panel_7 = Panel("""0
0
255
255
255
0
0""")
# optimize cross sections
opticrosec = OptimizeCrossSectionKaramba(
    Model=assemble.Model,
    CrossSections=cross_sections,
    MaximumUtilization=1,
    MaximumDisplacement_m=-1,
    UltimateLimitStateIterations=5,
    DisplacementIterations=5,
    NumberOfSamplePoints=3,
    ElasticDesign=True,
    GammaM0=1,
    GammaM1=1)  # -> ModelWithOptimizedCrossSections, Info, Mass_kg, MaximumDisplacement_m, ElasticEnergy_kNm
rgb = ColourRGB(Alpha=255, Red=panel_6, Green=panel_7, Blue=reverse(panel_6))
displacement = Panel(opticrosec.MaximumDisplacement_m)
# view results
modelview = ModelViewKaramba(
    Model=opticrosec.ModelWithOptimizedCrossSections,
    LoadCaseFactorsForLinearSuperposition=1,
    IndexIncrementOfVisibleLoadcase=0,
    ListOfColorsForColoringPlots=rgb)  # -> Model, DeformedMesh, DeformedAxes, DeformedModel
shellview = ShellViewKaramba(Model=modelview.Model)  # -> Model, MeshesOfRenderedShells, LegendColors, LegendTags
legend = Legend(Colour=shellview.LegendColors, Tags=shellview.LegendTags, LegendType=1)
