# Grasshopper definition 01_InformedGeometryScaleModuleEdgesByInnerForces.gh (Grasshopper 0.9.76)
# plug-ins: Karamba

# reference geometry from rhino
pipeline = GeometryPipeline(
    GroupByLayer=False,
    GroupByType=False,
    IncludeHidden=True,
    IncludeLocked=True,
    LayerFilter="input_module",
    NameFilter="*",
    TypeFilter=1073741848)
pipeline_2 = GeometryPipeline(
    GroupByLayer=False,
    GroupByType=False,
    IncludeHidden=True,
    IncludeLocked=True,
    LayerFilter="input_surface",
    NameFilter="*",
    TypeFilter=1073741848)
pipeline_3 = GeometryPipeline(
    GroupByLayer=False,
    GroupByType=False,
    IncludeHidden=True,
    IncludeLocked=True,
    LayerFilter="input supports",
    NameFilter="*",
    TypeFilter=1073741849)
srf = Surface(pipeline_2)
offset = OffsetLoose(Surface=srf, Distance=Slider(1.5, range=0..3), Retrim=True)
divide = DivideDomain²(Domain=Domain2(u=0..1, v=0..1), UCount=Slider(8, range=2..10), VCount=Slider(6, range=2..20))
# 05 - Informed Geometry Scale Module Edges by Inner Forces
# Difficulty: Hard (FREE/PRO versions only)
# The properties of modules are made dependent on the internal forces of the structure which is a tetrahedral space grid. Make sure to open the Rhino File which has the reference geometry.
subsrf = Isotrim(Surface=reparameterize(srf), Domain=divide)
subsrf_2 = Isotrim(Surface=reparameterize(offset), Domain=divide)
sdivide = DivideSurface(Surface=srf, UCount="1", VCount="1")  # -> flatten(Points), Normals, Parameters
explode = BrepComponents(Brep=subsrf)  # -> Faces, Edges, Vertices
explode_2 = BrepComponents(Brep=subsrf_2)  # -> Faces, Edges, Vertices
item = ListItem(List=sdivide.Points, Index=0, Wrap=True)  # -> Item, Item1, Item2, Item3
flip = FlipMatrix(Data=explode.Vertices)
flip_2 = FlipMatrix(Data=explode_2.Vertices)
srf_2 = Surface(pipeline)
aligndim = AlignedDimension(
    Plane=PlaneXY(0, 0, 0),
    PointA=[item.Item, item.Item2],
    PointB=[item.Item1, item.Item],
    Offset=-2,
    Text="{0:0.00}",
    Size=1)
bang = ExplodeTree(Data=flip)  # -> Branch0, Branch1, Branch2, Branch3
bang_2 = ExplodeTree(Data=flip_2)  # -> Branch0, Branch1, Branch2, Branch3
edges = BrepEdges(Brep=srf_2)  # -> Naked, Interior, NonManifold
join = JoinCurves(Curves=edges.Naked, Preserve=False)  # -> flatten(Curves)
tbox = TwistedBox(
    CornerA=bang.Branch0,
    CornerB=bang.Branch1,
    CornerC=bang.Branch2,
    CornerD=bang.Branch3,
    CornerE=bang_2.Branch0,
    CornerF=bang_2.Branch1,
    CornerG=bang_2.Branch2,
    CornerH=bang_2.Branch3)
box = Box2Pt(PointA=Point(0, 0, 0), PointB=Point(1, 1, 1), Plane=PlaneXY(0, 0, 0))
morph = BoxMorph(Geometry=join, Reference=box, Target=graft(tbox))
explode_3 = Explode(Curve=morph, Recursive=True)  # -> Segments, Vertices
end = EndPoints(Curve=explode_3.Segments)  # -> Start, End
ln = Line(StartPoint=end.Start, EndPoint=end.End)  # -> simplify(Line)
rdlines = RemoveDuplicateLinesKaramba(Line=flatten(ln), LDist=0.005)  # -> OutLine, Info, Indexes
# convert lines to beams
linetobeam = LineToBeamKaramba(Line=rdlines.OutLine, New=True, Remove=True, LDist=0.005)  # -> Point, Beam, Info
pt = Point(linetobeam.Point)
brepsinc = PointInBreps(Brep=pipeline_3, Point=pt, Strict=False)  # -> Inside, Index
cull = CullPattern(List=pt, CullPattern=brepsinc.Inside)
# define supports
supp = SupportKaramba(PosInd=flatten(cull), menu=[buttons(on, on, on, on, off, off)])
# define loads
gravity_load = Gravity(Vector=Vector(0, 0, -1), LCase=0, mode="Gravity")
# assemble model
assemble = AssembleModelKaramba(Elem=linetobeam.Beam, Support=supp, Load=gravity_load, LDist=0.005)  # -> Model, Info, Mass, CenterOfGravity
# analyze model
analyze = AnalyzeKaramba(Model=assemble.Model)  # -> ModelWithDisplacements, MaximumDisplacement, ResultingForceOfGravity, ElasticEnergy
# view results
modelview = ModelViewKaramba(Model=analyze.ModelWithDisplacements, LoadCaseFactorsForLinearSuperposition=1, IndexIncrementOfVisibleLoadcase=0)  # -> Model, DeformedMesh, DeformedAxes, DeformedModel
beamview = BeamViewKaramba(Model=modelview.Model)  # -> Model, MeshesOfRenderedBeams, DeformedBeamAxes, LegendColors, LegendTags

# ----
# switch between normal
# or moment forces
# remap values for offset
b_res_force = BeamResultantForcesKaramba(AnalyzedModel=analyze.ModelWithDisplacements, LCase=-1, MaximumProbingDistance_m=-1, NumberOfProbingPointsPerElement=3)  # -> AnalyzedModel, flatten(NormalForce_kN), flatten(ResultantBendingMoment_kNm), ResultantShearForce_kN
n_m = BooleanToggle(False)
filter = StreamFilter(Gate=n_m, Stream0=b_res_force.NormalForce_kN, Stream1=b_res_force.ResultantBendingMoment_kNm)
abs = Absolute(Value=filter)
sort = SortList(Keys=abs)  # -> Keys, ValuesA
item_2 = ListItem(List=sort.Keys, Index=0, Wrap=True)  # -> Item1, Item
dom = Domain(DomainStart=Slider(0.05, range=0..1), DomainEnd=Slider(0.84, range=0..1))
dom_2 = Domain(DomainStart=item_2.Item, DomainEnd=item_2.Item1)
remap = RemapNumbers(Value=abs, Source=dom_2, Target=dom)  # -> Mapped, Clipped

# ----
# select values neighbouring each face
# edgeCrv for planarSrf
crv = Curve(flatten(rdlines.OutLine))
join_2 = JoinCurves(Curves=ln, Preserve=False)  # -> flatten(Curves)
curvepoint = PointOnCurve(crv, parameter=0.5)
crv_cp = CurveCP(Point=flatten(curvepoint), Curve=graft(join_2))  # -> Point, Parameter, Distance
pcen = PolygonCenter(Polyline=graft(join_2))  # -> CenterV, CenterE, CenterA
sort_2 = SortList(Keys=crv_cp.Distance, ValuesA=crv)  # -> Keys, ValuesA
sort_3 = SortList(Keys=crv_cp.Distance, ValuesA=curvepoint)  # -> Keys, ValuesA
sort_4 = SortList(Keys=crv_cp.Distance, ValuesA=remap.Mapped)  # -> Keys, ValuesA
panel = Panel("""0
1
2""")
item_3 = ListItem(List=sort_2.ValuesA, Index=panel, Wrap=True)
item_4 = ListItem(List=sort_3.ValuesA, Index=panel, Wrap=True)
item_5 = ListItem(List=sort_4.ValuesA, Index=panel, Wrap=True)
vec2pt = Vector2Pt(PointA=item_4, PointB=pcen.CenterV, Unitize=False)  # -> Vector, Length
amp = Amplitude(Vector=vec2pt.Vector, Amplitude=item_5)
explode_4 = Explode(Curve=join_2, Recursive=True)  # -> Segments, Vertices
move = Move(Geometry=item_3, Motion=amp)  # -> simplify(Geometry), Transform
vdis = VectorDisplay(Anchors=item_4, Vectors=amp)
flip_3 = FlipMatrix(Data=explode_4.Vertices)
shift = ShiftList(List=move.Geometry, Shift=1, Wrap=True)
bang_3 = ExplodeTree(Data=flip_3)  # -> Branch0, Branch1, Branch2, Branch3
ccx = CurveCurve(CurveA=move.Geometry, CurveB=shift)  # -> Points, ParamsA, ParamsB
pl_3pt = Plane3Pt(PointA=bang_3.Branch0, PointB=bang_3.Branch1, PointC=bang_3.Branch2)  # -> flatten(Plane)
path_mapper = PathMapper(ccx.Points, source="{A;B;C}", target="{A}")
hull = ConvexHull(Points=path_mapper, Plane=simplify(graft(pl_3pt)))  # -> simplify(Hull), HullZ, Indices

fillet_inner_edges = BooleanToggle(True)
fillet_outer_edges = BooleanToggle(False)
avr = Average(Input=amp)  # -> flatten(ArithmeticMean)
fillet = Fillet(Curve=join_2, Radius=0.05)
fillet_2 = Fillet(Curve=hull.Hull, Radius=0.15)
filter_2 = StreamFilter(Gate=fillet_inner_edges, Stream0=hull.Hull, Stream1=fillet_2)
bnd = Bounds(Numbers=avr)
filter_3 = StreamFilter(Gate=fillet_outer_edges, Stream0=join_2, Stream1=fillet)
remap_2 = RemapNumbers(Value=avr, Source=bnd, Target=Domain(0, 1))  # -> Mapped, Clipped
merge = Merge(Data1=simplify(filter_2), Data2=simplify(graft(filter_3)))
gradient = Gradient(
    LowerLimit=0,
    UpperLimit=1,
    Parameter=remap_2.Mapped,
    stops=[0: RGB(243, 57, 0), 0.1: RGB(236, 27, 60), 0.2: RGB(210, 0, 118), 0.3: RGB(103, 0, 120), 0.4: RGB(39, 72, 161), 0.5: RGB(1, 192, 229), 0.6: RGB(18, 178, 90), 0.7: RGB(79, 186, 8), 0.8: RGB(220, 237, 32), 0.9: RGB(247, 159, 20), 1: RGB(243, 57, 0)])
planar = PlanarSrf(Edges=merge)
preview = CustomPreview(Geometry=planar, Shader=graft(gradient))
