# Grasshopper definition 02_InformedGeometryScaleOpeningsByInnerForces.gh (Grasshopper 0.9.76)
# plug-ins: Karamba, MeshEdit Components

# reference geometry from rhino
pipeline = GeometryPipeline(
    GroupByLayer=False,
    GroupByType=False,
    IncludeHidden=True,
    IncludeLocked=True,
    LayerFilter="input_surface",
    NameFilter="*",
    TypeFilter=1073741848)
number_slider = Slider(12, range=2..20)
number_slider_2 = Slider(10, range=2..20)
pipeline_2 = GeometryPipeline(
    GroupByLayer=False,
    GroupByType=False,
    IncludeHidden=True,
    IncludeLocked=True,
    LayerFilter="input supports",
    NameFilter="*",
    TypeFilter=1073741848)
srf = Surface(pipeline)
sdivide = DivideSurface(Surface=srf, UCount=1, VCount=1)  # -> flatten(Points), Normals, Parameters
sdivide_2 = DivideSurface(Surface=srf, UCount=number_slider, VCount=number_slider_2)  # -> Points, Normals, Parameters
frompoints = MeshFromPoints(Points=flatten(sdivide_2.Points), UDirection=expr("x+1", number_slider), VDirection=expr("x+1", number_slider_2))
item = ListItem(List=sdivide.Points, Index=0, Wrap=True)  # -> Item, Item1, Item2, Item3
aligndim = AlignedDimension(
    Plane=PlaneXY(0, 0, 0),
    PointA=[item.Item, item.Item1],
    PointB=[item.Item1, item.Item3],
    Offset=-2,
    Text="{0:0.00}",
    Size=1)
# 05 - Informed Geometry - Scale Openings by Inner Forces
# Difficulty: Hard
# Shows how to scale the size of openings on a surface depending on internal forces.  Make sure to open the Rhino File (05_InformedGeometry) which has the reference geometry.
# Reduce the surface U & V Count to 2 for viewing in the TRIAL version
faceb = FaceBoundaries(Mesh=frompoints)

# ---- group: cell outlines
crv = Curve(faceb)

# ----
explode = Explode(Curve=crv, Recursive=True)  # -> Segments, Vertices
rdlines = RemoveDuplicateLinesKaramba(Line=flatten(explode.Segments), LimitDistance=0.005)  # -> OutLine, Info, Indexes
# convert lines to beams
linetobeam = LineToBeamKaramba(Line=rdlines.OutLine, New=True, Remove=True, LimitDistance_m=0.005)  # -> Points, Element, Info
pt = Point(linetobeam.Points)
brepsinc = PointInBreps(Brep=pipeline_2, Point=pt, Strict=False)  # -> Inside, Index
cull = CullPattern(List=pt, CullPattern=brepsinc.Inside)
# define supports
supp = SupportKaramba(PosInd=cull, menu=[buttons(on, on, on, on, off, off)])
# define loads
loads = LoadsKaramba(Vector=Vector(0, 0, -1), LCase=0, mode="Gravity")
# assemble model
assemble = AssembleModelKaramba(Elem=flatten(linetobeam.Element), Support=flatten(supp), Load=flatten(loads), LimitDistance_m=0.005)  # -> Model, Info, Mass_kg, CenterOfGravity
# analyze model
analyzethi = AnalyzeThIKaramba(Model=assemble.Model)  # -> CalculatedModel, MaximumDisplacement_m, ResultingForceOfGravity_kN, ElasticEnergy_kNm
curvepoint = PointOnCurve(explode.Segments, parameter=0.5)
curvepoint_2 = PointOnCurve(rdlines.OutLine, parameter=0.5)
# view results
modelview = ModelViewKaramba(Model=analyzethi.CalculatedModel, LoadCaseFactorsForLinearSuperposition=1, IndexIncrementOfVisibleLoadcase=0)  # -> Model, DeformedMesh, DeformedAxes, DeformedModel
fsim = FindSimilarMember(Data=curvepoint, Set=curvepoint_2)  # -> Hit, simplify(Index)
beamview = BeamViewKaramba(Model=modelview.Model)  # -> Model, MeshesOfRenderedBeams, DeformedBeamAxes, LegendColors, LegendTags
b_res_force = BeamResultantForcesKaramba(AnalyzedModel=analyzethi.CalculatedModel, LoadCase=-1, MaximumProbingDistance_m=-1, NumberOfProbingPointsPerElement=3)  # -> AnalyzedModel, NormalForce_kN, ResultantBendingMoment_kNm, ResultantShearForce_kN
# switch between normal
# or moment forces
n_m = BooleanToggle(True)
filter = StreamFilter(Gate=n_m, Stream0=b_res_force.NormalForce_kN, Stream1=b_res_force.ResultantBendingMoment_kNm)
# disassemble model
disassemble = DisassembleModelKaramba(Model=b_res_force.AnalyzedModel)  # -> Model, Point, Beam, Shell, Support, Load, Line, Mesh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
int = Integer(fsim.Index)
abs = Absolute(Value=filter)
sqrt = SquareRoot(Value=abs)
item_2 = ListItem(List=sqrt, Index=int, Wrap=True)
item_3 = ListItem(List=disassemble.Line, Index=int, Wrap=True)
bnd = Bounds(Numbers=flatten(item_2))
remap = RemapNumbers(Value=item_2, Source=bnd, Target=Domain(0, 1))  # -> Mapped, Clipped
graph = GraphMapper(remap.Mapped, x0=0, x1=1, y0=0, y1=1, container_name="Bezier", cpx=[0, 0.2849262655, 0.1706542969, 1], cpy=[1, 1, 0, 0])
flip = FlipCurve(Curve=item_3, Guide=explode.Segments)  # -> Curve, Flag
remap_2 = RemapNumbers(Value=graph, Source=Domain(0, 1), Target="0.4 to 0.95")  # -> Mapped, Clipped
end = EndPoints(Curve=flip.Curve)  # -> Start, End
shift = ShiftList(List=remap_2.Mapped, Shift=-1, Wrap=True)
gradient = Gradient(
    LowerLimit=0,
    UpperLimit=1,
    Parameter=graph,
    stops=[0: RGB(234, 38, 0), 0.25: RGB(234, 126, 0), 0.5: RGB(254, 244, 84), 0.75: RGB(173, 203, 249), 1: RGB(75, 107, 169)])
avr = Average(Input=[end.Start, end.End])
expression = Expression(x=remap_2.Mapped, y=shift, Expression="(x+y)/2")
scale = Scale(Geometry=end.Start, Center=avr, Factor=expression)  # -> Geometry, Transform
end_2 = EndPoints(Curve=flip.Curve)  # -> Start, End
shift_2 = ShiftList(List=gradient, Shift=-1, Wrap=True)
expression_2 = Expression(x=gradient, y=shift_2, Expression="(x+y)/2")
pt_2 = Point(simplify(end_2.Start))
pt_3 = Point(simplify(scale.Geometry))
item_4 = ListItem(List=expression_2, Index=0, Wrap=True)
item_5 = ListItem(List=pt_2, Index=0, Wrap=True)
item_6 = ListItem(List=pt_3, Index=0, Wrap=True)
merge = Merge(Data1=expression_2, Data2=item_4, Data3=expression_2, Data4=item_4)
merge_2 = Merge(Data1=pt_2, Data2=item_5, Data3=pt_3, Data4=item_6)
lng = ListLength(List=pt_2)
# offset faces
frompoints_2 = MeshFromPoints(Points=merge_2, UDirection=2, VDirection=expr("x+1", lng), Colour=merge)  # -> flatten(Mesh)
