# Grasshopper definition 03_LargeDeformationVoronoiGridshell.gh (Grasshopper 0.9.76)
# Copyright: B+G Engineers
# plug-ins: Karamba, MeshEdit Components, Weaverbird

Z = UnitZ(Factor=1)
# create geometry
pt = Point([Point(8.666055418, 8.465737706, 0), Point(40.95674764, 4.607729938, 0), Point(28.92526197, 22.60767562, 0), Point(2.278675989, 24.28851277, 0)])
addition = Addition(A=pt, B=Z)
item = ListItem(List=pt, Index=0, Wrap=True)  # -> Item, Item1, Item2, Item3
pt_2 = Point(addition)
pline = PolyLine(Vertices=pt_2, Closed=True)
aligndim = AlignedDimension(
    Plane=PlaneXY(0, 0, 0),
    PointA=[item.Item, item.Item3],
    PointB=[item.Item1, item.Item],
    Offset=-2,
    Text="{0:0.00}",
    Size=1)
# 04 - Large Deformation of a Voronoi Gridshell
# Difficulty: Hard (PRO version only)
# Using the Large Deformation Analysis we can simulate the behaviour of a hanging model to find the optimum form for a Voronoi gridshell.
# The Beam Joint Agent component releases rotation in 2 axes at the connection with the columns.
boundary = BoundarySurfaces(Edges=pline)
popgeo = PopulateGeometry(Geometry=boundary, Count=Slider(7, range=0..20), Seed=1)
voronoi = Voronoi(Points=flatten(popgeo), BruteForceOverride=False)
incurve = PointInCurve(Point=pt_2, Curve=graft(voronoi))  # -> Relationship, Point
trim = TrimWithRegion(Curve=voronoi, Region=pline)  # -> Inside, Outside
cull = CullPattern(List=pt_2, CullPattern=incurve.Relationship)
disc = Discontinuity(Curve=trim.Inside, Level=1)  # -> Points, Parameters
merge = Merge(Data1=simplify(cull), Data2=simplify(disc.Points))
path_mapper = PathMapper(merge, source=["{A}", "{A;B}"], target=["{A}", "{A}"])
del = DelaunayMesh(Points=path_mapper, Plane=PlaneXY(0, 0, 0))
f = Slider(2.5, range=0..3)
medges = MeshEdges(Mesh=del)  # -> NakedEdges, InteriorEdges, NonManifoldEdges
len = Length(Curve=medges.NakedEdges)
expression = Expression(x=len, y=f, Expression="max(int(x*y/2)*2,2)")
area = MeshArea(Mesh=del)  # -> Area, Centroid
divide = DivideCurve(Curve=medges.NakedEdges, Count=expression, Kinks=False)  # -> simplify(Points), Tangents, Parameters
multiplication = Multiplication(A=area.Area, B=f)
trim_2 = TrimTree(Tree=divide.Points, Depth=1)
popgeo_2 = PopulateGeometry(Geometry=del, Count=multiplication, Seed=1, Points=trim_2)  # -> simplify(Population)
cullpt = CullDuplicates(Points=[trim_2, popgeo_2], Tolerance=0.1, CullMode=3)  # -> Points, Indices, Valence
del_2 = DelaunayMesh(Points=cullpt.Points, Plane=PlaneXY(0, 0, 0))
cluster = Cluster(C=trim.Inside, B=Slider(0.8, range=0.5..2))
wblaplace = WeaverbirdsLaplacianSmoothing(MeshCurves=del_2, Level=Slider(14, range=0..20), SmoothNakedEdges=0, Thin=1)
panel = Panel("""1
0
0.5""")
medges_2 = MeshEdges(Mesh=wblaplace)  # -> NakedEdges, InteriorEdges, NonManifoldEdges
range = Range(Domain="5 to 25", Steps=10)
line = LineSDL(Start=cluster, Direction=Vector(0, 0, 1), Length=-1)
entwine = Entwine(Branch00=medges_2.NakedEdges, Branch01=medges_2.InteriorEdges, Branch02=line, FlattenInputs=True)
ids = Panel("""A
B
S""")
cluster_2 = Cluster_2(M=wblaplace)  # -> P, M_2
panel_2 = Panel(ids)
project = Project(Geometry=cluster, Plane=PlaneXY(0, 0, 0))  # -> Geometry, Transform
concat = Concatenate(FragmentA="R", FragmentB=range)
Z_2 = UnitZ(Factor=1)
panel_3 = Panel("""A
B""")
section = Box(
    FamilyNameOfCrossSection="R",
    NameOfCrossSection=concat,
    Diameter_cm=range,
    WallThickness_cm=expr("x*0.05", range),
    mode="Circular Hollow")
lng = ListLength(List=section)  # -> expr("x-1", Length)
multiplication_2 = Multiplication(A=lng, B=panel)
# define cross sections
crosecselect = CrossSectionSelectorKaramba(ElementsIdentifiers=graft(panel_2), NameOrListIndexOfCrossSection=graft(multiplication_2), CrossSections=section)  # -> flatten(CrossSection), Info
# convert lines to beams
linetobeam = LineToBeamKaramba(Line=entwine, New=True, Remove=True, LDist_m=0.005, Identifier=graft(ids))  # -> Points, flatten(Element), Info
# release joints
joint_agent = BeamJointAgentKaramba(
    AtElementIdentifiers=panel_3,
    ToElementIdentifiers="S",
    Ct_kN_m=Vector(0, 0, 0),
    Cr_kNm_rad="{0.1,0.1,0.1}",
    menu=[buttons(off, off, off, off, on, on)])
# define supports
supp = SupportKaramba(PosInd=project.Geometry, menu=[buttons(on, on, on, off, off, off)])
supp_2 = SupportKaramba(PosInd=cluster_2.P, menu=[buttons(on, on, off, off, off, off)])
# define loads
gravity_load = Gravity(Vector=Z_2, LCase=0, mode="Gravity")
# assemble model
assemble = AssembleModelKaramba(
    Elem=flatten(linetobeam.Element),
    Support=flatten([supp, supp_2]),
    Load=flatten(gravity_load),
    CrossSection=flatten(crosecselect.CrossSection),
    Joint=flatten(joint_agent),
    LDist=0.005)  # -> Model, Info, Mass, CenterOfGravity
d = Slider(8, range=0..30)
# perform large
# deformation analysis
panel_4 = Panel("25")
ladeform = LargeDeformationAnalysisKaramba(Model=assemble.Model, Iterations=panel_4, MaximumDisplacement_m=d)  # -> CalculatedModel, MaximumDisplacement_m
weldvertices = MeshWeldVertices(Mesh=cluster_2.M_2, Tolerance=0.01)  # -> RuntimeMessage, Mesh
Z_3 = UnitZ(Factor="-10")
# reassemble model
disassemble = DisassembleModelKaramba(Model=ladeform.CalculatedModel)  # -> Model, Point, Beam, Shell, Support, Load, Line, Mesh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
loads = LoadsKaramba(Vector=Z_3, Mesh=weldvertices.Mesh, LCase=0, mode="Mesh Load", menu=[buttons(off, on, off), buttons(on, off)])
# redefine supports
supp_3 = SupportKaramba(PosInd=project.Geometry, menu=[buttons(on, on, on, on, on, on)])
# redefine loads
loads_2 = LoadsKaramba(Vector=Vector(0, 0, -1), LCase=0, mode="Gravity")
crosec = CrossSectionKaramba(section)
assemble_2 = AssembleModelKaramba(
    Point=flatten(disassemble.Point),
    Elem=flatten(disassemble.Beam),
    Support=flatten(supp_3),
    Load=flatten([loads_2, loads]),
    CrossSection=flatten(crosec),
    LimitDistance_m=0.005)  # -> Model, Info, Mass_kg, CenterOfGravity
# cross section
# optimization
opticrosec = OptimizeCrossSectionKaramba(
    Model=assemble_2.Model,
    CrossSections=section,
    MaximumUtilization=1,
    MaximumDisplacement_m=-1,
    UltimateLimitStateIterations=5,
    DisplacementIterations=5,
    NumberOfSamplePoints=3,
    ElasticDesign=True,
    GammaM0=1,
    GammaM1=1)  # -> ModelWithOptimizedCrossSections, Info, Mass_kg, MaximumDisplacement_m, ElasticEnergy_kNm
# view results
modelview = ModelViewKaramba(
    Model=opticrosec.ModelWithOptimizedCrossSections,
    LoadCaseFactorsForLinearSuperposition=1,
    IndexIncrementOfVisibleLoadcase=0)  # -> Model, MeshOfRendering, DeformedStructure, DeformedModel
beamview = BeamViewKaramba(Model=modelview.Model)  # -> Model, MeshesOfRenderedBeams, DeformedBeamAxes, LegendColors, LegendTags
legend = Legend(Colour=beamview.LegendColors, Tags=beamview.LegendTags, LegendType=1)

# ==== cluster Cluster
C = ClusterInput()
explode = Explode(Curve=C, Recursive=True)  # -> Segments, Vertices
len = Length(Curve=explode.Segments)
avr = Average(Input=flatten(len))
B = ClusterInput()
multiplication = Multiplication(A=avr, B=B)
curvepoint = PointOnCurve(explode.Segments, parameter=0.5)
larger = LargerThan(FirstNumber=len, SecondNumber=multiplication)  # -> LargerThan, OrEqualTo
cull = CullPattern(List=curvepoint, CullPattern=larger.LargerThan)  # -> flatten(List)
cullpt = CullDuplicates(Points=flatten(cull), Tolerance=0.1, CullMode=3)  # -> Points, Indices, Valence
P = ClusterOutput(cullpt.Points)

# ==== cluster Cluster_2
M = ClusterInput()
mjoin = MeshJoin(Meshes=flatten(M))
M_2 = ClusterOutput(mjoin)
weldvertices = MeshWeldVertices(Mesh=mjoin, Tolerance=0.01)  # -> RuntimeMessage, Mesh
nakededge = MeshNakedEdge(Mesh=weldvertices.Mesh)  # -> V, A, B
sort = SortList(Keys=[nakededge.A, nakededge.B])  # -> Keys, ValuesA
dcon = DeleteConsecutive(Set=sort.Keys, Wrap=False)  # -> Set, Count
item = ListItem(List=nakededge.V, Index=dcon.Set, Wrap=True)
cullpt = CullDuplicates(Points=flatten(item), Tolerance=0.1, CullMode=3)  # -> Points, Indices, Valence
P = ClusterOutput(cullpt.Points)
