# Grasshopper definition 04_ProjectedVoronoiPatternGridshell.gh (Grasshopper 0.9.76)
# Copyright: B+G Engineers
# plug-ins: Karamba

pt = Point([Point(3.327000821, 4.650775012, 0), Point(9.219793822, 0.9540431692, 0), Point(26.46719328, 1.757260388, 7.389493176), Point(27.47623261, 3.906008056, 7.437447087), Point(21.37015162, 15.37001021, 0), Point(15.80988716, 18.31487448, 0), Point(2.254486923, 18.65425393, 7.879748359), Point(1.099614045, 14.76551155, 8.807656018)])
nurbs = NurbsCurve(Vertices=pt, Degree=3, Periodic=True)  # -> reparameterize(Curve), Length, Domain
patch = Patch(Curves=nurbs.Curve, Spans="12", Flexibility=1, Trim=True)
panel = Panel("""10
18""")
cluster = Cluster_2(C=nurbs.Curve)  # -> crv_2, P, P_2
# 05 - Projected Voronoi Pattern Gridshell
# Difficulty: Hard (PRO version only)
# A Voronoi pattern is projected onto a surface. The cross section optimizer is used to specify the thickness of each member.
# By using the Beam Orient component, each element can be orientated individually to align with the input surface.
divide = DivideCurve(Curve=nurbs.Curve, Count=Slider(50, range=0..100), Kinks=False)  # -> Points, Tangents, Parameters
popgeo = PopulateGeometry(Geometry=patch, Count=Slider(28, range=0..100), Seed=1)
edges = BrepEdges(Brep=patch)  # -> Naked, Interior, NonManifold
project = Project(Geometry=cluster.crv_2, Plane=PlaneXY(0, 0, 0))  # -> Geometry, Transform
aligndim = AlignedDimension(Plane=PlaneXY(0, 0, 0), PointA=cluster.P, PointB=cluster.P_2, Offset=graft(panel), Text="{0:0.00}", Size=1)
voronoi = Voronoi(Points=flatten([popgeo, divide.Points]), BruteForceOverride=False)
preview = CustomPreview(
    Geometry=project.Geometry,
    Shader={ambient=RGB(0, 0, 0), diffuse=RGB(255, 105, 180), emission=RGB(76, 32, 54), shine=0.5, specular=RGB(255, 255, 255), transparency=0})
explode = Explode(Curve=voronoi, Recursive=True)  # -> Segments, Vertices
rdlines = RemoveDuplicateLinesKaramba(Line=flatten(explode.Segments), LDist=0.005)  # -> OutLine, Info, Indexes
project_2 = Project(Curve=rdlines.OutLine, Brep=patch, Direction=Vector(0, 0, 1))
# create beam axis
end = EndPoints(Curve=project_2)  # -> Start, End
crv_cp = CurveClosestPoint(Point=flatten([end.Start, end.End]), Curve=edges.Naked)  # -> Point, Parameter, Distance
smaller = SmallerThan(FirstNumber=crv_cp.Distance, SecondNumber="0.01")  # -> SmallerThan, OrEqualTo
cull = CullPattern(List=crv_cp.Parameter, CullPattern=smaller.SmallerThan)
shatter = Shatter(Curve=edges.Naked, Parameters=cull)
topoly = CurveToPolyline(Curve=shatter, ToleranceDistance="0.01", ToleranceAngle="pi/16")  # -> Polyline, Segments
explode_2 = Explode(Curve=topoly.Polyline, Recursive=True)  # -> flatten(Segments), Vertices
ln = Line(StartPoint=end.Start, EndPoint=end.End)  # -> flatten(Line)
genes = GenePool(Decimals=3, Maximum=1, Minimum=0, Value=[0.048, 0.089, 0.507, 0.554])
entwine = Entwine(Branch00=ln, Branch01=explode_2.Segments, FlattenInputs=True)
beam_ids = Panel("""A
B""")
eval = EvaluateCurve(Curve=reparameterize(edges.Naked), Parameter=genes)  # -> Point, Tangent, Angle
range = Range(Domain="8 to 36", Steps="10")
range_2 = Range(Domain="0.5 to 2", Steps="10")
eval_2 = Evaluate(F="family &\" \"& height &\"/\"& thickH", family="FRQ", height="32", width=range, thickH=range_2)
# convert line to beam
linetobeam = LineToBeamKaramba(Line=entwine, New=True, Remove=True, LDist=0.005, Identifier=graft(beam_ids))  # -> Points, Element, Info
# define cross sections
beam_ids_2 = Panel("""A
B""")
beam_ids_3 = Panel("A")
beam_ids_4 = Panel("B")
mesh = MeshBrep(
    Brep=patch,
    Settings={GridMaxCount=0, GridMinCount=0, JaggedSeams=False, MaxEdgeLength=0.7, MinEdgeLength=0.7, MinTolerance=0, Refine=False, RefineAngle=0, RelativeTolerance=0, SimplePlanes=False, Tolerance=0})
Z = UnitZ(Factor="-2")
# define supports
pull = PullPoint(Point=eval.Point, Geometry=flatten([end.Start, end.End]), ClosestOnly=True)  # -> ClosestPoint, Distance
cluster_2 = Cluster(S=patch, curvepoint=entwine)
section = Box(
    FamilyNameOfCrossSection="FRQ",
    NameOfCrossSection=eval_2,
    Height_cm="32",
    UpperFlangeWidth_cm=range,
    LowerFlangeWidth_cm=range,
    UpperFlangeThickness_cm=range_2,
    LowerFlangeThickness_cm=range_2,
    SidewallsThickness_cm=range_2,
    FilletRadius_cm=0.6,
    mode="Box")
crosecselect = CrossSectionSelectorKaramba(ElementsIdentifiers=beam_ids_2, NameOrListIndexOfCrossSection="0", CrossSections=section)  # -> CrossSection, Info
joint_agent = BeamJointAgentKaramba(
    AtElementIdentifiers=beam_ids_3,
    ToElementIdentifiers=beam_ids_4,
    Ct_kN_m=Vector(0, 0, 0),
    Cr_kNm_rad=Vector(0, 0, 0),
    menu=[buttons(off, off, off, on, on, on)])
mesh_load = MeshLoad(Vector=Z, Mesh=mesh, LCase=0, mode="Mesh Load", menu=[buttons(off, on, off), buttons(off, on)])
supp = SupportKaramba(PosInd=pull.ClosestPoint, menu=[buttons(on, on, on, off, off, off)])
# orient beam
orientate = OrientateBeamKaramba(Beam=linetobeam.Element, ZAxis=cluster_2, Alpha_deg=0)
# define loads
gravity_load = Gravity(Vector=Vector(0, 0, -1), LCase=0, mode="Gravity")
# assemble model
assemble = AssembleModelKaramba(
    Elem=flatten(orientate),
    Support=flatten(supp),
    Load=flatten([gravity_load, mesh_load]),
    CrossSection=flatten(crosecselect.CrossSection),
    Joint=flatten(joint_agent),
    LDist=0.005)  # -> Model, Info, Mass, CenterOfGravity
# optimize cross sections
opticrosec = OptimizeCrossSectionKaramba(
    Model=assemble.Model,
    CrossSections=flatten(section),
    MaximumUtilization=1,
    MaximumDisplacement_m=-1,
    UltimateLimitStateIterations=5,
    DisplacementIterations=5,
    NumberOfSamplePoints=3,
    ElasticDesign=True,
    GammaM0=1,
    GammaM1=1)  # -> ModelWithOptimizedCrossSections, Info, Mass_kg, MaximumDisplacement_m, ElasticEnergy_kNm
modelview = ModelViewKaramba(
    Model=opticrosec.ModelWithOptimizedCrossSections,
    LoadCaseFactorsForLinearSuperposition=1,
    IndexIncrementOfVisibleLoadcase=0)  # -> Model, MeshOfRendering, DeformedStructure, DeformedModel
displacement = Panel(opticrosec.MaximumDisplacement_m)
# view results
mass = Panel(opticrosec.Mass_kg)
beamview = BeamViewKaramba(Model=modelview.Model)  # -> Model, MeshOfRendering, DeformedBeamAxes, LegendColors, LegendTags
legend = Legend(Colour=beamview.LegendColors, Tags=beamview.LegendTags, LegendType=1)

# ==== cluster Cluster
S = ClusterInput()
curvepoint = ClusterInput()
curvepoint_2 = PointOnCurve(curvepoint, parameter=0.5)
srf_cp = SurfaceClosestPoint(Point=curvepoint_2, Surface=reparameterize(S))  # -> Point, UVPoint, Distance
evalsrf = EvaluateSurface(Surface=reparameterize(S), Point=srf_cp.UVPoint)  # -> Point, Normal, Frame
N = ClusterOutput(evalsrf.Normal)

# ==== cluster Cluster_2
xy = XYPlane(Origin=Point(0, 0, 0))
C = ClusterInput()
x_tremez = Extremes(Curve=reparameterize(C), Plane=xy)  # -> Highest, Lowest
crv_cp = CurveClosestPoint(Point=[x_tremez.Highest, x_tremez.Lowest], Curve=reparameterize(C))  # -> graft(Point), Parameter, Distance
crv = Curve(C)
eval = EvaluateCurve(Curve=reparameterize(C), Parameter=expr("(x+0.5)%1", crv_cp.Parameter))  # -> graft(Point), Tangent, Angle
P = ClusterOutput(crv_cp.Point)
P_2 = ClusterOutput(eval.Point)
crv_2 = ClusterOutput(crv)
