# Grasshopper definition 05_Projectedarrayoflines.gh (Grasshopper 0.9.76)
# plug-ins: Karamba

# create beam axis
crv = Curve([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])
loft = Loft(Curves=crv, Options={Adjust=False, Closed=False, LoftEnds=0, LoftSimp=0, LoftType=0, Rebuild=10, Refit=0.01})
range = Range(Domain="0.3*pi to 0.8*pi", Steps=Slider(16, range=0..20))
range_2 = Range(Domain="0.8*pi to 1.3*pi", Steps=Slider(10, range=0..20))
# 05 - Projected Array of Lines
srf = Surface(loft)
pt = PointCylindrical(BasePlane=PlaneXY(0, 0, 0), Angle=range, Radius=1, Elevation=0)
pt_2 = PointCylindrical(BasePlane=PlaneXY(0, 0, 0), Angle=range_2, Radius=1, Elevation=0)
pt_3 = Point(Point(-0.3840705608, -10.0484383, 0))
pt_4 = Point(Point(8.094820132, 2.717709761, 0))
# Difficulty: Hard (PRO version only)
# A set of lines are projected onto a surface. The cross section optimiser determines the appropriate cross section sizes for each element. By setting eccentricites for the beam elements, the beams are aligned with the original surface.
line = LineSDL(Start=pt_3, Direction=pt, Length=40)
line_2 = LineSDL(Start=pt_4, Direction=pt_2, Length=40)
edges = BrepEdges(Brep=srf)  # -> Naked, Interior, NonManifold
project = Project(Curve=line, Brep=srf, Direction=Vector(0, 0, 1))  # -> flatten(Curve)
project_2 = Project(Curve=line_2, Brep=srf, Direction=Vector(0, 0, 1))  # -> flatten(Curve)
explode = Explode(Curve=edges.Naked, Recursive=True)  # -> Segments, Vertices
entwine = Entwine(Branch00=project, Branch01=project_2, Branch02=explode.Segments, FlattenInputs=True)
ccx = CurveCurve(CurveA=reparameterize(graft(entwine)), CurveB=flatten(entwine))  # -> simplify(Points), simplify(ParamsA), ParamsB
trim = TrimTree(Tree=ccx.ParamsA, Depth=1)
sort = SortList(Keys=trim)  # -> Keys, ValuesA
dcon = DeleteConsecutive(Set=sort.Keys, Wrap=False)  # -> Set, Count
consec = ConsecutiveDomains(Numbers=dcon.Set, Additive=False)
end = EndPoints(Curve=entwine)  # -> Start, End
panel = Panel("""0
1""")
subcrv = SubCurve(BaseCurve=reparameterize(graft(entwine)), Domain=consec)
rdpoints = RemoveDuplicatePointsKaramba(Point=flatten([end.Start, end.End]), LimitDistance=0.005)  # -> OutPoint, Info, Indexes
range_3 = Range(Domain="10 to 40", Steps="20")
expression = Expression(x="R", y="5", z=range_3, Expression="x & \" \" & y & \"x\" & z")
len = Length(Curve=subcrv)
item = ListItem(List=crv, Index=0, Wrap=True)  # -> Item1, Item
pt_5 = Point(flatten(rdpoints.OutPoint))
expression_2 = Expression(x=len, y=Slider(0.33, range=0..1), Expression="max((x/y),2)")
crv_2 = Curve([item.Item1, item.Item])
end_2 = EndPoints(Curve=crv_2)  # -> Start, End
aligndim = AlignedDimension(Plane=PlaneXY(0, 0, 0), PointA=end_2.Start, PointB=end_2.End, Offset=1, Text="{0:0.00}", Size=0.2)
pull = PullPoint(Point=pt_5, Geometry=crv_2, ClosestOnly=True)  # -> ClosestPoint, Distance
reb = RebuildCurve(Curve=subcrv, Degree=1, Count=expression_2, Tangents=False)
# define cross sections
cross_sections = CrossSectionsKaramba(
    FamilyNameOfCrossSection="R",
    NameOfCrossSection=expression,
    Height_cm=range_3,
    UpperFlangeWidth_cm="5",
    LowerFlangeWidth_cm="5",
    UpperFlangeThickness_cm="1",
    LowerFlangeThickness_cm="1",
    SidewallsThickness_cm=0.4,
    FilletRadius_cm=0.6,
    mode="Box")
smaller = SmallerThan(FirstNumber=pull.Distance, SecondNumber=0.01)  # -> SmallerThan, OrEqualTo
explode_2 = Explode(Curve=reb, Recursive=True)  # -> simplify(Segments), Vertices
Z = UnitZ(Factor=expr("(-x/2)", range_3))
Z_2 = UnitZ(Factor="-20")
mesh = MeshBrep(
    Brep=srf,
    Settings={GridMaxCount=0, GridMinCount=0, JaggedSeams=False, MaxEdgeLength=0.5, MinEdgeLength=0.5, MinTolerance=0, Refine=True, RefineAngle=0, RelativeTolerance=0.65, SimplePlanes=False, Tolerance=0})
cull = CullPattern(List=pt_5, CullPattern=smaller.SmallerThan)
beam_ids = Panel("""A
B
C""")
trim_2 = TrimTree(Tree=explode_2.Segments, Depth=2)
branch = TreeBranch(Tree=trim_2, Path=panel, MaintainPaths=True)  # -> flatten(Branch)
end_3 = EndPoints(Curve=branch)  # -> Start, End
lng = ListLength(List=end_3.Start)
pull_2 = PullPoint(Point=end_3.Start, Geometry=edges.Naked, ClosestOnly=True)  # -> ClosestPoint, Distance
pull_3 = PullPoint(Point=end_3.End, Geometry=edges.Naked, ClosestOnly=True)  # -> ClosestPoint, Distance
series = Series(Start=0, Step=1, Count=lng)
smaller_2 = SmallerThan(FirstNumber=pull_2.Distance, SecondNumber=0.001)  # -> SmallerThan, OrEqualTo
smaller_3 = SmallerThan(FirstNumber=pull_3.Distance, SecondNumber=0.001)  # -> SmallerThan, OrEqualTo
int = Integer(series)
cull_2 = CullPattern(List=int, CullPattern=smaller_2.SmallerThan)
cull_3 = CullPattern(List=int, CullPattern=smaller_3.SmallerThan)
# set eccentricities for
# cross sections
eccent_crosec = EccentricityOnCrossSectionKaramba(CrossSection=cross_sections, LocalEccentricity_cm=Z)
# define joints
beam_joints = BeamJointsKaramba(
    ElementIdentifiers=cull_2,
    CtKNMAtStartingNode=Vector(0, 0, 0),
    CrKNmRadAtStartingNode=Vector(0, 0, 0),
    CtKNMAtEndNode=Vector(0, 0, 0),
    CrKNmRadAtEndNode=Vector(0, 0, 0),
    menu=[buttons(off, off, off, off, on, off), buttons(off, off, off, off, off, off)])
beam_joints_2 = BeamJointsKaramba(
    ElementIdentifiers=cull_3,
    CtKNMAtStartingNode=Vector(0, 0, 0),
    CrKNmRadAtStartingNode=Vector(0, 0, 0),
    CtKNMAtEndNode=Vector(0, 0, 0),
    CrKNmRadAtEndNode=Vector(0, 0, 0),
    menu=[buttons(off, off, off, off, off, off), buttons(off, off, off, off, on, off)])
loads = LoadsKaramba(Vector=Z_2, Mesh=mesh, LCase=0, mode="Mesh Load", menu=[buttons(on, off, off), buttons(on, off)])
# define supports
supp = SupportKaramba(PosInd=cull, menu=[buttons(on, on, on, off, off, off)])
# define loads
loads_2 = LoadsKaramba(Vector=Vector(0, 0, -1), LCase=0, mode="Gravity")
# convert line to beam
linetobeam = LineToBeamKaramba(Line=trim_2, New=True, Remove=True, LDist=0.005, Identifier=graft(beam_ids))  # -> Points, Element, Info
item_2 = ListItem(List=eccent_crosec, Index=0, Wrap=True)
# assemble model
assemble = AssembleModelKaramba(
    Elem=flatten(linetobeam.Element),
    Support=flatten(supp),
    Load=flatten([loads_2, loads]),
    CrossSection=flatten(item_2),
    Joint=flatten([beam_joints, beam_joints_2]),
    LimitDistance_m=0.005)  # -> Model, Info, Mass_kg, CenterOfGravity
# optimize cross sections
opticrosec = OptimizeCrossSectionKaramba(
    Model=assemble.Model,
    CrossSections=eccent_crosec,
    MaximumUtilization=1,
    MaximumDisplacement_m=-1,
    UltimateLimitStateIterations=5,
    DisplacementIterations=5,
    NumberOfSamplePoints=3,
    ElasticDesign=True,
    GammaM0=1,
    GammaM1=1)  # -> ModelWithOptimizedCrossSections, Info, Mass_kg, MaximumDisplacement_m, ElasticEnergy_kNm
displacement = Panel(opticrosec.MaximumDisplacement_m)
mass = Panel(opticrosec.Mass_kg)
# view results
modelview = ModelViewKaramba(
    Model=opticrosec.ModelWithOptimizedCrossSections,
    LoadCaseFactorsForLinearSuperposition=1,
    IndexIncrementOfVisibleLoadcase=0)  # -> Model, MeshOfRendering, DeformedStructure, DeformedModel
beamview = BeamViewKaramba(Model=modelview.Model)  # -> Model, MeshOfRendering, DeformedBeamAxes, LegendColors, LegendTags
legend = Legend(Colour=beamview.LegendColors, Tags=beamview.LegendTags, LegendType=1)
