# Grasshopper definition 06_LargeDeformationShell.gh (Grasshopper 0.9.76)
# plug-ins: Karamba, HDTReference

# ----
# create geometry - variation 1
pt = Point([Point(33.96332901, 1.32551419, 0), Point(2.017045573, 10.76809706, 0), Point(10.17070721, 37.6476561, 0), Point(33.81881526, 42.32263155, 0), Point(57.75311296, 32.8257045, 0), Point(73.36081434, 23.95538702, 0), Point(62.06920813, 9.608368494, 0), Point(46.49277597, 24.18034478, 0)])
d = Slider(0.54, range=0.1..2)
t = Slider(0.53, range=0..1)
o = Slider(0.29, range=0..1)
pline = PolyLine(Vertices=pt, Closed=True)
voronoi = Voronoi(Points=pt, BruteForceOverride=False)
xy = XYPlane(Origin=Point(0, 0, 0))
trim = TrimWithRegion(Curve=voronoi, Region=pline, Plane=xy)  # -> Inside, Outside
# 04 - Large Deformation of a Shell
# Difficulty: Hard
# Using the Large Deformation Analysis we can simulate the behaviour of a hanging model to find the optimum form for the applied stresses. The principle stress lines of the shell can be view after the analysis.
# For viewing in the FREE Version use a Analyze Model component instead of the Optimize Cross Section component. For viewing in the Trial Version set the Mesh Resolution of the Mesh Breps component to 10.
end = EndPoints(Curve=trim.Inside)  # -> Start, End
eval = EvaluateCurve(Curve=reparameterize(trim.Inside), Parameter=o)  # -> Point, Tangent, Angle
avr = Average(Input=[end.Start, end.End])
ln = Line(StartPoint=end.Start, EndPoint=end.End)
eval_2 = EvaluateLength(Curve=ln, Length=d, Normalized=False)  # -> Point, Tangent, Parameter
ln_2 = Line(StartPoint=avr, EndPoint=eval.Point)
eval_3 = EvaluateCurve(Curve=ln, Parameter=expr("1-x", eval_2.Parameter))  # -> flatten(Point), Tangent, Angle
eval_4 = EvaluateCurve(Curve=ln, Parameter=eval_2.Parameter)  # -> flatten(Point), Tangent, Angle
eval_5 = EvaluateCurve(Curve=ln_2, Parameter=t)  # -> flatten(Point), Tangent, Angle
circle = Circle3Pt(PointA=eval_4.Point, PointB=eval_3.Point, PointC=eval_5.Point)  # -> Circle, Plane, Radius
xy_2 = XYPlane(Origin=Point(0, 0, 0))
trim_2 = TrimWithRegion(Curve=circle.Circle, Region=pline, Plane=xy_2)  # -> flatten(Inside), Outside
end_2 = EndPoints(Curve=trim_2.Inside)  # -> Start, End
shift = ShiftList(List=end_2.End, Shift=1, Wrap=True)
ln_3 = Line(StartPoint=end_2.Start, EndPoint=shift)
crv = Curve(trim_2.Inside)

# ----
# create geometry - variation 2
pt_2 = Point([Point(108.5416597, 6.725562972, 0), Point(84.83303144, 11.08020898, 0), Point(82.49442525, 37.04680182, 0), Point(105.315996, 44.14326197, 0), Point(119.8314827, 35.63127082, 0), Point(134.5888941, 31.80509829, 0), Point(143.2981861, 22.20874877, 0), Point(130.8245815, 16.82988768, 0), Point(119.3476331, 18.0074646, 0)])
pline_2 = PolyLine(Vertices=pt_2, Closed=True)
disc = Discontinuity(Curve=pline_2, Level=1)  # -> Points, Parameters
explode = Explode(Curve=pline_2, Recursive=True)  # -> Segments, Vertices
hframe = HorizontalFrame(Curve=reparameterize(explode.Segments), Parameter=1)
d_2 = Slider(0.6, range=0.1..2)
l = Slider(0.27, range=0.1..1)
a = Slider(0.147, range=-0.785..0.785)
shift_2 = ShiftList(List=disc.Points, Shift="2", Wrap=True)
prot = RotatePlane(Plane=hframe, Angle=3.141592654)
polar = ToPolar(Point=shift_2, System=prot)  # -> Phi, Theta, Radius
pt_3 = PointCylindrical(BasePlane=prot, Angle=expr("x/2", polar.Phi), Radius=1, Elevation=0)
vec2pt = Vector2Pt(PointA=prot, PointB=pt_3, Unitize=True)  # -> Vector, Length
crv_2 = Curve(explode.Segments)
shift_3 = ShiftList(List=vec2pt.Vector, Shift="-1", Wrap=True)
len = Length(Curve=crv_2)
expression = Expression(x=vec2pt.Vector, l=len, y=l, Expression="x*l²*y*0.1")
expression_2 = Expression(x=shift_3, l=len, y=l, Expression="x*l²*y*0.1")
subtraction = Subtraction(A=len, B=d_2)
vrot = Rotate(Vector=expression, Axis=Vector(0, 0, 1), Angle=expr("-x", a))
eval_6 = EvaluateCurve(Curve=crv_2, Parameter=subtraction)  # -> Point, Tangent, Angle
eval_7 = EvaluateCurve(Curve=crv_2, Parameter=d_2)  # -> Point, Tangent, Angle
shift_4 = ShiftList(List=eval_7.Point, Shift="1", Wrap=True)
vrot_2 = Rotate(Vector=expression_2, Axis=Vector(0, 0, 1), Angle=a)
bzspan = BezierSpan(StartPoint=eval_6.Point, StartTangent=vrot, EndPoint=eval_7.Point, EndTangent=vrot_2)  # -> Curve, Length, Domain
ln_4 = Line(StartPoint=eval_6.Point, EndPoint=shift_4)
vdis = VectorDisplay(Anchor=eval_6.Point, Vector=vrot)
vdis_2 = VectorDisplay(Anchor=eval_7.Point, Vector=vrot_2)

item = ListItem(List=pt_2, Index=0, Wrap=True)  # -> Item1, Item, Item1_2, Item2
item_2 = ListItem(List=pt, Index=0, Wrap=True)  # -> Item1, Item, Item1_2, Item2
aligndim = AlignedDimension(
    Plane=PlaneXY(0, 0, 0),
    PointA=[item.Item, item.Item1, item.Item1_2],
    PointB=[item.Item1_2, item.Item, item.Item2],
    Offset=2,
    Text="{0:0.00}",
    Size=1)
aligndim_2 = AlignedDimension(
    Plane=PlaneXY(0, 0, 0),
    PointA=[item_2.Item, item_2.Item1, item_2.Item1_2],
    PointB=[item_2.Item1_2, item_2.Item, item_2.Item2],
    Offset=2,
    Text="{0:0.00}",
    Size=1)
# toggle between variation 1 or 2
toggle = BooleanToggle(False)
filter = StreamFilter(Gate=toggle, Stream0=flatten(crv), Stream1=flatten(bzspan.Curve))
filter_2 = StreamFilter(Gate=toggle, Stream0=flatten(ln_3), Stream1=flatten(ln_4))
mres = Slider(0.6, range=0.5..10)
# create mesh
boundary = BoundarySurfaces(Edges=[filter, filter_2])
# convert mesh to shell
mesh_breps = MeshBreps(
    Brep=boundary,
    MeshResolution=mres,
    EdgeRefinementFactor="0.5",
    PointReduction=False,
    SmoothingStepSize=0.6,
    SmoothingIterations=5)  # -> Mesh, Info
Z = UnitZ(Factor=1)
# define cross sections
panel = Panel("S")
cross_sections = CrossSectionsKaramba(ElementsIdentifiers=panel, Heights_cm="30", mode="Shell")
# define loads
loads = LoadsKaramba(Vector=Z, LCase=0, mode="Gravity")
meshtoshell = MeshToShellKaramba(Mesh=mesh_breps.Mesh, LDist=0.005, Identifier="S")  # -> Point, Element, Info
pt_4 = Point(meshtoshell.Point)
pull = PullPoint(Point=pt_4, Geometry=filter_2, ClosestOnly=True)  # -> ClosestPoint, Distance
smaller = SmallerThan(FirstNumber=pull.Distance, SecondNumber="0.01")  # -> SmallerThan, OrEqualTo
cull = CullPattern(List=pt_4, CullPattern=smaller.SmallerThan)
# define supports
supp = SupportKaramba(PosInd=cull, menu=[buttons(on, on, on, off, off, on)])
# assemble model
assemble = AssembleModelKaramba(Elem=meshtoshell.Element, Support=supp, Load=loads, CrossSection=cross_sections, LimitDistance_m=0.005)  # -> Model, Info, Mass_kg, CenterOfGravity
d_3 = Slider(8, range=0..30)
i = Slider(20, range=5..50)
# perform large
# deformation analysis
ladeform = LargeDeformationAnalysisKaramba(Model=assemble.Model, Iterations=i, MaximumDisplacement_m=d_3)  # -> CalculatedModel, MaximumDisplacement_m
# view results
modelview = ModelViewKaramba(Model=ladeform.CalculatedModel, LoadCaseFactorsForLinearSuperposition=1, IndexIncrementOfVisibleLoadcase=0)  # -> Model, DeformedMesh, DeformedAxes, DeformedModel
range = Range(Domain="25 to 65", Steps=10)
readmattable = ReadMaterialTableFromFileKaramba()
concat = Concatenate(FragmentA="Shell", FragmentB=range)
# define cross sections
panel_2 = Panel("S")
cross_sections_2 = CrossSectionsKaramba(FamilyNameOfCrossSection="Shell", NameOfCrossSection=graft(concat), Heights_cm=graft(range), mode="Shell")  # -> flatten(CrossSection)
# define materials
matselect = MaterialSelectionKaramba(ElementsIdentifiers="S", Materials=readmattable, menu=[dropdown(2), dropdown(6)])
crosecselect = CrossSectionSelectorKaramba(ElementsIdentifiers=panel_2, NameOrListIndexOfCrossSection="0", CrossSections=cross_sections_2)  # -> CrossSection, Info
# define loads
loads_2 = LoadsKaramba(Vector=Vector(0, 0, -1), LCase=0, mode="Gravity")
# convert deformed
# mesh to shell
meshtoshell_2 = MeshToShellKaramba(Mesh=modelview.DeformedMesh, LDist=0.005, Identifier="S")  # -> Point, Element, Info
support = SupportKaramba(supp)
# assemble model
assemble_2 = AssembleModelKaramba(
    Elem=meshtoshell_2.Element,
    Support=support,
    Load=loads_2,
    CrossSection=crosecselect.CrossSection,
    Material=matselect,
    LimitDistance_m=0.005)  # -> Model, Info, Mass_kg, CenterOfGravity
# optimize cross sections
opticrosec = OptimizeCrossSectionKaramba(
    Model=assemble_2.Model,
    CrossSections=cross_sections_2,
    MaximumUtilization=1,
    MaximumDisplacement_m=-1,
    UltimateLimitStateIterations=5,
    DisplacementIterations=5,
    NumberOfSamplePoints=3,
    ElasticDesign=True,
    GammaM0=1,
    GammaM1=1)  # -> ModelWithOptimizedCrossSections, Info, Mass_kg, MaximumDisplacement_m, ElasticEnergy_kNm
# analyze model (free version)
analyzethi = AnalyzeThIKaramba(Model=assemble_2.Model)  # -> CalculatedModel, MaximumDisplacement_m, ResultingForceOfGravity_kN, ElasticEnergy_kNm
# view results
modelview_2 = ModelViewKaramba(
    Model=opticrosec.ModelWithOptimizedCrossSections,
    LoadCaseFactorsForLinearSuperposition=1,
    IndexIncrementOfVisibleLoadcase=0)  # -> Model, DeformedMesh, DeformedAxes, DeformedModel
shellview = ShellViewKaramba(Model=modelview_2.Model)  # -> Model, MeshesOfRenderedShells, LegendColors, LegendTags
medges = MeshEdges(Mesh=modelview_2.DeformedMesh)  # -> NakedEdges, InteriorEdges, NonManifoldEdges
legend = Legend(Colour=shellview.LegendColors, Tags=shellview.LegendTags, LegendType=1)
popgeo = PopulateGeometry(Geometry=modelview_2.DeformedMesh, Count=Slider(200, range=20..200), Seed=1)
# visualize principal stress lines
shelllineresults = LineResultsOnShellsKaramba(
    AnalyzedModel=opticrosec.ModelWithOptimizedCrossSections,
    Layer=Slider(0, range=-1..1),
    ListOfSourcesOfPrincipalStressLinesLinesPoints=flatten(popgeo),
    SegmentLength_m=0.5,
    DA_deg=5,
    mode="PrincStress")  # -> AnalyzedModel, Lines1, Lines2
previewlw = CustomPreviewLineweights(Geometry=medges.NakedEdges, Shader=ColourSwatch(SwatchColor=RGB(0, 0, 0)), Thickness="2")
join = JoinCurves(Curves=shelllineresults.Lines1, Preserve=False)
join_2 = JoinCurves(Curves=shelllineresults.Lines2, Preserve=False)
subcrv = SubCurve(BaseCurve=join, Domain="0 to 20")
subcrv_2 = SubCurve(BaseCurve=join_2, Domain="0 to 20")
preview = CustomPreview(Geometry=subcrv_2, Shader=ColourSwatch(SwatchColor=RGB(255, 0, 0)))
preview_2 = CustomPreview(Geometry=subcrv, Shader=ColourSwatch(SwatchColor=RGB(0, 0, 255)))
