# Grasshopper definition 07_Optimization_InclinedColumnPositions.gh (Grasshopper 0.9.76)
# plug-ins: Karamba, Octopus

genes = GenePool(
    Decimals=2,
    Maximum=1,
    Minimum=0,
    Value=[0.665057336, 0.7077662486, 0.1745052601, 0.4113113332, 0.6070020028, 0.7648282618, 0.2847266512, 0.234322781, 0.05803681769, 0.04016988055, 0.8630773999, 0.5202322027, 0.3532711247, 0.8044202345, 0.7323035874, 0.8809566366, 0.9537981276, 0.2454335597, 0.6324080497, 0.391114483])
# parameters for column positions
genes_2 = GenePool(
    Decimals=2,
    Maximum=1,
    Minimum=0,
    Value=[0.04004128913, 0.09347920476, 0.5730534145, 0.8053407946, 0.3802742397, 0.7345801615, 0.4802135903, 0.1309763088, 0.9488566339, 0.9626441298, 0.2623109883, 0.1368457183, 0.7142720111, 0.765837049, 0.09710815101, 0.3887123712, 0.4905778314, 0.1193665021, 0.9254428342, 0.2234916698])
remap = RemapNumbers(Value=genes_2, Source=Domain(0, 1), Target="0.15 to 0.85")  # -> Mapped, Clipped
remap_2 = RemapNumbers(Value=genes, Source=Domain(0, 1), Target="-3.5 to 3.5")  # -> Mapped, Clipped
# 03 - Optimization of Inclined Column Positions
# Difficulty: Hard (PRO version only)
# The position of inclined columns for a shell roof structure is optimized. This shows how beams and shells are integrated into a single model.
# 3d shapes are used during the optimization to reduce the columns from intersecting predefined regions. The surface, boxes and region of columns can be altered.
# reference geometry
srf = Surface(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)
dispatch = Dispatch(List=remap.Mapped, DispatchPattern=[True, False])  # -> ListA, ListB
vec = VectorXYZ(XComponent=dispatch.ListA, YComponent=dispatch.ListB, ZComponent=0)  # -> Vector, Length
evalsrf = EvaluateSurface(Surface=reparameterize(srf), Point=vec.Vector)  # -> Point, Normal, Frame
crv = Curve(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)
devec = DeconstructVector(Vector=evalsrf.Point)  # -> XComponent, YComponent, ZComponent
dispatch_2 = Dispatch(List=remap_2.Mapped, DispatchPattern=[True, False])  # -> ListA, ListB
sdivide = DivideSurface(Surface=srf, UCount=1, VCount=1)  # -> flatten(Points), Normals, Parameters
addition = Addition(A=devec.XComponent, B=dispatch_2.ListA)
addition_2 = Addition(A=devec.YComponent, B=dispatch_2.ListB)
boundary = BoundarySurfaces(Edges=crv)
item = ListItem(List=sdivide.Points, Index=0, Wrap=True)  # -> Item, Item1, Item2, Item3
pt = ConstructPoint(XCoordinate=addition, YCoordinate=addition_2, ZCoordinate=0)
r = Slider(1.5, range=0.5..4)
preview = CustomPreview(Geometry=boundary, Shader=ColourSwatch(SwatchColor=RGB(207, 207, 207)))
aligndim = AlignedDimension(
    Plane=PlaneXY(0, 0, 0),
    PointA=[item.Item, item.Item2],
    PointB=[item.Item1, item.Item],
    Offset=4,
    Text="{0:0.00}",
    Size=1)
pull = PullPoint(Point=pt, Geometry=boundary, ClosestOnly=True)  # -> ClosestPoint, Distance
pt_2 = Point(evalsrf.Point)
subsrf = Isotrim(Surface=reparameterize(srf), Domain=[Domain2(u=0..0.5, v=0..1), Domain2(u=0.5..1, v=0..1)])
panel = Panel("""{0,-2,0}
{0,2,0}
{0,2,0}
{0,-2,0}""")
panel_2 = Panel("""4
5""")
readmattable = ReadMaterialTableFromFileKaramba()
ln = Line(StartPoint=pt_2, EndPoint=pull.ClosestPoint)
mesh_breps = MeshBreps(
    Brep=srf,
    InclusionPoints=pt_2,
    MeshResolution=r,
    EdgeRefinementFactor=0.67,
    PointReduction=False,
    SmoothingStepSize=0.8,
    SmoothingIterations=5)  # -> Mesh, Info
mesh = MeshBrep(
    Brep=subsrf,
    Settings={GridMaxCount=0, GridMinCount=16, JaggedSeams=False, MaxEdgeLength=0, MinEdgeLength=0.0001, MinTolerance=0, Refine=True, RefineAngle=0, RelativeTolerance=0.65, SimplePlanes=True, Tolerance=0})
range = Range(Domain="5 to 35", Steps=10)
range_2 = Range(Domain="5 to 55", Steps=10)
concat = Concatenate(FragmentA="r", FragmentB=range)
concat_2 = Concatenate(FragmentA="shell", FragmentB=range_2)
partition = PartitionList(List=panel, Size=2)
panel_3 = Panel("""-1
0
1
2
3""")
panel_4 = Panel("""{0,0,-1}
{2,0,0}
{0,2,0}
{-2,0,0}
{0,-2,0}""")
# define cross sections
panel_5 = Panel("b")
# convert line to beam
panel_6 = Panel("s")
cross_sections = CrossSectionsKaramba(
    FamilyNameOfCrossSection="r",
    NameOfCrossSection=concat,
    Diameter_cm=range,
    WallThickness_cm=expr("x*0.1", range),
    mode="Circular Hollow")  # -> flatten(CrossSection)
cross_sections_2 = CrossSectionsKaramba(FamilyNameOfCrossSection=graft("shell"), NameOfCrossSection=graft(concat_2), Heights_cm=graft(range_2), mode="Shell")  # -> flatten(CrossSection)
loads = LoadsKaramba(Vector=partition, Mesh=mesh, LCase=graft(panel_2), mode="Mesh Load", menu=[buttons(off, off, on), buttons(on, off)])  # -> flatten(Load)
# define materials
matselect = MaterialSelectionKaramba(ElementsIdentifiers="s", Materials=readmattable, menu=[dropdown(2), dropdown(6)])
matselect_2 = MaterialSelectionKaramba(ElementsIdentifiers="b", Materials=readmattable, menu=[dropdown(1), dropdown(2)])
crosecselect = CrossSectionSelectorKaramba(ElementsIdentifiers=panel_5, NameOrListIndexOfCrossSection=0, CrossSections=cross_sections)  # -> CrossSection, Info
crosecselect_2 = CrossSectionSelectorKaramba(ElementsIdentifiers="s", NameOrListIndexOfCrossSection=0, CrossSections=cross_sections_2)  # -> CrossSection, Info
# define joints
beam_joints = BeamJointsKaramba(
    ElementIdentifiers="b",
    CtKNMAtStartingNode=Vector(0, 0, 0),
    CrKNmRadAtStartingNode="{0,1,1}",
    CtKNMAtEndNode=Vector(0, 0, 0),
    CrKNmRadAtEndNode=Vector(0, 0, 0),
    menu=[buttons(off, off, off, off, on, on), buttons(off, off, off, off, off, off)])
linetobeam = LineToBeamKaramba(Line=ln, New=True, Remove=True, LimitDistance_m=0.005, BeamIdentifier="b")  # -> Points, Element, Info
loads_2 = LoadsKaramba(Vector=panel_4, Mesh=mesh_breps.Mesh, LCase=panel_3, mode="Mesh Load", menu=[buttons(off, off, on), buttons(on, off)])
# define supports
supp = SupportKaramba(PosInd=pull.ClosestPoint, menu=[buttons(on, on, on, off, off, off)])
# define loads
loads_3 = LoadsKaramba(Vector="{0,0,1.35}", LCase="-1", mode="Gravity")
# convert mesh to shell
meshtoshell = MeshToShellKaramba(Mesh=mesh_breps.Mesh, LDist=0.005, Identifier=panel_6)  # -> Point, Element, Info
load = LoadKaramba(flatten([loads_3, loads_2, loads]))
material = MaterialKaramba([matselect, matselect_2])
crosec = CrossSectionKaramba([crosecselect.CrossSection, crosecselect_2.CrossSection])
crosec_2 = CrossSectionKaramba([cross_sections_2, cross_sections])
# assemble model
assemble = AssembleModelKaramba(
    Elem=flatten([meshtoshell.Element, linetobeam.Element]),
    Support=flatten(supp),
    Load=flatten(load),
    CrossSection=flatten(crosec),
    Material=flatten(material),
    Joint=flatten(beam_joints),
    LimitDistance_m=0.005)  # -> Model, Info, Mass_kg, CenterOfGravity
max_deformation = Panel("9/150")
# optimize cross sections
opticrosec = OptimizeCrossSectionKaramba(
    Model=assemble.Model,
    CrossSections=crosec_2,
    MaximumUtilization=1,
    MaximumDisplacement_m=max_deformation,
    UltimateLimitStateIterations=5,
    DisplacementIterations=5,
    NumberOfSamplePoints=3,
    ElasticDesign=True,
    GammaM0=1,
    GammaM1=1)  # -> ModelWithOptimizedCrossSections, Info, Mass_kg, MaximumDisplacement_m, ElasticEnergy_kNm
mesh_2 = Mesh([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])
con = DelaunayEdges(Points=pull.ClosestPoint, Plane=PlaneXY(0, 0, 0))  # -> Connectivity, Edges
panel_7 = Panel("""1
2
3
4
5
6""")
preview_2 = CustomPreview(Geometry=mesh_2, Shader=ColourSwatch(SwatchColor=RGBA(255, 255, 255, 168)))
len = Length(Curve=con.Edges)
mjoin = MeshJoin(Meshes=mesh_2)
preview_3 = CustomPreview(Geometry=con.Edges, Shader=ColourSwatch(SwatchColor=RGB(115, 115, 115)))
sort = SortList(Keys=opticrosec.MaximumDisplacement_m, ValuesA=panel_7)  # -> Keys, ValuesA
sort_2 = SortList(Keys=len)  # -> Keys, ValuesA
panel_8 = Panel(opticrosec.MaximumDisplacement_m)
mcx = MeshCurve(Mesh=mjoin, Curve=ln)  # -> flatten(Points), Faces
item_2 = ListItem(List=reverse(sort.ValuesA), Index=0, Wrap=True)
item_3 = ListItem(List=reverse(sort.Keys), Index=0, Wrap=True)
item_4 = ListItem(List=sort_2.Keys, Index=0, Wrap=True)
lng = ListLength(List=mcx.Points)  # -> expr("x/2", Length)
neg = Negative(Value=item_4)
num = Number(opticrosec.Mass_kg)
panel_9 = Panel("""total Mass
Conflicts
Distribution""")
# multi objective optimization with octopus
# optimizing the geometry based on mass, conflicts with 3d shapes,
# and the distribution of the column positions
octopus = Octopus(OctopusData_gene=[genes_2, genes], OctopusData_obj=[txt, num_2])
merge = Merge(Data1=flatten(num), Data2=flatten(lng), Data3=flatten(neg))
# view results
modelview = ModelViewKaramba(
    Model=opticrosec.ModelWithOptimizedCrossSections,
    LoadCaseFactorsForLinearSuperposition=1,
    IndexIncrementOfVisibleLoadcase=item_2)  # -> Model, DeformedMesh, DeformedAxes, DeformedModel
txt = Text(panel_9)
num_2 = Number(merge)
panel_10 = Panel(num_2)
shellview = ShellViewKaramba(Model=modelview.Model)  # -> Model, MeshesOfRenderedShells, LegendColors, LegendTags
beamview = BeamViewKaramba(Model=modelview.Model)  # -> Model, MeshesOfRenderedBeams, DeformedBeamAxes, LegendColors, LegendTags
