# Grasshopper definition 08_FindMaterialDistribution.gh (Grasshopper 0.9.76)
# plug-ins: Karamba, MeshEdit Components

# ---- group: rhino input: polyline
# This work is licensed under a Creative Commons Attribution 4.0 licence. You are free to copy, communicate and adapt the work, so long as you attribute the work in the manner specified by the author or licensor (but not in any way that suggests that they endorse you or your use of the work). A copy of this licence is available at http://http://creativecommons.org/licenses/by/4.0/ or write to info@creativecommons.org
brep = Brep(<brep referenced from the Rhino model>)

# ---- group: rhino input: support pts
pt = Point([<point referenced from the Rhino model> x9])

# ----
# Structural Performance Feedback:
# 
# 3.1 FIND MATERIAL DISTRIBUTION
# DOMAIN:      divided mesh - analyze mesh division edges as beams
# 
# ATTRIBUTES: bending moment at division nodes
# 
# OPERATIONS:  redraw mesh; scale at nodes according to bending moment
# All definitions are organized according to:
# DOMAIN (model framework)
# ATTRIBUTES (what is being measured?)
# OPERATIONS (what is changing based on measurements?)
# This definition takes a polysurface input from rhino (or option2: curves to loft), divides a mesh according to sliders, converts the mesh edges to beams and analyzes moments at each node. The mesh is then redrawn with thickness of each edge determined by the bending moment value.
# 
# steps to alter:
# 
# 
# 1. change slider that controls mesh density
# 2. change slider that controls angle threshold to turn triangle segments into quads
# 3. test your own polygon
panel_2 = Panel(" ")

# ---- group: triangulates mesh quads depending on curvature
number_slider = Slider(0, range=0..1)
number_slider_2 = Slider(0.904, range=0..1)

# ---- group: dead load
Z = UnitZ(Factor="-1")
loads = LoadsKaramba(Vector=Z, LCase=0, mode="Gravity")
panel_3 = Panel(loads)

# ---- group: live load applied as uniform distributed (mesh) loads / load magnitude
live_load = Slider(-0.25, range=-0.25..-0.04)

# ---- group: live load applied as uniform distributed (mesh) loads / mesh density
# ** note: low mesh density can
# result in uneven distribution of load
number_slider_3 = Slider(76, range=0..100)

# ---- group: live load applied as uniform distributed (mesh) loads
# LIVE LOAD REFERENCE:
# ref: The Structural Basis of Architecture, Sandaker et al.
# residential (typical) 	2 kN/m2  	.04 kip/ft2
# office (tyipcal)  			3 kN/m2  	.06 kip/ft2
# public plazas  	12 kN/m2  	.25 kip/ft2
# athletic facilities (typical)  5 kN/m2  	.1 kip/ft2
# hospitals (operating rooms)  3 kN/m2   .06 kip/ft2
# libraries (book stacks)  7 kN/m2   .15 kip/ft2
# manufacturing (typical)  6 kN/m2   .125 kip/ft2
# heavy equipment   12 kN/m2   .25 kip/ft2
# schools (classrooms)   2 kN/m2   .04 kip/ft2
# schools (hallways)   5 kN/m2   .1 kip/ft2
brep_2 = Brep([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])
mesh_breps = MeshBreps(
    Brep=brep_2,
    MeshResolution=number_slider_3,
    EdgeRefinementFactor=0.67,
    PointReduction=False,
    SmoothingStepSize=0,
    SmoothingIterations=5)  # -> Mesh, Info
Z_2 = UnitZ(Factor=live_load)
loads_2 = LoadsKaramba(Vector=Z_2, Mesh=mesh_breps.Mesh, LCase=0, mode="Mesh Load", menu=[buttons(on, off, off), buttons(on, on)])
panel_4 = Panel(loads_2)

# ----
mesh_breps_2 = MeshBreps(
    Brep=brep,
    MeshResolution=Slider(10, range=1..40),
    EdgeRefinementFactor=0.67,
    PointReduction=False,
    SmoothingStepSize=0,
    SmoothingIterations=5)  # -> Mesh, Info

# ---- group: triangulates mesh quads depending on curvature
triangulate = MeshTriangulate(Mesh=mesh_breps_2.Mesh, ShortDiagonal=False)
quad = Quadrangulate(Mesh=triangulate, Angle=number_slider, Ratio=number_slider_2)  # -> Mesh, Count

# ----
faceb = FaceBoundaries(Mesh=quad.Mesh)
crv = Curve(faceb)
explode = Explode(Curve=crv, Recursive=True)  # -> Segments, Vertices
rdlines = RemoveDuplicateLinesKaramba(Line=flatten(explode.Segments), LimitDistance=0.005)  # -> OutLine, Info, Indexes

linetobeam = LineToBeamKaramba(Line=rdlines.OutLine, New=True, Remove=True, LimitDistance_m=0.005, BeamIdentifier="beams")  # -> flatten(Points), Element, Info
rdpoints = RemoveDuplicatePointsKaramba(Point=linetobeam.Points, LimitDistance=0.005)  # -> flatten(OutPoint), Info, Indexes

# ----
# to apply to a new model:
# right-click and set multiple points;
# 
# ** points must be near intended supports;
# definition will automatically snap to closest node in model
fsim = FindSimilarMember(Data=pt, Set=linetobeam.Points)  # -> Hit, Index

# ----
# Karamba Input
supp = SupportKaramba(PosInd=fsim.Hit, menu=[buttons(on, on, on, off, off, off)])

# ---- group: assemble elements and analyze
assemble = AssembleModelKaramba(Elem=flatten(linetobeam.Element), Support=flatten(supp), Load=flatten([loads, loads_2]), LimitDistance_m=0.005)  # -> Model, Info, Mass_kg, CenterOfGravity
analyzethi = AnalyzeThIKaramba(Model=assemble.Model)  # -> CalculatedModel, MaximumDisplacement_m, ResultingForceOfGravity_kN, ElasticEnergy_kNm

# ----
# Karamba Output
modelview = ModelViewKaramba(Model=analyzethi.CalculatedModel, LoadCaseFactorsForLinearSuperposition=1, IndexIncrementOfVisibleLoadcase=0)  # -> Model, DeformedMesh, DeformedAxes, DeformedModel

# ----
# NOTE:
# If you want to SEE the deformation with the beam visualization plug in the BeamView AFTER the ModelView. The numerical data is the SAME if you plug BeamView directly into the Analyze component.
beamview = BeamViewKaramba(Model=modelview.Model)  # -> Model, MeshesOfRenderedBeams, DeformedBeamAxes, LegendColors, LegendTags

# ---- group: extact original components
disassemble = DisassembleModelKaramba(Model=analyzethi.CalculatedModel)  # -> Model, Point, Beam, Shell, Support, Load, Line, Mesh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

# ----
shellview = ShellViewKaramba(Model=analyzethi.CalculatedModel)  # -> Model, MeshesOfRenderedShells, LegendColors, LegendTags
legend = Legend(Colour=shellview.LegendColors, Tags=shellview.LegendTags, LegendType=1)

# ---- group: determine bending moments
b_res_force = BeamResultantForcesKaramba(AnalyzedModel=analyzethi.CalculatedModel, LoadCase=-1, MaximumProbingDistance_m=-1, NumberOfProbingPointsPerElement=3)  # -> AnalyzedModel, NormalForce_kN, ResultantBendingMoment_kNm, ResultantShearForce_kN

# ---- group: determine principle forces
s_forces = ShellForcesKaramba(AnalyzedModel=analyzethi.CalculatedModel)  # -> AnalyzedModel, FirstPrincipalForce_kN_m, SecondPrincipalForce_kN_m, FirstPrincipalMoment_kN, SecondPrincipalMoment_kN, ShearForceIn1stDirection_kN_m, ShearForceIn2ndDirection_kN_m

# ---- group: determine force vectors
shellvecresults = ResultVectorsOnShellsKaramba(AnalyzedModel=analyzethi.CalculatedModel, LayerOfResults=0, mode="PrincStress")  # -> AnalyzedModel, Points, FirstPrincipalStressDirection_kN_cm2, SecondPrincipalStressDirection_kN_cm2

# ----
# this step determines the midpoint of each
# edge, and clusters the values together
# per face. this means that each face has 4
# assigned datums. this is used in a later
# step to maintain order with the various
# data values.
curvepoint = PointOnCurve(explode.Segments, parameter=0.5)
curvepoint_2 = PointOnCurve(rdlines.OutLine, parameter=0.5)
fsim_2 = FindSimilarMember(Data=curvepoint, Set=curvepoint_2)  # -> Hit, simplify(Index)
int = Integer(fsim_2.Index)

# ---- group: connect bending moment values to mesh faces
abs = Absolute(Value=b_res_force.ResultantBendingMoment_kNm)
sqrt = SquareRoot(Value=abs)
item = ListItem(List=sqrt, Index=int, Wrap=True)
bnd = Bounds(Numbers=flatten(item))
remap = RemapNumbers(Value=item, Source=bnd, Target=Domain(0, 1))  # -> Mapped, Clipped

# ---- group: redistribute moment value according to curve -> use as scale factor
graph = GraphMapper(
    remap.Mapped,
    x0=0,
    x1=1,
    y0=0,
    y1=1,
    container_name="Bezier",
    cpx=[0, 0.3704356253, 0.03768257424, 1],
    cpy=[1, 0.7092753649, 0, 0])
remap_2 = RemapNumbers(Value=graph, Source=Domain(0, 1), Target="0.4 to 0.95")  # -> Mapped, Clipped
shift = ShiftList(List=remap_2.Mapped, Shift=-1, Wrap=True)
expression = Expression(x=remap_2.Mapped, y=shift, Expression="(x+y)/2")

# ---- group: create vertex colors
gradient = Gradient(
    LowerLimit=0,
    UpperLimit=1,
    Parameter=graph,
    stops=[0: RGB(234, 38, 0), 0.122: RGB(234, 126, 0), 0.298: RGB(254, 244, 84), 0.75: RGB(173, 203, 249), 1: RGB(75, 107, 169)])
shift_2 = ShiftList(List=gradient, Shift=-1, Wrap=True)
expression_2 = Expression(x=gradient, y=shift_2, Expression="(x+y)/2")
item_2 = ListItem(List=expression_2, Index=0, Wrap=True)
merge = Merge(Data1=expression_2, Data2=item_2, Data3=expression_2, Data4=item_2)

# ---- group: group face edges
item_3 = ListItem(List=disassemble.Line, Index=int, Wrap=True)

# ----
flip = FlipCurve(Curve=item_3, Guide=explode.Segments)  # -> Curve, Flag

# ---- group: determine center of face
end = EndPoints(Curve=flip.Curve)  # -> Start, End
avr = Average(Input=[end.Start, end.End])

# ---- group: boundary points; scaled points
scale = Scale(Geometry=end.Start, Center=avr, Factor=expression)  # -> Geometry, Transform
end_2 = EndPoints(Curve=flip.Curve)  # -> Start, End

# ---- group: merge outer points, inner points to create new faces
pt_2 = Point(simplify(end_2.Start))
pt_3 = Point(simplify(scale.Geometry))
item_4 = ListItem(List=pt_2, Index=0, Wrap=True)
item_5 = ListItem(List=pt_3, Index=0, Wrap=True)
merge_2 = Merge(Data1=pt_2, Data2=item_4, Data3=pt_3, Data4=item_5)
lng = ListLength(List=pt_2)

# ---- group: alternative reconfigured members
ln = Line(StartPoint=end.Start, EndPoint=avr)
ln_2 = Line(StartPoint=end.End, EndPoint=avr)
preview = CustomPreview(Geometry=[ln, ln_2], Shader=ColourSwatch(SwatchColor=RGB(171, 171, 171)))

# ---- group: output 1: reconstructed mesh
frompoints = MeshFromPoints(Points=merge_2, UDirection=2, VDirection=expr("x+1", lng), Colour=merge)  # -> flatten(Mesh)
weldvertices = MeshWeldVertices(Mesh=frompoints, Tolerance=0.01)  # -> RuntimeMessage, Mesh

# ---- group: vector mesh outlines
pline = PolyLine(Vertices=pt_3, Closed=True)
pline_2 = PolyLine(Vertices=pt_2, Closed=True)
