# Grasshopper definition 09_SetSmartModule.gh (Grasshopper 0.9.76)
# plug-ins: Karamba

# This work is licensed under a Creative Commons Attribution 4.0 licence. You are free to copy, communicate and adapt the work, so long as you attribute the work in the manner specified by the author or licensor (but not in any way that suggests that they endorse you or your use of the work). A copy of this licence is available at http://http://creativecommons.org/licenses/by/4.0/ or write to info@creativecommons.org
panel = Panel("")

# ---- group: rhino input surface
srf = Surface(<surface referenced from the Rhino model>)

# ----
number_slider = Slider(15, range=0..50)
number_slider_2 = Slider(10, range=0..50)
mesh_uv = MeshSurface(Surface=srf, UCount=number_slider, VCount=number_slider_2, Overhang=True, Equalize=False)
divide = DivideDomain²(Domain=srf, UCount=number_slider, VCount=number_slider_2)

# ---- group: input points; snap to nearest node on lines above / rhino input points
pt = Point([<point referenced from the Rhino model> x2])

# ----
# Structural Performance Feedback:
# 
# 3.2 SET SMART MODULE
# apply modules according to load patterns
# DOMAIN:      divided mesh - analyze mesh as divided shell
# 
# ATTRIBUTES: shell forces and utilization
# 
# OPERATIONS: apply module according to shell force/utilization values
# All definitions are organized according to:
# DOMAIN (model framework)
# ATTRIBUTES (what is being measured?)
# OPERATIONS (what is changing based on measurements?)
# This definition takes surface input from rhino, divides it as a mesh according to density sliders, analyzes the distribution of forces on the mesh and applies a series of rhino-modeled modules according to the force pattern.
# 
# steps to alter:
# 
# 
# 1. change slider that controls mesh density
# 2. change the controlling attributes
# 3. change the graph-mapper to adjust the domain of results
# 4. input new surface
# 5. define new modules
panel_2 = Panel(" ")

# ---- group: dead load
Z = UnitZ(Factor="-1")
loads = LoadsKaramba(Vector=Z, LCase=0, mode="Gravity")
panel_3 = Panel(loads)

# ---- group: live load applied as uniform distributed (mesh) loads / load magnitude
live_load = Slider(2, range=-2..2)

# ---- group: live load applied as uniform distributed (mesh) loads / rhino input surfaces for live load
srf_2 = Surface(<surface referenced from the Rhino model>)

# ---- group: live load applied as uniform distributed (mesh) loads / mesh density
# ** note: low mesh density can
# result in uneven distribution of load
number_slider_3 = Slider(70, range=0..100)
mesh_uv_2 = MeshSurface(Surface=srf_2, UCount=number_slider_3, VCount=number_slider_3, Overhang=True, Equalize=False)

# ---- group: live load applied as uniform distributed (mesh) loads
# OCCUPANCY LOAD REFERENCE:
# ref: The Structural Basis of Architecture, Sandaker et al.
# residential (typical) 	2 kN/m2  	.04 kip/ft2
# office (tyipcal)  			3 kN/m2  	.06 kip/ft2
# public plazas  	12 kN/m2  	.25 kip/ft2
# athletic facilities (typical)  5 kN/m2  	.1 kip/ft2
# hospitals (operating rooms)  3 kN/m2   .06 kip/ft2
# libraries (book stacks)  7 kN/m2   .15 kip/ft2
# manufacturing (typical)  6 kN/m2   .125 kip/ft2
# heavy equipment   12 kN/m2   .25 kip/ft2
# schools (classrooms)   2 kN/m2   .04 kip/ft2
# schools (hallways)   5 kN/m2   .1 kip/ft2
Z_2 = UnitZ(Factor=live_load)

# ----
meshtoshell = MeshToShellKaramba(Mesh=mesh_uv, LDist=0.005, Identifier="baseShell")  # -> Point, Element, Info

# ---- group: input points; snap to nearest node on lines above
# to apply to a new model:
# right-click and set multiple points;
# 
# ** points must be near intended supports;
# definition will automatically snap to closest node in model
fsim = FindSimilarMember(Data=pt, Set=meshtoshell.Point)  # -> Hit, Index

# ----
# Karamba Input
loads_2 = LoadsKaramba(Vector=Z_2, Mesh=mesh_uv_2, LCase=0, mode="Mesh Load", menu=[buttons(on, off, off), buttons(on, on)])
supp = SupportKaramba(PosInd=fsim.Hit, menu=[buttons(on, on, on, on, on, on)])

# ---- group: assemble elements and analyze
assemble = AssembleModelKaramba(Elem=meshtoshell.Element, Support=supp, Load=[loads, loads_2], LimitDistance_m=0.005)  # -> Model, Info, Mass_kg, CenterOfGravity
analyzethi = AnalyzeThIKaramba(Model=assemble.Model)  # -> CalculatedModel, MaximumDisplacement_m, ResultingForceOfGravity_kN, ElasticEnergy_kNm

# ----
# Karamba Output
modelview = ModelViewKaramba(Model=analyzethi.CalculatedModel, LoadCaseFactorsForLinearSuperposition=1, IndexIncrementOfVisibleLoadcase=0)  # -> Model, DeformedMesh, DeformedAxes, DeformedModel

shellview = ShellViewKaramba(Model=modelview.Model)  # -> Model, MeshesOfRenderedShells, LegendColors, LegendTags
legend = Legend(Colour=shellview.LegendColors, Tags=shellview.LegendTags, LegendType=1)

# ----
# NOTE:
# If you want to SEE the deformation with the beam visualization plug in the BeamView AFTER the ModelView. The numerical data is the SAME if you plug BeamView directly into the Analyze component.
beamview = BeamViewKaramba(Model=modelview.Model)  # -> Model, MeshesOfRenderedBeams, DeformedBeamAxes, LegendColors, LegendTags

# ----
# PLUG IN DIFFERENT FORCE TYPES TO SEE RESULTS
s_forces = ShellForcesKaramba(AnalyzedModel=shellview.Model)  # -> AnalyzedModel, FirstPrincipalForce_kips_ft, SecondPrincipalForce_kips_ft, FirstPrincipalMoment_kips, SecondPrincipalMoment_kips, ShearForceIn1stDirection_kN_m, ShearForceIn2ndDirection_kN_m
utilization = UtilizationOfElementsKaramba(AnalyzedModel=shellview.Model, ElemIdentifiers="baseShell", LoadCase=-1, mode="Shells")  # -> AnalyzedModel, Utilization

# ---- group: Compute Face Averages: Utilization
cull = CullPattern(List=utilization.Utilization, CullPattern=[False, True])  # -> graft(List)
cull_2 = CullPattern(List=utilization.Utilization, CullPattern=[True, False])  # -> graft(List)
bnd = Bounds(Numbers=flatten(utilization.Utilization))
avr = Average(Input=simplify([cull, cull_2]))
remap = RemapNumbers(Value=avr, Source=bnd, Target=Domain(0, 1))  # -> Mapped, Clipped

# ---- group: Compute Face Averages: In-Plane Force
cull_3 = CullPattern(List=s_forces.FirstPrincipalForce_kips_ft, CullPattern=[False, True])  # -> graft(List)
cull_4 = CullPattern(List=s_forces.FirstPrincipalForce_kips_ft, CullPattern=[True, False])  # -> graft(List)
bnd_2 = Bounds(Numbers=flatten(s_forces.FirstPrincipalForce_kips_ft))
avr_2 = Average(Input=simplify([cull_3, cull_4]))
remap_2 = RemapNumbers(Value=avr_2, Source=bnd_2, Target=Domain(0, 1))  # -> Mapped, Clipped

# ---- group: Compute Face Averages: Moment Force
cull_5 = CullPattern(List=s_forces.FirstPrincipalMoment_kips, CullPattern=[False, True])  # -> graft(List)
cull_6 = CullPattern(List=s_forces.FirstPrincipalMoment_kips, CullPattern=[True, False])  # -> graft(List)
bnd_3 = Bounds(Numbers=flatten(s_forces.FirstPrincipalMoment_kips))
avr_3 = Average(Input=simplify([cull_5, cull_6]))
remap_3 = RemapNumbers(Value=avr_3, Source=bnd_3, Target=Domain(0, 1))  # -> Mapped, Clipped

# ---- group: remap value distribution
graph = GraphMapper(
    remap_2.Mapped,
    x0=0,
    x1=1,
    y0=0,
    y1=1,
    container_name="Bezier",
    cpx=[0, 0, 0.9913064837, 1],
    cpy=[0, 0.9734375477, 1, 1])

# ---- group: remap results to number of reference modules
remap_4 = RemapNumbers(Value=flatten(graph), Source=Domain(0, 1), Target="0 to 3")  # -> Mapped, Clipped

# ---- group: reference modules
brep = Brep(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)
brep_2 = Brep(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)
brep_3 = Brep(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)
brep_4 = Brep(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)

entwine = Entwine(Branch00=brep, Branch01=brep_2, Branch02=brep_3, Branch03=brep_4, FlattenInputs=True)  # -> simplify(Result)

# ---- group: BOUNDING BOX PER REF GEO
bbox = BoundingBox(Content=entwine, Plane=PlaneXY(0, 0, 0))  # -> Box, Box_2

# ---- group: split list into boolean pattern for each reference module
number_slider_4 = Slider(0, range=0..100)
addition = Addition(A=number_slider_4, B=1)
addition_2 = Addition(A=addition, B=1)
addition_3 = Addition(A=addition_2, B=1)

# ----
int = Integer(remap_4.Mapped)
sbox = SurfaceBox(Surface=srf, Domain=divide, Height=Slider(0.795, range=0..10))
panel_4 = Panel(int)

# ---- group: split list into boolean pattern for each reference module (continued)
equals = Equality(FirstNumber=number_slider_4, SecondNumber=int)  # -> Equality, Inequality
equals_2 = Equality(FirstNumber=addition, SecondNumber=int)  # -> Equality, Inequality
equals_3 = Equality(FirstNumber=addition_2, SecondNumber=int)  # -> Equality, Inequality
equals_4 = Equality(FirstNumber=addition_3, SecondNumber=int)  # -> Equality, Inequality

# ----
entwine_2 = Entwine(
    Branch00=equals.Equality,
    Branch01=equals_2.Equality,
    Branch02=equals_3.Equality,
    Branch03=equals_4.Equality,
    FlattenInputs=True)

# ---- group: SEPARATE SET OF BOXES PER EACH REF GEO
cull_7 = CullPattern(List=sbox, CullPattern=entwine_2)

# ----
morph = BoxMorph(Geometry=entwine, Reference=simplify(bbox.Box), Target=cull_7)

# ---- group: COLOR BASED ON LEGEND / GEO TYPE
panel_5 = Panel("""215, 225, 225
215, 175, 175
215, 125, 125
219, 50, 0""")
legend_2 = Legend(Colour=panel_5, Tags=panel_5, LegendType=1)
preview = CustomPreview(Geometry=morph, Shader=graft(panel_5))
