# Grasshopper definition 10_SmoothCrossSectionHeightsFromMoments.gh (Grasshopper 0.9.76)
# plug-ins: Karamba, MeshEdit Components

md_slider = MDSlider(
    slider_value=Point(0.8059998489, 0.2058537181, 0.5),
    SliderMode=0,
    x_domain=Domain(0, 1),
    y_domain=Domain(0, 1),
    z_domain=Domain(0, 1))
md_slider_2 = MDSlider(
    slider_value=Point(0.704536438, 0.6944393995, 0.5),
    SliderMode=0,
    x_domain=Domain(0, 1),
    y_domain=Domain(0, 1),
    z_domain=Domain(0, 1))
md_slider_3 = MDSlider(
    slider_value=Point(0.3089842447, 0.3034973145, 0.5),
    SliderMode=0,
    x_domain=Domain(0, 1),
    y_domain=Domain(0, 1),
    z_domain=Domain(0, 1))
md_slider_4 = MDSlider(
    slider_value=Point(0.2170731614, 0.8169756633, 0.5),
    SliderMode=0,
    x_domain=Domain(0, 1),
    y_domain=Domain(0, 1),
    z_domain=Domain(0, 1))
# create geometry
pt = Point(Point(9.526762916, 20.00815252, 0))
slider = Slider(20, range=0..40)
slider_2 = Slider(15, range=0..40)
range = Range(Domain=Domain(0, 1), Steps=expr("x+1", slider_2))
range_2 = Range(Domain=Domain(0, 1), Steps=expr("x+1", slider))
vcomp = Decompose(Vector=[md_slider_3, md_slider_4, md_slider_2, md_slider])  # -> XComponent, YComponent, ZComponent
cull_i = CullIndex(List=reverse(range), Indices=0, Wrap=False)  # -> reverse(List)
cull_i_2 = CullIndex(List=reverse(range_2), Indices=0, Wrap=False)  # -> reverse(List)
cull_i_3 = CullIndex(List=range, Indices=0, Wrap=False)
cull_i_4 = CullIndex(List=range_2, Indices=0, Wrap=False)
dom = Domain(DomainStart=cull_i, DomainEnd=cull_i_3)
dom_2 = Domain(DomainStart=cull_i_2, DomainEnd=cull_i_4)
# 05 - Smooth Cross Section Heights from Moments
# Difficulty: Hard (TRIAL/PRO version only)
# Takes the original CrossSectionHeightsfromMoments definition and smoothens the beam heights and then reassembling the model in Karamba to calculate the final model. A meshload is applied on the overall structure.
# The Eccentricities on Beam component aligns the top of all beams in one plane. Set the Grid to 3 x 2 for the to view with the TRIAL version.
sqgrid = Square(Plane=pt, Size=1, ExtentX=slider_2, ExtentY=slider)  # -> flatten(Cells), flatten(Points)
fdom = FindDomain(Domains=dom, Number=vcomp.XComponent, Strict=False)  # -> Index, Neighbour
fdom_2 = FindDomain(Domains=dom_2, Number=vcomp.YComponent, Strict=False)  # -> Index, Neighbour
explode = Explode(Curve=sqgrid.Cells, Recursive=True)  # -> flatten(Segments), Vertices
eval = Evaluate(F="x*(y+1)+z", x=fdom.Index, y=slider, z=fdom_2.Index)
rdlines = RemoveDuplicateLinesKaramba(Line=explode.Segments, LDist=0.005)  # -> OutLine, Info, Indexes
lng = ListLength(List=rdlines.OutLine)
item = ListItem(List=sqgrid.Points, Index=eval, Wrap=True)
series = Series(Start=0, Step=1, Count=lng)
bbox = BoundingBox(Content=sqgrid.Cells, Plane=PlaneXY(0, 0, 0), UnionBox=True)  # -> Box, Box_2
int = Integer(series)
debrep = DeconstructBrep(Brep=bbox.Box)  # -> Faces, Edges, Vertices
frompoints = MeshFromPoints(Points=sqgrid.Points, UDirection=expr("x+1", slider_2), VDirection=expr("x+1", slider))
Z = UnitZ(Factor="-2")
concat = Concatenate(FragmentA="BEAM_", FragmentB=int)
item_2 = ListItem(List=debrep.Vertices, Index=0, Wrap=True)  # -> Item, Item1, Item2, Item3
# convert line to beam
linetobeam = LineToBeamKaramba(Point=sqgrid.Points, Line=rdlines.OutLine, New=True, Remove=True, LDist=0.005, Identifier=concat)  # -> Point, Beam, Info
loads = LoadsKaramba(Vector=Z, Mesh=frompoints, LCase=0, mode="Mesh Load", menu=[buttons(off, on, off), buttons(on, on)])
# define supports
supp = SupportKaramba(PosInd=item, menu=[buttons(on, on, on, off, off, off)])
# define loads
loads_2 = LoadsKaramba(Vector=Vector(0, 0, -1), LCase=0, mode="Gravity")
aligndim = AlignedDimension(
    Plane=PlaneXY(0, 0, 0),
    PointA=[item_2.Item, item_2.Item1],
    PointB=[item_2.Item1, item_2.Item2],
    Offset=-1,
    Text="{0:0.00}",
    Size=1)
# assemble model
assemble = AssembleModelKaramba(Elem=linetobeam.Beam, Support=supp, Load=[loads_2, loads], LDist=0.005)  # -> Model, Info, Mass, CenterOfGravity
# analyse model
analyzethi = AnalyzeThIKaramba(Model=assemble.Model)  # -> ModelWithDisplacements, MaximumDisplacement_m, ResultingForceOfGravity_kN, ElasticEnergy_kNm
# view results
modelview = ModelViewKaramba(Model=analyzethi.ModelWithDisplacements, LoadCaseFactorsForLinearSuperposition=1, IndexIncrementOfVisibleLoadcase=0)  # -> Model, MeshOfRendering, DeformedStructure, DeformedModel
beamview = BeamViewKaramba(Model=modelview.Model)  # -> Model, MeshOfRendering, DeformedBeamAxes, LegendColors, LegendTags
# cross section heights
Z_2 = UnitZ(Factor=-1)
# create cross section heights from section forces
crv = Curve(flatten(rdlines.OutLine))
crv_2 = Curve(beamview.DeformedBeamAxes)
column_diameter_cm = Panel("30")
end = EndPoints(Curve=crv_2)  # -> Start, End
line = LineSDL(Start=item, Direction=Z_2, Length="4")
end_2 = EndPoints(Curve=graft(crv))  # -> Start, End
pt_2 = Point([end.Start, end.End])
pt_3 = Point([end_2.Start, end_2.End])
project = Project(Geometry=pt_2, Plane=PlaneXY(0, 0, 0))  # -> Geometry, Transform
# disassemble model to calculate new cross section heights
disassemble = DisassembleModelKaramba(Model=analyzethi.ModelWithDisplacements)  # -> Model, Point, Beam, Shell, Support, Load, Line, Mesh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
crv_3 = Curve(line)
crv_4 = Curve(line)
pipe = Pipe(Curve=crv_3, Radius=expr("x/200", column_diameter_cm), Caps=0)
pgroups = PointGroups(Points=project.Geometry, Distance="0.01")  # -> Groups, Indices
# create beam element for column
panel = Panel("2")
item_3 = ListItem(List=pt_2, Index=pgroups.Indices, Wrap=True)
txt = Text(simplify(graft(concat)))
avr = Average(Input=item_3)  # -> flatten(ArithmeticMean)
# define supports
end_3 = EndPoints(Curve=crv_4)  # -> Start, End
num = Number(column_diameter_cm)
project_2 = Project(Geometry=flatten(avr), Plane=PlaneXY(0, 0, 0))  # -> Geometry, Transform
cross_sections = CrossSectionsKaramba(ElementsIdentifiers="column", Diameter_cm=num, WallThickness_cm=0.4, mode="Circular Hollow")
linetobeam_2 = LineToBeamKaramba(Line=crv_4, New=True, Remove=True, LimitDistance_m=0.005, BeamIdentifier="column")  # -> Points, Element, Info
supp_2 = SupportKaramba(PosInd=end_3.End, menu=[buttons(on, on, on, off, off, off)])
cp = ClosestPoint(Point=project.Geometry, Cloud=project_2.Geometry)  # -> ClosestPoint, CPIndex, Distance
item_4 = ListItem(List=avr, Index=cp.CPIndex, Wrap=True)
lng_2 = ListLength(List=item_4)
series_2 = Series(Start=0, Step=1, Count=expr("x/2", lng_2))
# set the min and mix beam dimensions
series_3 = Series(Start=series_2, Step=expr("x/2", lng_2), Count=2)
item_5 = ListItem(List=item_4, Index=series_3, Wrap=True)
pdecon = Deconstruct(Point=item_5)  # -> XComponent, YComponent, ZComponent
max_beam_height = Panel("1")
min_beam_height = Panel("0.2")
num_2 = Number(pdecon.ZComponent)
dom_3 = ConstructDomain(DomainStart=min_beam_height, DomainEnd=max_beam_height)
bnd = Bounds(Numbers=flatten(num_2))
# use a graph to adjust the beam heights
remap = RemapNumbers(Value=num_2, Source=bnd, Target=dom_3)  # -> Mapped, Clipped
graph = GraphMapper(remap.Mapped, x0=0, x1=1, y0=0, y1=1, container_name="Conic", Cx=0.3282442689, Cy=0.6898550987)
num_3 = Number(graph)
bnd_2 = Bounds(Numbers=flatten(num_3))
remap_2 = RemapNumbers(Value=num_3, Source=bnd_2, Target=dom_3)  # -> Mapped, Clipped
beam_heights = Number(remap_2.Mapped)
avr_2 = Average(Input=beam_heights)  # -> simplify(ArithmeticMean)
expression = Expression(x=avr_2, Expression="Round(x*100,2)")
division = Division(A=expression, B=panel)
# set beam eccentricites
Z_3 = UnitZ(Factor=expr("-x", division))
# define cross sections
cross_sections_2 = CrossSectionsKaramba(
    ElementsIdentifiers=txt,
    NameOfCrossSection=expression,
    Height_cm=expression,
    UpperFlangeWidth_cm="2",
    LowerFlangeWidth_cm="2",
    UpperFlangeThickness_cm=expr("X/2", "2"),
    LowerFlangeThickness_cm=expr("X/2", "2"),
    SidewallsThickness_cm=0.4,
    FilletRadius_cm=0.6,
    mode="Box")  # -> flatten(CrossSection)
eccent_beam = EccentricityOnBeamKaramba(Beam=flatten(disassemble.Beam), LocalEccentricity_cm=flatten(Z_3))
# reassemble model
assemble_2 = AssembleModelKaramba(
    Point=disassemble.Point,
    Elem=flatten([linetobeam_2.Element, eccent_beam]),
    Support=supp_2,
    Load=disassemble.Load,
    CrossSection=[cross_sections_2, cross_sections],
    LimitDistance_m=0.005)  # -> Model, Info, Mass_kg, CenterOfGravity
# analyse model
analyzethi_2 = AnalyzeThIKaramba(Model=assemble_2.Model)  # -> CalculatedModel, MaximumDisplacement_m, ResultingForceOfGravity_kN, ElasticEnergy_kNm
# view results
modelview_2 = ModelViewKaramba(Model=analyzethi_2.CalculatedModel, LoadCaseFactorsForLinearSuperposition=1, IndexIncrementOfVisibleLoadcase=0)  # -> Model, DeformedMesh, DeformedAxes, DeformedModel
beamview_2 = BeamViewKaramba(Model=modelview_2.Model)  # -> Model, MeshesOfRenderedBeams, DeformedBeamAxes, LegendColors, LegendTags
Z_4 = UnitZ(Factor=expr("-x", remap_2.Mapped))
move = Move(Geometry=pt_3, Motion=Z_4)  # -> Geometry, Transform
item_6 = ListItem(List=move.Geometry, Index=0, Wrap=True)  # -> Item, Item1
item_7 = ListItem(List=pt_3, Index=0, Wrap=True)  # -> Item, Item1
srf4pt = _4PointSurface(CornerA=item_7.Item, CornerB=item_7.Item1, CornerC=item_6.Item1, CornerD=item_6.Item)
preview = CustomPreview(Geometry=[srf4pt, pipe], Shader=ColourSwatch(SwatchColor=RGB(150, 150, 150)))
