# Grasshopper definition 02_HighRiseSystems.gh (Grasshopper 0.9.76)
# plug-ins: Karamba

bays = Slider(6, range=2..8)
storeys = Slider(30, range=4..30)
# parameters for height and number of bays
width_of_bay = Panel("6")
storey_height = Panel("4")
series = Series(Start=0, Step=storey_height, Count=storeys)
# 01 - High Rise Systems
# Difficulty: Moderate (FREE/PRO Versions only)
# Shows the effect of different kinds of horizontal bracing systems. Feel free to alter the number of bays and storeys.
series_2 = Series(Start=0, Step=width_of_bay, Count=bays)
vec = VectorXYZ(XComponent=graft(series_2), YComponent=0, ZComponent=series)  # -> simplify(Vector), Length

num = Number(storeys)
# create geometry
vec_2 = Vector(vec.Vector)
# create geometry
vec_3 = Vector(vec.Vector)
# create geometry
vec_4 = Vector(vec.Vector)
num_2 = Number(bays)
num_3 = Number(storeys)
larger = LargerThan(FirstNumber=num, SecondNumber="7")  # -> LargerThan, OrEqualTo
filter = StreamFilter(Gate=larger.LargerThan, Stream0="1", Stream1="3")
division = Division(A=num, B=4)
series_3 = Series(Start=expr("x-1", num_2), Step=-1, Count=num_2)
series_4 = Series(Start=0, Step=1, Count=num_2)
series_5 = Series(Start=-1, Step=-3, Count=3)
vec_5 = Vector(Vector(0, 0, -5))
vec_6 = Vector("0,0,0")
move = Move(Geometry=vec_3, Translation="0,0,0")  # -> Geometry, Transform
lng = ListLength(List=vec_3)
series_6 = Series(Start=division, Step=division, Count=filter)
addition = Addition(A=vec_6, B=vec_5)
Z = UnitZ(Factor=series_5)
series_7 = Series(Start=series_3, Step=expr("x-1", num_2), Count=num_3)  # -> simplify(Series)
series_8 = Series(Start=series_4, Step=expr("x-1", num_2), Count=num_3)  # -> simplify(Series)
lng_2 = ListLength(List=flatten(lng))
move_2 = Move(Geometry=vec_2, Translation="70,0,0")  # -> Geometry, Transform
lng_3 = ListLength(List=vec_2)
int = Integer(series_6)
flip = FlipMatrix(Data=move.Geometry)
vec_7 = Vector("70,0,0")
series_9 = Series(Start=-1, Step=-3, Count=3)
vec_8 = Vector(Vector(0, 0, -5))
lng_4 = ListLength(List=flatten(lng_3))
move_3 = Move(Geometry=addition, Motion=Z)  # -> Geometry, Transform
eval = Evaluate(F="Int(x/2-1)", x=lng_2)
addition_2 = Addition(A=int, B=1)
flip_2 = FlipMatrix(Data=move_2.Geometry)
move_4 = Move(Geometry=vec_4, Translation="-70,0,0")  # -> Geometry, Transform
addition_3 = Addition(A=vec_7, B=vec_8)
Z_2 = UnitZ(Factor=series_9)
pline = PolyLine(Vertices=move.Geometry, Closed=False)
pline_2 = PolyLine(Vertices=flip, Closed=False)
addition_4 = Addition(A=eval, B=1)
eval_2 = Evaluate(F="Int(x/2-1)", x=lng_4)
item = ListItem(List=move.Geometry, Index=int, Wrap=True)
item_2 = ListItem(List=move.Geometry, Index=addition_2, Wrap=True)
flip_3 = FlipMatrix(Data=move_4.Geometry)
# create geometry
vec_9 = Vector(vec.Vector)
item_3 = ListItem(List=move_4.Geometry, Index=series_8, Wrap=False)
item_4 = ListItem(List=move_4.Geometry, Index=series_7, Wrap=False)
series_10 = Series(Start=-1, Step=-3, Count=3)
vec_10 = Vector("-70,0,0")
vec_11 = Vector(Vector(0, 0, -5))
move_5 = Move(Geometry=addition_3, Motion=Z_2)  # -> Geometry, Transform
addition_5 = Addition(A=eval_2, B=1)
pline_3 = PolyLine(Vertices=move_2.Geometry, Closed=False)
pline_4 = PolyLine(Vertices=flip_2, Closed=False)
explode = Explode(Curve=pline, Recursive=True)  # -> flatten(Segments), Vertices
explode_2 = Explode(Curve=pline_2, Recursive=True)  # -> flatten(Segments), Vertices
xz = XZPlane(Origin=move_3.Geometry)
branch = TreeBranch(Tree=move.Geometry, Path=eval, MaintainPaths=False)
branch_2 = TreeBranch(Tree=move.Geometry, Path=addition_4, MaintainPaths=False)
flip_4 = FlipMatrix(Data=item)
flip_5 = FlipMatrix(Data=item_2)
pline_5 = PolyLine(Vertices=move_4.Geometry, Closed=False)
pline_6 = PolyLine(Vertices=flip_3, Closed=False)
flip_6 = FlipMatrix(Data=item_3)
flip_7 = FlipMatrix(Data=item_4)
addition_6 = Addition(A=vec_10, B=vec_11)
Z_3 = UnitZ(Factor=series_10)
move_6 = Move(Geometry=vec_9, Translation="140,0,0")  # -> Geometry, Transform
explode_3 = Explode(Curve=pline_3, Recursive=True)  # -> flatten(Segments), Vertices
explode_4 = Explode(Curve=pline_4, Recursive=True)  # -> flatten(Segments), Vertices
xz_2 = XZPlane(Origin=move_5.Geometry)
branch_3 = TreeBranch(Tree=move_2.Geometry, Path=eval_2, MaintainPaths=False)
branch_4 = TreeBranch(Tree=move_2.Geometry, Path=addition_5, MaintainPaths=False)
cull = CullPattern(List=branch, CullPattern=[False, True])
cull_2 = CullPattern(List=branch_2, CullPattern=[True, False])
merge = Merge(StreamA=flip_4, StreamB=flip_5)
series_11 = Series(Start=-1, Step=-3, Count=3)
vec_12 = Vector("140,0,0")
vec_13 = Vector(Vector(0, 0, -5))
explode_5 = Explode(Curve=pline_5, Recursive=True)  # -> flatten(Segments), Vertices
explode_6 = Explode(Curve=pline_6, Recursive=True)  # -> flatten(Segments), Vertices
move_7 = Move(Geometry=addition_6, Motion=Z_3)  # -> Geometry, Transform
clean = CleanTree(RemoveNulls=True, RemoveInvalid=True, RemoveEmpty=True, Tree=flip_6)
clean_2 = CleanTree(RemoveNulls=True, RemoveInvalid=True, RemoveEmpty=True, Tree=flip_7)
weave = Weave(Pattern=[0, 1], Stream0=cull_2, Stream1=cull, NullGaps=False)
flip_8 = FlipMatrix(Data=move_6.Geometry)
cull_3 = CullPattern(List=branch_3, CullPattern=[False, True])
cull_4 = CullPattern(List=branch_4, CullPattern=[True, False])
prox = Proximity3D(Points=merge, Group=4, MinRadius=7, MaxRadius=8)  # -> Links, Topology
addition_7 = Addition(A=vec_12, B=vec_13)
Z_4 = UnitZ(Factor=series_11)
xz_3 = XZPlane(Origin=move_7.Geometry)
pline_7 = PolyLine(Vertices=clean, Closed=False)
pline_8 = PolyLine(Vertices=clean_2, Closed=False)
pline_9 = PolyLine(Vertices=weave, Closed=False)
pline_10 = PolyLine(Vertices=flip_8, Closed=False)
weave_2 = Weave(Pattern=[1, 0], Stream0=cull_3, Stream1=cull_4, NullGaps=False)
pline_11 = PolyLine(Vertices=move_6.Geometry, Closed=False)
move_8 = Move(Geometry=addition_7, Motion=Z_4)  # -> Geometry, Transform
rdlines = RemoveDuplicateLines(Line=flatten(prox.Links), LDist=0.005)  # -> flatten(OutLine), Info, Indexes
clean_3 = CleanTree(Data=[pline_7, pline_8], CleanInvalid=True, CleanEmpty=True)
explode_7 = Explode(Curve=pline_9, Recursive=True)  # -> flatten(Segments), Vertices
explode_8 = Explode(Curve=pline_11, Recursive=True)  # -> flatten(Segments), Vertices
explode_9 = Explode(Curve=pline_10, Recursive=True)  # -> flatten(Segments), Vertices
pline_12 = PolyLine(Vertices=weave_2, Closed=False)
xz_4 = XZPlane(Origin=move_8.Geometry)
explode_10 = Explode(Curve=clean_3, Recursive=True)  # -> flatten(Segments), Vertices
explode_11 = Explode(Curve=pline_12, Recursive=True)  # -> flatten(Segments), Vertices
path_mapper = PathMapper(explode_9.Segments, source="{A}", target="{1}")
path_mapper_2 = PathMapper(explode_8.Segments, source="{A}", target="{0}")
path_mapper_3 = PathMapper(explode_2.Segments, source="{A}", target="{1}")
path_mapper_4 = PathMapper(explode_7.Segments, source="{A}", target="{2}")
path_mapper_5 = PathMapper(rdlines.OutLine, source="{A}", target="{3}")
pt = Point(flatten(move_6.Geometry))
path_mapper_6 = PathMapper(explode.Segments, source="{A}", target="{0}")
path_mapper_7 = PathMapper(explode_5.Segments, source="{A}", target="{0}")
path_mapper_8 = PathMapper(explode_6.Segments, source="{A}", target="{1}")
path_mapper_9 = PathMapper(explode_10.Segments, source="{A}", target="{2}")
pt_2 = Point(flatten(move_4.Geometry))
pt_3 = Point(flatten(move.Geometry))
path_mapper_10 = PathMapper(explode_4.Segments, source="{A}", target="{1}")
path_mapper_11 = PathMapper(explode_11.Segments, source="{A}", target="{2}")
path_mapper_12 = PathMapper(explode_3.Segments, source="{A}", target="{0}")
pt_4 = Point(flatten(move_2.Geometry))
lng_5 = ListLength(List=[path_mapper_2, path_mapper])  # -> flatten(Length)
lng_6 = ListLength(List=[path_mapper_7, path_mapper_8, path_mapper_9])  # -> flatten(Length)
lng_7 = ListLength(List=[path_mapper_6, path_mapper_3, path_mapper_4, path_mapper_5])  # -> flatten(Length)
lng_8 = ListLength(List=[path_mapper_12, path_mapper_10, path_mapper_11])  # -> flatten(Length)
ma = MassAddition(Input=["0", lng_5])  # -> Result, PartialResult
ma_2 = MassAddition(Input=["0", lng_6])  # -> Result, PartialResult
ma_3 = MassAddition(Input=["0", lng_7])  # -> Result, PartialResult
ma_4 = MassAddition(Input=["0", lng_8])  # -> Result, PartialResult
cull_i = CullIndex(List=reverse(ma.PartialResult), Indices=0, Wrap=False)  # -> reverse(List)
cull_i_2 = CullIndex(List=ma.PartialResult, Indices=0, Wrap=False)
cull_i_3 = CullIndex(List=reverse(ma_2.PartialResult), Indices=0, Wrap=False)  # -> reverse(List)
cull_i_4 = CullIndex(List=ma_2.PartialResult, Indices=0, Wrap=False)
pt_5 = Point(flatten(pt))
cull_i_5 = CullIndex(List=reverse(ma_3.PartialResult), Indices=0, Wrap=False)  # -> reverse(List)
cull_i_6 = CullIndex(List=reverse(ma_4.PartialResult), Indices=0, Wrap=False)  # -> reverse(List)
cull_i_7 = CullIndex(List=ma_3.PartialResult, Indices=0, Wrap=False)
cull_i_8 = CullIndex(List=ma_4.PartialResult, Indices=0, Wrap=False)
series_12 = Series(Start=cull_i, Step=1, Count=cull_i_2)  # -> simplify(Series)
series_13 = Series(Start=cull_i_3, Step=1, Count=cull_i_4)  # -> simplify(Series)
series_14 = Series(Start=cull_i_5, Step=1, Count=cull_i_7)  # -> simplify(Series)
series_15 = Series(Start=cull_i_6, Step=1, Count=cull_i_8)  # -> simplify(Series)
item_5 = ListItem(List=flip_3, Index=0, Wrap=True)  # -> flatten(Item)
item_6 = ListItem(List=flip_8, Index=0, Wrap=True)  # -> flatten(Item)
int_2 = Integer(series_12)
int_3 = Integer(series_13)
int_4 = Integer(series_15)
concat = Concatenate(FragmentA="E", FragmentB=int_2)
int_5 = Integer(series_14)
concat_2 = Concatenate(FragmentA="E", FragmentB=int_3)
pt_6 = Point(flatten(pt_2))
concat_3 = Concatenate(FragmentA="E", FragmentB=int_4)
item_7 = ListItem(List=flip, Index=0, Wrap=True)  # -> flatten(Item)
pt_7 = Point(flatten(pt_4))
concat_4 = Concatenate(FragmentA="E", FragmentB=int_5)
height = Panel("""30
20""")
item_8 = ListItem(List=flip_2, Index=0, Wrap=True)  # -> flatten(Item)
item_9 = ListItem(List=move_4.Geometry, Index=0, Wrap=True)  # -> flatten(Item)
vec_14 = VectorXYZ(XComponent="100", YComponent=0, ZComponent=0)  # -> Vector, Length
vec_15 = VectorXYZ(XComponent="100", YComponent=0, ZComponent=0)  # -> Vector, Length
lng_9 = ListLength(List=item_5)
# convert line to beam
pt_8 = Point(flatten(pt_3))
lng_10 = ListLength(List=item_6)
item_10 = ListItem(List=move.Geometry, Index=0, Wrap=True)  # -> flatten(Item)
width = Panel("""20
20""")
vec_16 = VectorXYZ(XComponent="100", YComponent=0, ZComponent=0)  # -> Vector, Length
lng_11 = ListLength(List=item_7)
vec_17 = VectorXYZ(XComponent="100", YComponent=0, ZComponent=0)  # -> Vector, Length
lng_12 = ListLength(List=item_8)
item_11 = ListItem(List=move_6.Geometry, Index=0, Wrap=True)  # -> flatten(Item)
division_2 = Division(A=vec_15.Vector, B=lng_10)
division_3 = Division(A=vec_14.Vector, B=lng_9)
t = Panel("""2
2""")
members = Panel("""col
slab
core
outr""")
# convert line to beam
linetobeam = LineToBeamKaramba(Point=pt_6, Line=[path_mapper_7, path_mapper_8, path_mapper_9], New=True, Remove=True, LDist=0.005, Identifier=concat_2)  # -> Point, Beam, Info
width_2 = Panel("""20
20
15
20""")
# convert line to beam
linetobeam_2 = LineToBeamKaramba(
    Point=pt_7,
    Line=[path_mapper_12, path_mapper_10, path_mapper_11],
    New=True,
    Remove=True,
    LDist=0.005,
    Identifier=concat_3)  # -> Point, Beam, Info
linetobeam_3 = LineToBeamKaramba(
    Point=pt_8,
    Line=[path_mapper_6, path_mapper_3, path_mapper_4, path_mapper_5],
    New=True,
    Remove=True,
    LDist=0.005,
    Identifier=concat_4)  # -> Point, Beam, Info
height_2 = Panel("""30
20
15
20""")
members_2 = Panel("""col
slab
bracing""")
height_3 = Panel("""30
20
15""")
width_3 = Panel("""20
20
15""")
height_4 = Panel("""30
20
15""")
width_4 = Panel("""20
20
15""")
item_12 = ListItem(List=move_2.Geometry, Index=0, Wrap=True)  # -> flatten(Item)
division_4 = Division(A=vec_16.Vector, B=lng_11)
division_5 = Division(A=vec_17.Vector, B=lng_12)
t_2 = Panel("""2
2
3
3""")
bending = Panel("""0
0
0
0""")
bending_2 = Panel("""0
0
0""")
t_3 = Panel("""2
2
3""")
panel = Panel("""0
0
0""")
t_4 = Panel("""2
2
3""")
# define cross sections
crossecs = CrossSectionsKaramba(
    ElementsIdentifiers=concat,
    Height_cm=graft(height),
    UpperFlangeWidth_cm=graft(width),
    LowerFlangeWidth_cm=graft(width),
    UpperFlangeThickness_cm=graft(t),
    LowerFlangeThickness_cm=graft(t),
    SidewallsThickness_cm=graft(t),
    FilletRadius_cm=0.6,
    mode="Box")
# define cross sections
crossecs_2 = CrossSectionsKaramba(
    ElementsIdentifiers=concat_3,
    Height_cm=graft(height_4),
    UpperFlangeWidth_cm=graft(width_4),
    LowerFlangeWidth_cm=graft(width_4),
    UpperFlangeThickness_cm=graft(t_4),
    LowerFlangeThickness_cm=graft(t_4),
    SidewallsThickness_cm=graft(t_4),
    FilletRadius_cm=0.6,
    mode="Box")
# define cross sections
crossecs_3 = CrossSectionsKaramba(
    ElementsIdentifiers=concat_4,
    Height_cm=graft(height_2),
    UpperFlangeWidth_cm=graft(width_2),
    LowerFlangeWidth_cm=graft(width_2),
    UpperFlangeThickness_cm=graft(t_2),
    LowerFlangeThickness_cm=graft(t_2),
    SidewallsThickness_cm=graft(t_2),
    FilletRadius_cm=0.6,
    mode="Box")
# define cross sections
crossecs_4 = CrossSectionsKaramba(
    ElementsIdentifiers=concat_2,
    Height_cm=graft(height_3),
    UpperFlangeWidth_cm=graft(width_3),
    LowerFlangeWidth_cm=graft(width_3),
    UpperFlangeThickness_cm=graft(t_3),
    LowerFlangeThickness_cm=graft(t_3),
    SidewallsThickness_cm=graft(t_3),
    FilletRadius_cm=0.6,
    mode="Box")
# modify beam
modifyelem = ModifyElementKaramba(Beam=linetobeam_2.Beam, Bending=graft(panel), mode="Beam")
# modify beam
modifyelem_2 = ModifyElementKaramba(Beam=linetobeam_3.Beam, Bending=graft(bending), mode="Beam")
# modify beam
modifyelem_3 = ModifyElementKaramba(Beam=linetobeam.Beam, Bending=graft(bending_2), mode="Beam")
# convert line to beam
linetobeam_4 = LineToBeamKaramba(Point=pt_5, Line=[path_mapper_2, path_mapper], New=True, Remove=True, LDist=0.005, Identifier=concat)  # -> Point, Beam, Info
# define loads
loads = LoadsKaramba(ForceVector=division_2, Local=True, PosInd=item_6, LCase=0, mode="Point")
# define loads
loads_2 = LoadsKaramba(ForceVector=division_5, Local=True, PosInd=item_8, LCase=0, mode="Point")
# define loads
loads_3 = LoadsKaramba(ForceVector=division_4, Local=True, PosInd=item_7, LCase=0, mode="Point")
# define supports
supp = SupportKaramba(PosInd=item_11, menu=[buttons(on, on, on, on, on, off)])
# define supports
supp_2 = SupportKaramba(PosInd=item_12, menu=[buttons(on, on, on, on, on, off)])
supp_3 = SupportKaramba(PosInd=pt_4, menu=[buttons(off, on, off, off, off, off)])
# define supports
supp_4 = SupportKaramba(PosInd=item_10, menu=[buttons(on, on, on, on, on, off)])
supp_5 = SupportKaramba(PosInd=pt_3, menu=[buttons(off, on, off, off, off, off)])
loads_4 = LoadsKaramba(Vector="0,0,-2", LCase=0, mode="Gravity")
loads_5 = LoadsKaramba(Vector="0,0,-2", LCase=0, mode="Gravity")
loads_6 = LoadsKaramba(Vector="0,0,-2", LCase=0, mode="Gravity")
# define loads
loads_7 = LoadsKaramba(ForceVector=division_3, Local=True, PosInd=item_5, LCase=0, mode="Point")
# define supports
supp_6 = SupportKaramba(PosInd=item_9, menu=[buttons(on, on, on, on, off, off)])
supp_7 = SupportKaramba(PosInd=pt_2, menu=[buttons(off, on, off, off, off, off)])
loads_8 = LoadsKaramba(Vector="0,0,-2", LCase=0, mode="Gravity")
# assemble model
assemble = AssembleModelKaramba(
    Point=flatten(pt_8),
    Elem=flatten(modifyelem_2),
    Support=flatten([supp_4, supp_5]),
    Load=flatten([loads_3, loads_6]),
    CrossSection=flatten(crossecs_3),
    LDist=0.005)  # -> Model, Info, Mass, CenterOfGravity
num_4 = Number(flatten(assemble.Mass))
expression = Expression(x=num_4, Expression="Format(\"Mass = {0} t\", Round(x/1000,2))")
# assemble model
assemble_2 = AssembleModelKaramba(
    Point=flatten(linetobeam_4.Point),
    Elem=flatten(linetobeam_4.Beam),
    Support=flatten(supp),
    Load=flatten([loads, loads_4]),
    CrossSection=flatten(crossecs),
    LDist=0.005)  # -> Model, Info, Mass, CenterOfGravity
num_5 = Number(flatten(assemble_2.Mass))
expression_2 = Expression(x=num_5, Expression="Format(\"Mass = {0} t\", Round(x/1000,2))")
# assemble model
assemble_3 = AssembleModelKaramba(
    Point=flatten(pt_7),
    Elem=flatten(modifyelem),
    Support=flatten([supp_2, supp_3]),
    Load=flatten([loads_2, loads_5]),
    CrossSection=flatten(crossecs_2),
    LDist=0.005)  # -> Model, Info, Mass, CenterOfGravity
num_6 = Number(flatten(assemble_3.Mass))
expression_3 = Expression(x=num_6, Expression="Format(\"Mass = {0} t\", Round(x/1000,2))")
# assemble model
assemble_4 = AssembleModelKaramba(
    Point=flatten(pt_6),
    Elem=flatten(modifyelem_3),
    Support=flatten([supp_6, supp_7]),
    Load=flatten([loads_7, loads_8]),
    CrossSection=flatten(crossecs_4),
    LDist=0.005)  # -> Model, Info, Mass, CenterOfGravity
num_7 = Number(flatten(assemble_4.Mass))
expression_4 = Expression(x=num_7, Expression="Format(\"Mass = {0} t\", Round(x/1000,2))")
# analyse model
analyzethi = AnalyzeThIKaramba(Model=assemble.Model)  # -> ModelWithDisplacements, MaximumDisplacement_m, ResultingForceOfGravity_kN, ElasticEnergy_kNm
num_8 = Number(flatten(analyzethi.MaximumDisplacement_m))
expression_5 = Expression(x=num_8, Expression="Format(\"Displacement = {0} mm\", Int(x*1000))")
tag = TextTag3D(Location=graft(xz), Text=graft(["Core + Outrigger", expression_5, expression]), Size=1.6, Justification=7)
# analyse model
analyzethi_2 = AnalyzeThIKaramba(Model=assemble_2.Model)  # -> ModelWithDisplacements, MaximumDisplacement_m, ResultingForceOfGravity_kN, ElasticEnergy_kNm
num_9 = Number(flatten(analyzethi_2.MaximumDisplacement_m))
expression_6 = Expression(x=num_9, Expression="Format(\"Displacement = {0} mm\", Int(x*1000))")
tag_2 = TextTag3D(Location=graft(xz_4), Text=graft(["Frame", expression_6, expression_2]), Size=1.6, Justification=7)
# analyse model
analyzethi_3 = AnalyzeThIKaramba(Model=assemble_3.Model)  # -> ModelWithDisplacements, MaximumDisplacement_m, ResultingForceOfGravity_kN, ElasticEnergy_kNm
num_10 = Number(flatten(analyzethi_3.MaximumDisplacement_m))
expression_7 = Expression(x=num_10, Expression="Format(\"Displacement = {0} mm\", Int(x*1000))")
tag_3 = TextTag3D(Location=graft(xz_2), Text=graft(["Core", expression_7, expression_3]), Size=1.6, Justification=7)
# analyse model
analyzethi_4 = AnalyzeThIKaramba(Model=assemble_4.Model)  # -> ModelWithDisplacements, MaximumDisplacement_m, ResultingForceOfGravity_kN, ElasticEnergy_kNm
num_11 = Number(flatten(analyzethi_4.MaximumDisplacement_m))
expression_8 = Expression(x=num_11, Expression="Format(\"Displacement = {0} mm\", Int(x*1000))")
tag_4 = TextTag3D(Location=graft(xz_3), Text=graft(["Crossbracing", expression_8, expression_4]), Size=1.6, Justification=7)
mass = Panel(assemble_4.Mass)
displacement = Panel(analyzethi_4.MaximumDisplacement_m)
mass_2 = Panel(assemble_3.Mass)
displacement_2 = Panel(analyzethi_3.MaximumDisplacement_m)
mass_3 = Panel(assemble.Mass)
displacement_3 = Panel(analyzethi.MaximumDisplacement_m)
displacement_4 = Panel(analyzethi_2.MaximumDisplacement_m)
mass_4 = Panel(assemble_2.Mass)
# view results
modelview = ModelViewKaramba(Model=analyzethi_4.ModelWithDisplacements, LoadCaseFactorsForLinearSuperposition=1, IndexIncrementOfVisibleLoadcase=0)  # -> Model, MeshOfRendering, DeformedStructure, DeformedModel
# view results
modelview_2 = ModelViewKaramba(Model=analyzethi_3.ModelWithDisplacements, LoadCaseFactorsForLinearSuperposition=1, IndexIncrementOfVisibleLoadcase=0)  # -> Model, MeshOfRendering, DeformedStructure, DeformedModel
# view results
modelview_3 = ModelViewKaramba(Model=analyzethi.ModelWithDisplacements, LoadCaseFactorsForLinearSuperposition=1, IndexIncrementOfVisibleLoadcase=0)  # -> Model, MeshOfRendering, DeformedStructure, DeformedModel
# view results
modelview_4 = ModelViewKaramba(Model=analyzethi_2.ModelWithDisplacements, LoadCaseFactorsForLinearSuperposition=1, IndexIncrementOfVisibleLoadcase=0)  # -> Model, MeshOfRendering, DeformedStructure, DeformedModel
beamview = BeamViewKaramba(Model=modelview.Model)  # -> Model, MeshOfRendering, DeformedBeamAxes, LegendColors, LegendTags
beamview_2 = BeamViewKaramba(Model=modelview_2.Model)  # -> Model, MeshOfRendering, DeformedBeamAxes, LegendColors, LegendTags
beamview_3 = BeamViewKaramba(Model=modelview_3.Model)  # -> Model, MeshOfRendering, DeformedBeamAxes, LegendColors, LegendTags
beamview_4 = BeamViewKaramba(Model=modelview_4.Model)  # -> Model, MeshOfRendering, DeformedBeamAxes, LegendColors, LegendTags
