# Grasshopper definition 03_CrossSectionHeightsFromMoments.gh (Grasshopper 0.9.76)
# plug-ins: Karamba

md_slider = MDSlider(
    slider_value=Point(0.2158537144, 0.1904877453, 0.5),
    SliderMode=0,
    x_domain=Domain(0, 1),
    y_domain=Domain(0, 1),
    z_domain=Domain(0, 1))
md_slider_2 = MDSlider(
    slider_value=Point(0.6695122137, 0.8324391435, 0.5),
    SliderMode=0,
    x_domain=Domain(0, 1),
    y_domain=Domain(0, 1),
    z_domain=Domain(0, 1))
md_slider_3 = MDSlider(
    slider_value=Point(0.916829179, 0.2912195717, 0.5),
    SliderMode=0,
    x_domain=Domain(0, 1),
    y_domain=Domain(0, 1),
    z_domain=Domain(0, 1))
# create geometry
pt = Point(Point(9.526762916, 20.00815252, 0))
slider = Slider(20, range=0..40)
slider_2 = Slider(15, range=0..40)
range = Range(Domain=Domain(0, 1), Steps=expr("x+1", slider_2))
range_2 = Range(Domain=Domain(0, 1), Steps=expr("x+1", slider))
vcomp = Decompose(Vector=[md_slider, md_slider_2, md_slider_3])  # -> XComponent, YComponent, ZComponent
# Difficulty: Moderate
# Cross section forces of a structure under dead weight are used to scale the cross section heights in a rectangular grid of beams. Contains a trick regarding the flexible definition of support positions.
# Set the Grid to 3 x 2 for the to view with the TRIAL version.
cull_i = CullIndex(List=reverse(range), Indices=0, Wrap=False)  # -> reverse(List)
cull_i_2 = CullIndex(List=reverse(range_2), Indices=0, Wrap=False)  # -> reverse(List)
cull_i_3 = CullIndex(List=range, Indices=0, Wrap=False)
cull_i_4 = CullIndex(List=range_2, Indices=0, Wrap=False)
dom = Domain(DomainStart=cull_i, DomainEnd=cull_i_3)
dom_2 = Domain(DomainStart=cull_i_2, DomainEnd=cull_i_4)
fdom = FindDomain(Domains=dom, Number=vcomp.XComponent, Strict=False)  # -> Index, Neighbour
fdom_2 = FindDomain(Domains=dom_2, Number=vcomp.YComponent, Strict=False)  # -> Index, Neighbour
# 05 - Cross Section Heights from Moments
sqgrid = Square(Plane=pt, Size=1, ExtentX=slider_2, ExtentY=slider)  # -> flatten(Cells), flatten(Points)
eval = Evaluate(F="x*(y+1)+z", x=fdom.Index, y=slider, z=fdom_2.Index)
explode = Explode(Curve=sqgrid.Cells, Recursive=True)  # -> flatten(Segments), Vertices
bbox = BoundingBox(Content=sqgrid.Cells, Plane=PlaneXY(0, 0, 0), UnionBox=True)  # -> Box, Box_2
item = ListItem(List=sqgrid.Points, Index=eval, Wrap=True)
rdlines = RemoveDuplicateLinesKaramba(Line=explode.Segments, LDist=0.005)  # -> OutLine, Info, Indexes
debrep = DeconstructBrep(Brep=bbox.Box)  # -> Faces, Edges, Vertices
item_2 = ListItem(List=debrep.Vertices, Index=0, Wrap=True)  # -> Item, Item1, Item2, Item3
# convert line to beam
linetobeam = LineToBeamKaramba(Point=sqgrid.Points, Line=rdlines.OutLine, New=True, Remove=True, LDist=0.005)  # -> Point, Beam, Info
# define supports
supp = SupportKaramba(PosInd=item, menu=[buttons(on, on, on, off, off, off)])
# define loads
loads = LoadsKaramba(Vector=Vector(0, 0, -1), LCase=0, mode="Gravity")
aligndim = AlignedDimension(
    Plane=PlaneXY(0, 0, 0),
    PointA=[item_2.Item, item_2.Item1],
    PointB=[item_2.Item1, item_2.Item2],
    Offset=-1,
    Text="{0:0.00}",
    Size=1)
# assemble model
assemble = AssembleModelKaramba(Elem=linetobeam.Beam, Support=supp, Load=loads, LDist=0.005)  # -> Model, Info, Mass, CenterOfGravity
# analyse model
analyzethi = AnalyzeThIKaramba(Model=assemble.Model)  # -> ModelWithDisplacements, MaximumDisplacement_m, ResultingForceOfGravity_kN, ElasticEnergy_kNm
# view results
modelview = ModelViewKaramba(Model=analyzethi.ModelWithDisplacements, LoadCaseFactorsForLinearSuperposition=1, IndexIncrementOfVisibleLoadcase=0)  # -> Model, MeshOfRendering, DeformedStructure, DeformedModel
beamview = BeamViewKaramba(Model=modelview.Model)  # -> Model, MeshOfRendering, DeformedBeamAxes, LegendColors, LegendTags

crv = Curve(beamview.DeformedBeamAxes)
crv_2 = Curve(rdlines.OutLine)
curvepoint = PointOnCurve(crv, parameter=1)
pull = PullPoint(Point=curvepoint, Geometry=crv_2, ClosestOnly=True)  # -> ClosestPoint, Distance
vec2pt = Vector2Pt(PointA=pull.ClosestPoint, PointB=curvepoint, Unitize=False)  # -> Vector, Length
vcomp_2 = Decompose(Vector=vec2pt.Vector)  # -> XComponent, YComponent, ZComponent
# cross section heights
panel = Panel("0.05")
max = Maximum(A=panel, B=vcomp_2.ZComponent)
min = Minimum(A=vcomp_2.ZComponent, B="-0.05")
sort = SortList(Keys=max)  # -> Keys, ValuesA
Z = UnitZ(Factor=max)
Z_2 = UnitZ(Factor=min)
move = Move(Geometry=crv_2, Motion=Z)  # -> Geometry, Transform
move_2 = Move(Geometry=crv_2, Motion=Z_2)  # -> Geometry, Transform
edgesrf = EdgeSurface(CurveA=move.Geometry, CurveB=move_2.Geometry)
