# Grasshopper definition 04_Optimization_ShapeIrregularStructure.gh (Grasshopper 0.9.76)
# plug-ins: Karamba

# parameters for supports
genes = GenePool(
    Decimals=2,
    Maximum=1,
    Minimum=0,
    Value=[0.9640413732, 0.5942069067, 0.4889678892, 0.00956680207, 0.7556243775, 0.5235885249, 0.4843276546, 0.7022026669, 0.2058792693, 0.7857289909])
# create grid
pt = Point(Point(106.0890811, 73.08763888, 0))
planesrf = PlaneSurface(Plane=pt, XSize=Domain(0, 10), YSize=Domain(0, 10))
preview = CustomPreview(Geometry=planesrf, Shader=ColourSwatch(SwatchColor=RGBA(168, 168, 168, 67)))
dispatch = Dispatch(List=genes, DispatchPattern=[True, False])  # -> ListA, ListB
sdivide = DivideSurface(Surface=planesrf, UCount=1, VCount=1)  # -> flatten(Points), Normals, Parameters
Z = UnitZ(Factor=10)
pt_2 = ConstructPoint(XCoordinate=dispatch.ListA, YCoordinate=dispatch.ListB, ZCoordinate=0)
# 03 - Optimization of an Irregular Structure
# Difficulty: Moderate (PRO Version only)
# A grid of beams is supported at five points. Columns from the base to the roof grid are stitched using Element Felting creating irregularity within the structure.
# The position of the support positions is optimized using galapagos based on the deflection.
move = Move(Geometry=planesrf, Motion=Z)  # -> Geometry, Transform
item = ListItem(List=sdivide.Points, Index=0, Wrap=True)  # -> Item, Item1, Item2
evalsrf = EvaluateSurface(Surface=reparameterize(planesrf), Point=pt_2)  # -> Point, Normal, Frame
aligndim = AlignedDimension(
    Plane=PlaneXY(0, 0, 0),
    PointA=[item.Item, item.Item2],
    PointB=[item.Item1, item.Item],
    Offset=1,
    Text="{0:0.00}",
    Size=0.5)
sdivide_2 = DivideSurface(Surface=move.Geometry, UCount=Slider(6, range=2..10), VCount=Slider(6, range=2..10))  # -> Points, Normals, Parameters
flip = FlipMatrix(Data=sdivide_2.Points)
pline = PolyLine(Vertices=sdivide_2.Points, Closed=False)
pline_2 = PolyLine(Vertices=flip, Closed=False)
explode = Explode(Curve=[pline_2, pline], Recursive=True)  # -> Segments, Vertices
cp = ClosestPoint(Point=evalsrf.Point, Cloud=flatten(explode.Vertices))  # -> ClosestPoint, CPIndex, Distance
ln = Line(StartPoint=cp.ClosestPoint, EndPoint=evalsrf.Point)
entwine = Entwine(Branch00=explode.Segments, Branch01=ln, FlattenInputs=True)
panel = Panel("""roof
columns""")
Z_2 = UnitZ(Factor="-2")
# define supports
supp = SupportKaramba(PosInd=evalsrf.Point, menu=[buttons(on, on, on, off, off, off)])
# convert lines to beams
linetobeam = LineToBeamKaramba(Line=entwine, New=True, Remove=True, LDist=0.005, Identifier=graft(panel))  # -> Point, Beam, Info
# define loads
loads = LoadsKaramba(ForceVector=Z_2, Local=True, PosInd=explode.Vertices, LCase=0, mode="Point")
# define cross sections
cross_sections = CrossSectionsKaramba(Diameter_cm="30", WallThickness_cm="2", mode="Circular Hollow")
loads_2 = LoadsKaramba(Vector=Vector(0, 0, -1), LCase=0, mode="Gravity")
# assemble model
assemble = AssembleModelKaramba(Elem=flatten(linetobeam.Beam), Support=supp, Load=flatten([loads, loads_2]), CrossSection=cross_sections, LDist=0.005)  # -> Model, Info, Mass, CenterOfGravity
# element felting
elemfelting = ElementFeltingKaramba(
    Model=assemble.Model,
    LimitDistance=Slider(7.4, range=0.5..10),
    SnapLength=Slider(0.5, range=0.05..0.5),
    MaximumElementLength=-1,
    StartingElementIndex=0,
    MaximumNumberOfConnections=-1)
# analyse model
analyzethi = AnalyzeThIKaramba(Model=elemfelting)  # -> ModelWithDisplacements, MaximumDisplacement_m, ResultingForceOfGravity_kN, ElasticEnergy_kNm
# optimisation of form
galapagos = Galapagos(fitness=displace, gene=genes)
displace = Number(analyzethi.MaximumDisplacement_m)
displacement = Panel(displace)
# view results
modelview = ModelViewKaramba(Model=analyzethi.ModelWithDisplacements, LoadCaseFactorsForLinearSuperposition=1, IndexIncrementOfVisibleLoadcase=0)  # -> Model, MeshOfRendering, DeformedStructure, DeformedModel
beamview = BeamViewKaramba(Model=modelview.Model)  # -> Model, MeshOfRendering, DeformedBeamAxes, LegendColors, LegendTags
