# Grasshopper definition 06_LargeDeformationTriangularGridshell.gh (Grasshopper 0.9.76)
# plug-ins: Karamba

pt = Point([Point(1.058299944, 8.501823982, 0), Point(7.939971617, 2.755962197, 0), Point(32.52691507, 7.165577056, 0), Point(34.06359904, 16.05161912, 0), Point(23.86929237, 19.99354755, 0), Point(22.31677384, 23.06691548, 0), Point(21.16881619, 34.29138967, 0), Point(11.34740128, 30.95077235, 0)])
grid_size = Slider(1.2, range=1..10)
# create geometry
bnd = Bounds2D(Coordinates=pt)
item = ListItem(List=pt, Index=0, Wrap=True)  # -> Item, Item1, Item2, Item3
dedom2num = DeconstructDomain²(Domain=bnd)  # -> UMin, UMax, VMin, VMax
aligndim = AlignedDimension(
    Plane=PlaneXY(0, 0, 0),
    PointA=[item.Item, item.Item1],
    PointB=[item.Item1, item.Item2],
    Offset=-2,
    Text="{0:0.00}",
    Size=1)
expression = Expression(x=dedom2num.UMin, y=dedom2num.UMax, z=grid_size, Expression="ceiling((y-x)/z*2)")
expression_2 = Expression(x=dedom2num.VMin, y=dedom2num.VMax, z=grid_size, Expression="ceiling((y-x)/z/sin(pi/3))")
# 04 - Large Deformation of a Triangular Gridshell
# Difficulty: Moderate (PRO version only)
# Using the Large Deformation Analysis we can simulate the behaviour of a hanging model to find the optimum form for a triangular gridshell.
# The Beam Joint Agent releases rotation in all axes at the supports.
vec = VectorXYZ(XComponent=dedom2num.UMin, YComponent=dedom2num.VMin, ZComponent=0)  # -> Vector, Length
trigrid = Triangular(Plane=vec.Vector, Size=grid_size, ExtentX=expression, ExtentY=expression_2)  # -> Cells, Points
explode = Explode(Curve=trigrid.Cells, Recursive=True)  # -> Segments, Vertices
rdlines = RemoveDuplicateLinesKaramba(Line=flatten(explode.Segments), LDist=0.005)  # -> OutLine, Info, Indexes
nurbs = NurbsCurve(Vertices=pt, Degree=3, Periodic=True)  # -> Curve, Length, Domain
xy = XYPlane(Origin=Point(0, 0, 0))
ccx = CurveCurve(CurveA=nurbs.Curve, CurveB=rdlines.OutLine)  # -> flatten(Points), flatten(ParamsA), ParamsB
trim = TrimWithRegion(Curve=rdlines.OutLine, Region=nurbs.Curve, Plane=xy)  # -> flatten(Inside), Outside
sort = SortList(Keys=ccx.ParamsA, ValuesA=ccx.Points)  # -> Keys, ValuesA
pline = PolyLine(Vertices=sort.ValuesA, Closed=True)
explode_2 = Explode(Curve=pline, Recursive=True)  # -> Segments, Vertices
range = Range(Domain="0.5 to 1.5", Steps=10)
pt_2 = Point([Point(18.01839589, 7.725677167, 0), Point(8.094484219, 18.13017566, 0), Point(20.29151467, 21.97537189, 0), Point(23.69776883, 16.43540467, 0)])
ids = Panel("""A
B""")
entwine = Entwine(Branch00=trim.Inside, Branch01=explode_2.Segments, FlattenInputs=True)
eval = Evaluate(F="n&\" \"&x&\"/\"&y", n="BOX", x="10", y=range)
Z = UnitZ(Factor=1)
# convert lines to beams
linetobeam = LineToBeamKaramba(Line=entwine, New=True, Remove=True, LDist_m=0.005, Identifier=graft(ids))  # -> Points, flatten(Element), Info
pull = PullPoint(Point=pt_2, Geometry=flatten(linetobeam.Points), ClosestOnly=True)  # -> ClosestPoint, Distance
section = Box(
    FamilyNameOfCrossSection="BOX",
    NameOfCrossSection=eval,
    Height_cm="10",
    UpperFlangeWidth_cm="10",
    LowerFlangeWidth_cm="10",
    UpperFlangeThickness_cm=range,
    LowerFlangeThickness_cm=range,
    SidewallsThickness_cm=range,
    FilletRadius_cm=0.6,
    mode="Box")
crosecselect = CrossSectionSelectorKaramba(ElementsIdentifiers=ids, NameOrListIndexOfCrossSection="0", CrossSections=graft(section))  # -> flatten(CrossSection), Info
section_2 = Box(
    ElementsIdentifiers="B",
    FamilyNameOfCrossSection="EDGE",
    NameOfCrossSection="EDGE",
    Height_cm="10",
    UpperFlangeWidth_cm="10",
    LowerFlangeWidth_cm="10",
    UpperFlangeThickness_cm="3",
    LowerFlangeThickness_cm="3",
    SidewallsThickness_cm="3",
    FilletRadius_cm=0.6,
    mode="Box")
# define joints
jointagent = BeamJointAgentKaramba(
    ToGeometry=pull.ClosestPoint,
    Ct_kN_m=Vector(0, 0, 0),
    Cr_kNm_rad="{0.01,0.01,0.01}",
    menu=[buttons(off, off, off, on, on, on)])
# define supports
supp = SupportKaramba(PosInd=pull.ClosestPoint, menu=[buttons(on, on, on, on, on, on)])
supp_2 = SupportKaramba(PosInd=explode_2.Vertices, menu=[buttons(on, on, off, off, off, off)])
# define loads
gravity_load = Gravity(Vector=Z, LCase=0, mode="Gravity")
# assemble model
assemble = AssembleModelKaramba(
    Elem=flatten(linetobeam.Element),
    Support=flatten([supp, supp_2]),
    Load=flatten(gravity_load),
    CrossSection=flatten([section_2, crosecselect.CrossSection]),
    Joint=flatten(jointagent),
    LDist=0.005)  # -> Model, Info, Mass, CenterOfGravity
d = Slider(10, range=0..20)
# perform large
# deformation analysis
ladeform = AnalyzeLargeDeformationKaramba(Model=assemble.Model, Iterations=Slider(20, range=0..20), MaximumDisplacement_m=d)  # -> ModelWithDisplacements, MaximumDisplacement_m
# reassemble model
disassemble = DisassembleModelKaramba(Model=ladeform.ModelWithDisplacements)  # -> Model, Point, Beam, Shell, Support, Load, Line, Mesh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
# redefine loads
gravity_load_2 = Gravity(Vector=Vector(0, 0, -1), LCase=0, mode="Gravity")
assemble_2 = AssembleModelKaramba(
    Point=flatten(disassemble.Point),
    Elem=flatten(disassemble.Beam),
    Support=flatten(disassemble.Support),
    Load=flatten(gravity_load_2),
    CrossSection=flatten(disassemble.CrossSection),
    Joint=flatten(disassemble.Joint),
    LDist=0.005)  # -> Model, Info, Mass, CenterOfGravity
# cross section
# optimization
opticrosec = OptimizeCrossSectionKaramba(
    Model=assemble_2.Model,
    CrossSections=section,
    MaximumUtilization=1,
    MaximumDisplacement_m=-1,
    UltimateLimitStateIterations=5,
    DisplacementIterations=5,
    NumberOfSamplePoints=3,
    ElasticDesign=True,
    GammaM0=1,
    GammaM1=1)  # -> ModelWithOptimizedCrossSections, Info, Mass_kg, MaximumDisplacement_m, ElasticEnergy_kNm
# view results
modelview = ModelViewKaramba(
    Model=opticrosec.ModelWithOptimizedCrossSections,
    LoadCaseFactorsForLinearSuperposition=1,
    IndexIncrementOfVisibleLoadcase=0)  # -> Model, MeshOfRendering, DeformedStructure, DeformedModel
beamview = BeamViewKaramba(Model=modelview.Model)  # -> Model, MeshesOfRenderedBeams, DeformedBeamAxes, LegendColors, LegendTags
legend = Legend(Colour=beamview.LegendColors, Tags=beamview.LegendTags, LegendType=1)
