# Grasshopper definition 08_Optimization_ShellBridge.gh (Grasshopper 0.9.76)
# plug-ins: Karamba, Octopus

bridgecrosssectionheight = Slider(9.8, range=2..10)
# create geometry
pt = Point(Point(-29.62751221, -3.508493978, 0))
pt_2 = Point(Point(30.37248779, -3.508493978, 0))
width_supports = Slider(5, range=5..20)
additionalwidth_center = Slider(5.4, range=5..10)
archheight = Slider(10, range=5..10)
aligndim = AlignedDimension(Plane=PlaneXY(0, 0, 0), PointA=pt, PointB=pt_2, Offset=-1, Text="{0:0.00}", Size=1)
addition = Addition(A=archheight, B=bridgecrosssectionheight)
addition_2 = Addition(A=width_supports, B=additionalwidth_center)
merge = Merge(Data1=archheight, Data2=addition)
# 03 - Optimization of Shell Bridge
# Difficulty: Moderate
# This definition uses Octopus to find the optimal height and width of a concrete shell bridge based on the deflection, weight and height. The octopus component contains some sample iterations.
# To view in the TRIAL version, set the Mesh Resolution to 6 and the Edge Refinement Factor to 1.
vec2pt = Vector2Pt(PointA=pt, PointB=pt_2, Unitize=False)  # -> Vector, Length
multiplication = Multiplication(A=addition_2, B=-1)
multiplication_2 = Multiplication(A=width_supports, B=-1)
panel = Panel("""1
0
0
1""")
series = Series(Start=expr("-x/2", width_supports), Step=expr("x/3", width_supports), Count=4)
merge_2 = Merge(Data1=multiplication, Data2=multiplication_2, Data3=width_supports, Data4=addition_2)
align = AlignPlane(Plane=pt, Direction=vec2pt.Vector)  # -> Plane, Angle
range = Range(Domain=vec2pt.Length, Steps="4")
item = ListItem(List=merge, Index=panel, Wrap=True)
entwine = Entwine(Branch00=series, Branch01=merge_2, Branch02=merge_2, Branch03=merge_2, Branch04=series, FlattenInputs=True)
entwine_2 = Entwine(Branch00="0", Branch01=item, Branch02=item, Branch03=item, Branch04="0", FlattenInputs=True)
pt_3 = PointOriented(BasePlane=graft(align.Plane), UComponent=graft(range), VComponent=entwine, WComponent=entwine_2)  # -> simplify(Point)
# parameters for support positions
nurbs = NurbsCurve(Vertices=pt_3, Degree=3, Periodic=False)  # -> Curve, Length, Domain
panel_2 = Panel("""{0.0,1.0,0.0}
{1.0,0.0,0.0}
{1.0,1.0,0.0}
{0.0,0.0,0.0}""")
loft = Loft(
    Curves=flatten(nurbs.Curve),
    Options={Adjust=False, Closed=False, LoftEnds=0, LoftSimp=0, LoftType=1, Rebuild=10, Refit=0.01})
res = Slider(3, range=0.5..6)
srf = Surface(loft)
evalsrf = EvaluateSurface(Surface=reparameterize(srf), Point=panel_2)  # -> Point, Normal, Frame
range_2 = Range(Domain="10 to 60", Steps=10)
mesh_breps = MeshBreps(
    Brep=srf,
    InclusionPoints=evalsrf.Point,
    MeshResolution=res,
    EdgeRefinementFactor=0.67,
    PointReduction=False,
    SmoothingStepSize=0,
    SmoothingIterations=5)  # -> Mesh, Info
expression = Expression(x="Shell", y=range_2, Expression="x&\" \"&y")
readmattable = ReadMaterialTableFromFileKaramba()
dispatch = Dispatch(List=evalsrf.Point, DispatchPattern=[True, False])  # -> ListA, ListB
cross_sections = CrossSectionsKaramba(FamilyNameOfCrossSection="Shell", NameOfCrossSection=graft(expression), Heights_cm=graft(range_2), mode="Shell")  # -> flatten(CrossSection)
# define materials
matselect = MaterialSelectionKaramba(Materials=readmattable, menu=[dropdown(2), dropdown(6)])
# define cross sections
crosecselect = CrossSectionSelectorKaramba(ElementsIdentifiers="S", NameOrListIndexOfCrossSection="0", CrossSections=cross_sections)  # -> CrossSection, Info
# define supports
supp = SupportKaramba(PosInd=dispatch.ListA, menu=[buttons(on, on, on, off, off, off)])
supp_2 = SupportKaramba(PosInd=dispatch.ListB, menu=[buttons(on, off, on, off, off, off)])
# define loads
loads = LoadsKaramba(Vector=Vector(0, 0, -1), LCase=0, mode="Gravity")
# convert mesh to shell
meshtoshell = MeshToShellKaramba(Mesh=mesh_breps.Mesh, LDist=0.005, Identifier="S")  # -> Point, Element, Info
# assemble model
assemble = AssembleModelKaramba(
    Elem=flatten(meshtoshell.Element),
    Support=flatten([supp, supp_2]),
    Load=flatten(loads),
    CrossSection=flatten(crosecselect.CrossSection),
    Material=flatten(matselect),
    LimitDistance_m=0.005)  # -> Model, Info, Mass_kg, CenterOfGravity
# optimize cross sections
opticrosec = OptimizeCrossSectionKaramba(
    Model=assemble.Model,
    CrossSections=cross_sections,
    MaximumUtilization=1,
    MaximumDisplacement_m="0.20",
    UltimateLimitStateIterations=5,
    DisplacementIterations=5,
    NumberOfSamplePoints=3,
    ElasticDesign=True,
    GammaM0=1,
    GammaM1=1)  # -> ModelWithOptimizedCrossSections, Info, Mass_kg, MaximumDisplacement_m, ElasticEnergy_kNm
num = Number(flatten(opticrosec.MaximumDisplacement_m))
num_2 = Number(flatten(assemble.Mass_kg))
num_3 = Number(flatten(addition))
# view results
modelview = ModelViewKaramba(
    Model=opticrosec.ModelWithOptimizedCrossSections,
    LoadCaseFactorsForLinearSuperposition=1,
    IndexIncrementOfVisibleLoadcase=0)  # -> Model, DeformedMesh, DeformedAxes, DeformedModel
displacement = Panel(num)
total_mass = Panel(num_2)
neg = Negative(Value=num_3)
total_height = Panel(num_3)
shellview = ShellViewKaramba(Model=modelview.Model)  # -> Model, MeshesOfRenderedShells, LegendColors, LegendTags
# multi objective optimization with octopus
item_2 = ListItem(List=shellview.MeshesOfRenderedShells, Index=0, Wrap=True)
# optimizing the geometry based on minimum displacement,
# minimum mass and maximum height
octopus = Octopus(
    Phenotype=item_2,
    OctopusData_gene=[width_supports, additionalwidth_center, archheight, bridgecrosssectionheight],
    OctopusData_obj=[num_4, txt])
legend = Legend(Colour=shellview.LegendColors, Tags=shellview.LegendTags, LegendType=1)
num_4 = Number([num, num_2, neg])
panel_3 = Panel(num_4)
panel_4 = Panel("""disp
mass
height""")
txt = Text(panel_4)
