# Grasshopper definition 09_QuickFeedbackInputCurves.gh (Grasshopper 0.9.76)
# plug-ins: Karamba

# ---- group: input curves, explode into segments; divide at intersections / rhino input curves
crv = Curve([<curve referenced from the Rhino model> x195])

# ---- group: input points; snap to nearest node on lines above / rhino input points
pt = Point([<point referenced from the Rhino model> x10])

# ---- group: input curves, explode into segments; divide at intersections
# This work is licensed under a Creative Commons Attribution 4.0 licence. You are free to copy, communicate and adapt the work, so long as you attribute the work in the manner specified by the author or licensor (but not in any way that suggests that they endorse you or your use of the work). A copy of this licence is available at http://http://creativecommons.org/licenses/by/4.0/ or write to info@creativecommons.org
# to apply to a new model:
# right-click and set multiple curves;
# 
# ** pay close attention to intersections of rhino curves; karamba will not read joints if lines are not intersecting
explode = Explode(Curve=crv, Recursive=True)  # -> flatten(Segments), Vertices
llinter = LineLineIntersectionKaramba(Line=explode.Segments, LengthTolerance=0.01)  # -> IntersectionPoints, flatten(LineSubSegements)

# ----
# Structural Performance Feedback:
# 
# 2.1 QUICK FEEDBACK input curves
# visualize load path; identify rough limits to geometry and support systems
# DOMAIN:      curves analyzed as beams
# 
# ATTRIBUTES: member utilization (cross-section optimization)
# 
# OPERATIONS: size beams according to load path / utilization (cross-section optimization)
# All definitions are organized according to:
# DOMAIN (model framework)
# ATTRIBUTES (what is being measured?)
# OPERATIONS (what is changing based on measurements?)
# This definition takes curve input from rhino, converts them to beams and optimizes each cross section.
# 
# steps to alter:
# 
# 
# 1. change slider that controls loads
# 2. alter existing geometry
# 3. test your own curves, surface loads, and support point input
panel_2 = Panel(" ")

# ---- group: dead load
Z = UnitZ(Factor="-1")
loads = LoadsKaramba(Vector=Z, LCase=0, mode="Gravity")
panel_3 = Panel(loads)

# ---- group: live load applied as uniform distributed (mesh) loads / load magnitude
live_load = Slider(-0.25, range=-0.25..-0.04)

# ---- group: live load applied as uniform distributed (mesh) loads / rhino input surfaces for live load
srf = Surface([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])

# ---- group: live load applied as uniform distributed (mesh) loads / mesh density
# ** note: low mesh density can
# result in uneven distribution of load
number_slider = Slider(76, range=0..100)
mesh_uv = MeshSurface(Surface=srf, UCount=number_slider, VCount=number_slider, Overhang=True, Equalize=False)

# ---- group: apply initial cross-section / smallest W section is #378 in list
panel_4 = Panel("378")

# ---- group: apply initial cross-section / list of karamba standard cross-sections
readcstable = ReadCrossSectionTableFromFileKaramba()  # -> CrossSection, Info
panel_5 = Panel(readcstable.CrossSection)

# ---- group: apply initial cross-section
crosecselect = CrossSectionSelectorKaramba(ElementsIdentifiers="beams", NameOrListIndexOfCrossSection=panel_4, CrossSections=readcstable.CrossSection)  # -> flatten(CrossSection), Info
panel_6 = Panel(crosecselect.CrossSection)

# ----
linetobeam = LineToBeamKaramba(Line=llinter.LineSubSegements, New=True, Remove=True, LimitDistance_m=0.005, BeamIdentifier="beams")  # -> flatten(Points), Element, Info
rdpoints = RemoveDuplicatePointsKaramba(Point=linetobeam.Points, LimitDistance=0.005)  # -> flatten(OutPoint), Info, Indexes

# ---- group: input points; snap to nearest node on lines above
# to apply to a new model:
# right-click and set multiple points;
# 
# ** points must be near intended supports;
# definition will automatically snap to closest node in model
fsim = FindSimilarMember(Data=pt, Set=linetobeam.Points)  # -> Hit, Index

# ----
# Karamba Input
supp = SupportKaramba(PosInd=fsim.Hit, menu=[buttons(on, on, on, off, off, off)])

# ---- group: The W sections are #369 to 640 in the list
range = Range(Domain="369 to 640", Steps="271")

# ---- group: optional variation
# (optional)
# plug this into the Name | Ind input instead of the range;
# This would limit the cross sections to 3 sections:
# W4x13, W12x14, and W18x65
panel_7 = Panel("""369
410
486""")

# ---- group: list of standard karamba cross-sections
readcstable_2 = ReadCrossSectionTableFromFileKaramba()  # -> CrossSection, Info
panel_8 = Panel(readcstable_2.CrossSection)

# ---- group: live load applied as uniform distributed (mesh) loads
# LIVE LOAD REFERENCE:
# ref: The Structural Basis of Architecture, Sandaker et al.
# residential (typical) 	2 kN/m2  	.04 kip/ft2
# office (tyipcal)  			3 kN/m2  	.06 kip/ft2
# public plazas  	12 kN/m2  	.25 kip/ft2
# athletic facilities (typical)  5 kN/m2  	.1 kip/ft2
# hospitals (operating rooms)  3 kN/m2   .06 kip/ft2
# libraries (book stacks)  7 kN/m2   .15 kip/ft2
# manufacturing (typical)  6 kN/m2   .125 kip/ft2
# heavy equipment   12 kN/m2   .25 kip/ft2
# schools (classrooms)   2 kN/m2   .04 kip/ft2
# schools (hallways)   5 kN/m2   .1 kip/ft2
Z_2 = UnitZ(Factor=live_load)

# ----
loads_2 = LoadsKaramba(Vector=Z_2, Mesh=mesh_uv, LCase=0, mode="Mesh Load", menu=[buttons(on, off, off), buttons(on, on)])

# ---- group: live load applied as uniform distributed (mesh) loads (continued)
panel_9 = Panel(loads_2)

# ---- group: assemble elements and analyze
assemble = AssembleModelKaramba(
    Point=rdpoints.OutPoint,
    Elem=linetobeam.Element,
    Support=supp,
    Load=[loads, loads_2],
    CrossSection=crosecselect.CrossSection,
    LimitDistance_m=0.005)  # -> Model, Info, Mass_kg, CenterOfGravity
analyzethi = AnalyzeThIKaramba(Model=assemble.Model)  # -> CalculatedModel, MaximumDisplacement_m, ResultingForceOfGravity_kN, ElasticEnergy_kNm

# ----
# This definition combines attributes and operations (both are performed by the "optimize cross-section component".
# 
# Optimize cross-section uses an iterative procedure to determine the optimal cross-section for each member and optionally limit the maximum deflection of the structure.
panel_10 = Panel("beams")
crosecselect_2 = CrossSectionSelectorKaramba(ElementsIdentifiers=panel_10, NameOrListIndexOfCrossSection=range, CrossSections=readcstable_2.CrossSection)  # -> flatten(CrossSection), Info
opticrosec = OptimizeCrossSectionKaramba(
    Model=analyzethi.CalculatedModel,
    CrossSections=crosecselect_2.CrossSection,
    MaximumUtilization=1,
    MaximumDisplacement_ft=-1,
    UltimateLimitStateIterations=5,
    DisplacementIterations=5,
    NumberOfSamplePoints=3,
    ElasticDesign=True,
    GammaM0=1,
    GammaM1=1)  # -> ModelWithOptimizedCrossSections, Info, Mass_lb, MaximumDisplacement_ft, ElasticEnergy_kip_ft

# ---- group: internal forces
# NOTE:
# You can call a specific group of beams using the 'BeamIds' input
b_forces = BeamForcesKaramba(
    AnalyzedModel=opticrosec.ModelWithOptimizedCrossSections,
    LCase=-1,
    MaximumDistanceBetweenResults_m=-1,
    NumberOfResultsPerBeamElement=2)  # -> AnalyzedModel, NormalForce_kN, ShearForceVz_kN, ShearForceVy_kN, BendingMomentMt_kNm, BendingMomentMy_kNm, BendingMomentMz_kNm
panel_11 = Panel(b_forces.BendingMomentMy_kNm)

# ----
# Karamba Output
modelview = ModelViewKaramba(
    Model=opticrosec.ModelWithOptimizedCrossSections,
    LoadCaseFactorsForLinearSuperposition=1,
    IndexIncrementOfVisibleLoadcase=0)  # -> Model, DeformedMesh, DeformedAxes, DeformedModel

# ----
# NOTE:
# If you want to SEE the deformation with the beam visualization plug in the BeamView AFTER the ModelView. The numerical data is the SAME if you plug BeamView directly into the Analyze component.
beamview = BeamViewKaramba(Model=modelview.Model)  # -> Model, MeshesOfRenderedBeams, DeformedBeamAxes, LegendColors, LegendTags
