# Grasshopper definition 10_QuickFeedbackInputSurfaces.gh (Grasshopper 0.9.76)
# plug-ins: Karamba

# ---- group: mesh outlines -> beam network / input floor surfaces / rhino input: polysurface
# This work is licensed under a Creative Commons Attribution 4.0 licence. You are free to copy, communicate and adapt the work, so long as you attribute the work in the manner specified by the author or licensor (but not in any way that suggests that they endorse you or your use of the work). A copy of this licence is available at http://http://creativecommons.org/licenses/by/4.0/ or write to info@creativecommons.org
brep = Brep([<brep referenced from the Rhino model> x8])

# ---- group: mesh outlines -> beam network / input floor surfaces / mesh density
number_slider = Slider(10, range=0..100)

# ---- group: mesh outlines -> beam network / brep to mesh to outline curves
mesh_breps = MeshBreps(
    Brep=brep,
    MeshResolution=number_slider,
    EdgeRefinementFactor=0.67,
    PointReduction=False,
    SmoothingStepSize=0,
    SmoothingIterations=5)  # -> flatten(Mesh), Info
faceb = FaceBoundaries(Mesh=mesh_breps.Mesh)  # -> flatten(Boundaries)
explode = Explode(Curve=faceb, Recursive=True)  # -> flatten(Segments), Vertices
rdlines = RemoveDuplicateLinesKaramba(Line=flatten(explode.Segments), LimitDistance=0.005)  # -> flatten(OutLine), Info, Indexes

# ----
# Structural Performance Feedback:
# 
# 2.2 QUICK FEEDBACK input surfaces
# visualize load path; identify rough limits to geometry and support systems
# DOMAIN:      divided mesh - analyze mesh division edges as beams
# 
# ATTRIBUTES: member utilization (cross-section optimization)
# 
# OPERATIONS: size beams according to load path / utilization (cross-section optimization)
# All definitions are organized according to:
# DOMAIN (model framework)
# ATTRIBUTES (what is being measured?)
# OPERATIONS (what is changing based on measurements?)
# This definition takes surface input from rhino, divides them as meshes according to density sliders, converts the mesh edges to beams and optimizes each cross section.
# 
# steps to alter:
# 
# 
# 1. change slider that controls mesh density
# 2. change slider that controls loads
# 3. test your own surfaces
panel_2 = Panel(" ")

# ---- group: dead load
Z = UnitZ(Factor="-1")
loads = LoadsKaramba(Vector=Z, LCase=0, mode="Gravity")  # -> flatten(Load)
panel_3 = Panel(loads)

# ---- group: live load applied as uniform distributed (mesh) loads / load magnitude
live_load = Slider(-0.25, range=-0.25..-0.04)

# ---- group: live load applied as uniform distributed (mesh) loads / mesh density
# ** note: low mesh density can
# result in uneven distribution of load
number_slider_2 = Slider(76, range=0..100)

# ---- group: apply initial cross-section / list of karamba standard cross-sections
readcstable = ReadCrossSectionTableFromFileKaramba()  # -> CrossSection, Info
panel_4 = Panel(readcstable.CrossSection)

# ---- group: apply initial cross-section / smallest W section is #378 in list
panel_5 = Panel("378")

# ---- group: apply initial cross-section
crosecselect = CrossSectionSelectorKaramba(ElementsIdentifiers="beams", NameOrListIndexOfCrossSection=panel_5, CrossSections=readcstable.CrossSection)  # -> flatten(CrossSection), Info
panel_6 = Panel(crosecselect.CrossSection)

# ----
linetobeam = LineToBeamKaramba(Line=rdlines.OutLine, New=True, Remove=True, LimitDistance_m=0.005, BeamIdentifier="beams")  # -> flatten(Points), Element, Info
rdpoints = RemoveDuplicatePointsKaramba(Point=linetobeam.Points, LimitDistance=0.005)  # -> flatten(OutPoint), Info, Indexes

# ---- group: find lowest z values; set as supports
# Plug this into supports to set lowest points (z-value) as supports
pdecon = Deconstruct(Point=rdpoints.OutPoint)  # -> XComponent, YComponent, ZComponent

# ---- group: find lowest z values; set as supports / find lowest z value
sort = SortList(Keys=pdecon.ZComponent)  # -> Keys, ValuesA
item = ListItem(List=sort.Keys, Index=0, Wrap=True)

# ---- group: find lowest z values; set as supports / add tolerance of 'y' to lowest value
expression = Expression(x=item, y=Slider(1, range=0..5), Expression="x+y")

# ---- group: find lowest z values; set as supports / ‌find all points lower than threshold; set as supports
smaller = SmallerThan(FirstNumber=pdecon.ZComponent, SecondNumber=expression)  # -> SmallerThan, OrEqualTo
cull = CullPattern(List=rdpoints.OutPoint, CullPattern=smaller.OrEqualTo)

# ---- group: live load applied as uniform distributed (mesh) loads
# LIVE LOAD REFERENCE:
# ref: The Structural Basis of Architecture, Sandaker et al.
# residential (typical) 	2 kN/m2  	.04 kip/ft2
# office (tyipcal)  			3 kN/m2  	.06 kip/ft2
# public plazas  	12 kN/m2  	.25 kip/ft2
# athletic facilities (typical)  5 kN/m2  	.1 kip/ft2
# hospitals (operating rooms)  3 kN/m2   .06 kip/ft2
# libraries (book stacks)  7 kN/m2   .15 kip/ft2
# manufacturing (typical)  6 kN/m2   .125 kip/ft2
# heavy equipment   12 kN/m2   .25 kip/ft2
# schools (classrooms)   2 kN/m2   .04 kip/ft2
# schools (hallways)   5 kN/m2   .1 kip/ft2
mesh_breps_2 = MeshBreps(
    Brep=brep,
    MeshResolution=number_slider_2,
    EdgeRefinementFactor=0.67,
    PointReduction=False,
    SmoothingStepSize=0,
    SmoothingIterations=5)  # -> Mesh, Info
Z_2 = UnitZ(Factor=live_load)
loads_2 = LoadsKaramba(Vector=Z_2, Mesh=mesh_breps_2.Mesh, LCase=0, mode="Mesh Load", menu=[buttons(on, off, off), buttons(on, on)])  # -> flatten(Load)
panel_7 = Panel(loads_2)

# ----
# Karamba Input
supp = SupportKaramba(PosInd=cull, menu=[buttons(on, on, on, on, on, on)])

# ---- group: assemble elements and analyze
assemble = AssembleModelKaramba(
    Elem=linetobeam.Element,
    Support=supp,
    Load=[loads, loads_2],
    CrossSection=crosecselect.CrossSection,
    LimitDistance_m=0.005)  # -> Model, Info, Mass_kg, CenterOfGravity
analyzethi = AnalyzeThIKaramba(Model=assemble.Model)  # -> CalculatedModel, MaximumDisplacement_m, ResultingForceOfGravity_kN, ElasticEnergy_kNm

# ---- group: optional variation
# (optional)
# plug this into the Name | Ind input instead of the range;
# This would limit the cross sections to 3 sections:
# W4x13, W12x14, and W18x65
panel_8 = Panel("""369
410
486""")

# ---- group: list of standard karamba cross-sections
readcstable_2 = ReadCrossSectionTableFromFileKaramba()  # -> CrossSection, Info
panel_9 = Panel(readcstable_2.CrossSection)

# ---- group: The W sections are #369 to 640 in the list
range = Range(Domain="369 to 640", Steps="271")

# ----
# This definition combines attributes and operations (both are performed by the "optimize cross-section component".
# 
# Optimize cross-section uses an iterative procedure to determine the optimal cross-section for each member and optionally limit the maximum deflection of the structure.
panel_10 = Panel("beams")
crosecselect_2 = CrossSectionSelectorKaramba(ElementsIdentifiers=panel_10, NameOrListIndexOfCrossSection=range, CrossSections=readcstable_2.CrossSection)  # -> flatten(CrossSection), Info
opticrosec = OptimizeCrossSectionKaramba(
    Model=analyzethi.CalculatedModel,
    CrossSections=crosecselect_2.CrossSection,
    MaximumUtilization=1,
    MaximumDisplacement_ft=-1,
    UltimateLimitStateIterations=5,
    DisplacementIterations=5,
    NumberOfSamplePoints=3,
    ElasticDesign=True,
    GammaM0=1,
    GammaM1=1)  # -> ModelWithOptimizedCrossSections, Info, Mass_lb, MaximumDisplacement_ft, ElasticEnergy_kip_ft

# ---- group: internal forces
# NOTE:
# You can call a specific group of beams using the 'BeamIds' input
b_forces = BeamForcesKaramba(
    AnalyzedModel=opticrosec.ModelWithOptimizedCrossSections,
    LCase=-1,
    MaximumDistanceBetweenResults_m=-1,
    NumberOfResultsPerBeamElement=2)  # -> AnalyzedModel, NormalForce_kN, ShearForceVz_kN, ShearForceVy_kN, BendingMomentMt_kNm, BendingMomentMy_kNm, BendingMomentMz_kNm
panel_11 = Panel(b_forces.BendingMomentMy_kNm)

# ----
# Karamba Output
modelview = ModelViewKaramba(
    Model=opticrosec.ModelWithOptimizedCrossSections,
    LoadCaseFactorsForLinearSuperposition=1,
    IndexIncrementOfVisibleLoadcase=0)  # -> Model, DeformedMesh, DeformedAxes, DeformedModel

# ----
# NOTE:
# If you want to SEE the deformation with the beam visualization plug in the BeamView AFTER the ModelView. The numerical data is the SAME if you plug BeamView directly into the Analyze component.
beamview = BeamViewKaramba(Model=modelview.Model)  # -> Model, MeshesOfRenderedBeams, DeformedBeamAxes, LegendColors, LegendTags
