# Grasshopper definition project1.gh (Grasshopper 1.0.7)
# plug-ins: Karamba

# ----
# Create the Geometry
number_of_floors = Slider(16, range=0..100)
floor_to_floor = Slider(2.3, range=0..10)
subtraction = Subtraction(A=number_of_floors, B="1")
series = Series(Start=0, Step=floor_to_floor, Count=number_of_floors)
ellipse = Ellipse(Plane=PlaneXY(0, 0, 0), Radius1=Slider(8, range=0..10), Radius2=Slider(2.8, range=0..10))  # -> Ellipse, Focus1, Focus2
Z = UnitZ(Factor=series)
dom = ConstructDomain(DomainStart="0", DomainEnd=Slider(180, range=0..180))
move = Move(Geometry=ellipse.Ellipse, Motion=Z)  # -> Geometry, Transform
range = Range(Domain=dom, Steps=subtraction)
dom_2 = ConstructDomain(DomainStart="1", DomainEnd=Slider(0.46, range=0..1))
area = Area(Geometry=move.Geometry)  # -> Area, Centroid
rad = Radians(Degrees=range)
range_2 = Range(Domain=dom_2, Steps=subtraction)
scale = Scale(Geometry=move.Geometry, Center=area.Centroid, Factor=range_2)  # -> Geometry, Transform
rotate = Rotate(Geometry=scale.Geometry, Angle=rad, Plane=PlaneXY(0, 0, 0))  # -> Geometry, Transform
series_2 = Series(Start=0, Step=1, Count=subtraction)
addition = Addition(A=series_2, B=Slider(1, range=0..1))
item = ListItem(List=rotate.Geometry, Index=addition, Wrap=True)  # -> graft(Item)
item_2 = ListItem(List=rotate.Geometry, Index=series_2, Wrap=True)  # -> graft(Item)
loft = Loft(Curves=[item_2, item], Options={Adjust=False, Closed=False, LoftEnds=0, LoftSimp=0, LoftType=0, Rebuild=10, Refit=0.01})
mesh_uv = MeshSurface(Surface=loft, UCount="2", VCount=Slider(30, range=0..30), Overhang=True, Equalize=False)  # -> flatten(Mesh)
tri = Triangulate(Mesh=mesh_uv)  # -> Mesh, Count

# ----
# Input in Karamba
medges = MeshEdges(Mesh=tri.Mesh)  # -> NakedEdges, InteriorEdges, NonManifoldEdges
line = Line(flatten([medges.NakedEdges, medges.InteriorEdges, medges.NonManifoldEdges]))
rdlines = RemoveDuplicateLinesKaramba(Line=line, LimitDistance=0.005)  # -> OutLine, Info, Indexes
line_2 = Line(rdlines.OutLine)
end = EndPoints(Curve=line_2)  # -> Start, End
pt = Point([end.Start, end.End])
Y = UnitY(Factor=1)
geo = Geometry(loft)
linetobeam = LineToBeamKaramba(Line=line_2, New=True, Remove=True, LimitDistance_m=0.005)  # -> Points, Element, Info
join = BrepJoin(Breps=flatten(geo))  # -> Breps, Closed
line_3 = LineSDL(Start=linetobeam.Points, Direction=Y, Length=Slider(10, range=0..100))
bcx = BrepCurve(Brep=join.Breps, Curve=line_3)  # -> Curves, Points
pdecon = Deconstruct(Point=linetobeam.Points)  # -> XComponent, YComponent, ZComponent
lng = ListLength(List=bcx.Points)
smaller = SmallerThan(FirstNumber=pdecon.ZComponent, SecondNumber=Slider(0.5, range=0..1))  # -> SmallerThan, OrEqualTo
smaller_2 = SmallerThan(FirstNumber=flatten(lng), SecondNumber=2)  # -> SmallerThan, OrEqualTo
Z_2 = UnitZ(Factor=Slider(-21, range=-100..0))
cull = CullPattern(List=linetobeam.Points, CullPattern=smaller.SmallerThan)
vec = VectorXYZ(XComponent=0, YComponent=Slider(0, range=-100..0), ZComponent=0)  # -> Vector, Length
cull_2 = CullPattern(List=linetobeam.Points, CullPattern=smaller_2.SmallerThan)
supp = SupportKaramba(PosInd=cull, menu=[buttons(on, on, on, on, on, on)])
loads = LoadsKaramba(ForceVector=vec.Vector, Local=True, PosInd=cull_2, LCase=Slider(1, range=0..1), mode="Point")

# ---- group: randomly reduce lines
line_4 = Line(rdlines.OutLine)
lng_2 = ListLength(List=line_4)
multiplication = Multiplication(A=lng_2, B=Slider(0.28, range=0..1))
reduce = RandomReduce(List=line_4, Reduction=multiplication, Seed=Slider(91301, range=0..100000))

# ----
multiplication_2 = Multiplication(A=Z_2, B=Slider(29, range=0..100))

loads_2 = LoadsKaramba(Vector=multiplication_2, LCase=0, mode="Gravity")
assemble = AssembleModelKaramba(Elem=linetobeam.Element, Support=supp, Load=flatten([loads_2, loads]), LimitDistance_m=0.005)  # -> Model, Info, Mass_kg, CenterOfGravity
analyzethi = AnalyzeThIKaramba(Model=assemble.Model)  # -> CalculatedModel, MaximumDisplacement_m, ResultingForceOfGravity_kN, ElasticEnergy_kNm
panel = Panel(analyzethi.MaximumDisplacement_m)
b_res_force = BeamResultantForcesKaramba(AnalyzedModel=analyzethi.CalculatedModel, LoadCase=-1, MaximumProbingDistance_m=-1, NumberOfProbingPointsPerElement=3)  # -> AnalyzedModel, NormalForce_kN, ResultantBendingMoment_kNm, ResultantShearForce_kN
modelview = ModelViewKaramba(Model=analyzethi.CalculatedModel, LoadCaseFactorsForLinearSuperposition=1, IndexIncrementOfVisibleLoadcase=0)  # -> Model, DeformedMesh, DeformedAxes, DeformedModel
beamview = BeamViewKaramba(Model=modelview.Model)  # -> Model, MeshesOfRenderedBeams, DeformedBeamAxes, LegendColors, LegendTags
geo_2 = Geometry(modelview.DeformedAxes)
