# Grasshopper definition KarambaToDynamoBIM_SingleTruss.gh (Grasshopper 0.9.76)
# plug-ins: Karamba

# ----
# Create Truss Geometry
truss_width = Slider(6, range=0..10)
construct_point = ConstructPoint(XCoordinate=0, YCoordinate=0, ZCoordinate=0)
unit_x = UnitX(Factor=truss_width)
move = Move(Geometry=construct_point, Motion=unit_x)  # -> Geometry, Transform
truss_height = Slider(1.1, range=0..5)
line = Line(StartPoint=construct_point, EndPoint=move.Geometry)
unit_z = UnitZ(Factor=truss_height)
move_2 = Move(Geometry=line, Motion=unit_z)  # -> Geometry, Transform
number_of_digonal_webs = Slider(8, range=0..10)
divide_curve = DivideCurve(Curve=[line, move_2.Geometry], Count=number_of_digonal_webs, Kinks=False)  # -> Points, Tangents, Parameters
explode_tree = ExplodeTree(Data=divide_curve.Points)  # -> Branch0, Branch1
list_length = ListLength(List=explode_tree.Branch0)
list_length_2 = ListLength(List=explode_tree.Branch0)
list_length_3 = ListLength(List=explode_tree.Branch0)
list_length_4 = ListLength(List=explode_tree.Branch0)
split_list = SplitList(List=explode_tree.Branch0, Index=expr("((x-1)/2)+1", list_length))  # -> ListA, ListB
split_list_2 = SplitList(List=explode_tree.Branch1, Index=expr("((x-1)/2)+1", list_length_2))  # -> ListA, ListB
split_list_3 = SplitList(List=explode_tree.Branch1, Index=expr("((x-1)/2)", list_length_3))  # -> ListA, ListB
split_list_4 = SplitList(List=explode_tree.Branch0, Index=expr("((x-1)/2)", list_length_4))  # -> ListA, ListB
point = Point(split_list.ListA)
point_2 = Point(split_list_2.ListA)
point_3 = Point(split_list_3.ListB)
point_4 = Point(split_list_4.ListB)
shift_list = ShiftList(List=point, Shift=1, Wrap=False)
shift_list_2 = ShiftList(List=point_3, Shift=1, Wrap=False)
shortest_list = ShortestList(ListListA=shift_list, ListListB=point_2, TrimMode=2)  # -> ListListA, ListListB
shortest_list_2 = ShortestList(ListListA=shift_list_2, ListListB=point_4, TrimMode=2)  # -> ListListA, ListListB

# ---- group: Web_Right
line_2 = Line(StartPoint=shortest_list_2.ListListA, EndPoint=shortest_list_2.ListListB)

# ---- group: Post
line_3 = Line(StartPoint=explode_tree.Branch0, EndPoint=explode_tree.Branch1)

# ---- group: Top & Bottom Chord
shatter = Shatter(Curve=[line, move_2.Geometry], Parameters=divide_curve.Parameters)  # -> flatten(Segments)

# ---- group: Web_Left
line_4 = Line(StartPoint=shortest_list.ListListA, EndPoint=shortest_list.ListListB)

# ----
remove_duplicate_lines_karamba = RemoveDuplicateLinesKaramba(Line=shatter, LimitDistance=0.005)  # -> OutLine, Info, Indexes

# ----
# Load
number_slider = Slider(-1.45, range=-5..0)
unit_z_2 = UnitZ(Factor=number_slider)
unit_z_3 = UnitZ(Factor="-1")
loads_karamba = LoadsKaramba(Vector=unit_z_2, LCase=0, mode="Uniform Line", menu=[buttons(off, on, off)])
loads_karamba_2 = LoadsKaramba(Vector=unit_z_3, LCase=0, mode="Gravity")

# ----
# Support
list_item = ListItem(List=point, Index=0, Wrap=True)
list_item_2 = ListItem(List=reverse(point_4), Index=0, Wrap=True)
support_karamba = SupportKaramba(PosInd=[list_item, list_item_2], menu=[buttons(on, on, on, on, on, on)])

cross_section_selector_karamba = CrossSectionSelectorKaramba(ElementsIdentifiers="Post", NameOrListIndexOfCrossSection="CHSH114.3x3.0")  # -> CrossSection, Info
panel = Panel(cross_section_selector_karamba.CrossSection)

cross_section_selector_karamba_2 = CrossSectionSelectorKaramba(ElementsIdentifiers="Web", NameOrListIndexOfCrossSection="CHSH88.9x6.3")  # -> CrossSection, Info
panel_2 = Panel(cross_section_selector_karamba_2.CrossSection)

number_slider_2 = Slider(33, range=0..100)
cross_section_range_selector_karamba = CrossSectionRangeSelectorKaramba(MaximumHeight_cm=number_slider_2, MaximumWidth_cm=number_slider_2, menu=[dropdown(2), dropdown(2), dropdown(1)])

# ----
# Line To Beam
panel_3 = Panel("Chord")
line_to_beam_karamba = LineToBeamKaramba(Line=remove_duplicate_lines_karamba.OutLine, New=True, Remove=True, LimitDistance_m=0.005, BeamIdentifier=panel_3)  # -> Points, Element, Info
line_to_beam_karamba_2 = LineToBeamKaramba(Line=line_3, New=True, Remove=True, LimitDistance_m=0.005, BeamIdentifier="Post")  # -> Points, Element, Info
line_to_beam_karamba_3 = LineToBeamKaramba(Line=[line_4, line_2], New=True, Remove=True, LimitDistance_m=0.005, BeamIdentifier="Web")  # -> Points, Element, Info

panel_4 = Panel(cross_section_range_selector_karamba)

element_karamba = ElementKaramba(flatten([line_to_beam_karamba.Element, line_to_beam_karamba_2.Element, line_to_beam_karamba_3.Element]))
support_karamba_2 = SupportKaramba(flatten(support_karamba))
load_karamba = LoadKaramba(flatten([loads_karamba, loads_karamba_2]))

# ----
# Truss Height Optimization
galapagos = Galapagos(fitness=number, gene=truss_height)

panel_5 = Panel("Chord")
panel_6 = Panel("Post")
panel_7 = Panel("Web")

# ----
# Cross Section
slider = Slider(9.4, range=0..50)
readcstable = ReadCrossSectionTableFromFileKaramba()  # -> CrossSection, Info
crossecs = CrossSectionsKaramba(
    ElementsIdentifiers="Chord",
    Height_cm=Slider(19, range=0..50),
    UpperFlangeWidth_cm=slider,
    LowerFlangeWidth_cm=slider,
    UpperFlangeThickness_cm=0.4,
    LowerFlangeThickness_cm=0.4,
    SidewallsThickness_cm=0.4,
    FilletRadius_cm=0.6,
    mode="Box")

# ---- group: By default this component uses the cross sections of the default cross section table
crosecrselect = CrossSectionRangeSelectorKaramba(
    MaximumHeight_cm=-1,
    MaximumWidth_cm=-1,
    CrossSection=readcstable.CrossSection,
    menu=[dropdown(2), dropdown(0), dropdown(0)])

# ----
csmatch = CrossSectionMatcherKaramba(MatchCrossSection=crossecs, CrossSections=crosecrselect)  # -> CrossSection, Info
panel_8 = Panel(csmatch.CrossSection)

cross_section_karamba = CrossSectionKaramba(flatten([csmatch.CrossSection, cross_section_selector_karamba.CrossSection, cross_section_selector_karamba_2.CrossSection]))

# ----
# Assemble
assemble_model_karamba = AssembleModelKaramba(
    Elem=element_karamba,
    Support=support_karamba_2,
    Load=load_karamba,
    CrossSection=cross_section_karamba,
    LimitDistance_m=0.005)  # -> Model, Info, Mass_kg, CenterOfGravity

panel_9 = Panel(assemble_model_karamba.Mass_kg)

# ----
# Analyse
number_slider_3 = Slider(3, range=0..10)
analyzethi_karamba = AnalyzeThIKaramba(Model=assemble_model_karamba.Model)  # -> CalculatedModel, MaximumDisplacement_m, ResultingForceOfGravity_kN, ElasticEnergy_kNm
beam_displacements_karamba = BeamDisplacementsKaramba(
    AnalyzedModel=analyzethi_karamba.CalculatedModel,
    LoadCase=-1,
    MaximumDistanceBetweenResults_m=-1,
    NumberOfResultsPerElement=number_slider_3)  # -> AnalyzedModel, simplify(Translations_m), Rotations_rad
panel_10 = Panel(analyzethi_karamba.MaximumDisplacement_m)
panel_11 = Panel(beam_displacements_karamba.Translations_m)

number = Number(analyzethi_karamba.MaximumDisplacement_m)

# ----
# Model - View
model_view_karamba = ModelViewKaramba(Model=analyzethi_karamba.CalculatedModel, LoadCaseFactorsForLinearSuperposition=1, IndexIncrementOfVisibleLoadcase=0)  # -> Model, DeformedMesh, DeformedAxes, DeformedModel
beam_view_karamba = BeamViewKaramba(Model=model_view_karamba.Model)  # -> Model, MeshesOfRenderedBeams, DeformedBeamAxes, LegendColors, LegendTags
