# Dynamo graph KarambaToDynamoBIM_SingleTruss.dyn (Dynamo 0.8.2.2392)

# note: Get Rhino Model
file_path = Filename("C:\Users\Junghwo\Favorites\MyFolder\Work\MyFolder\POINT ONE\working\065_A_Karamba\Drawings\Rhino\VideoTutorial_Examples\Tutorials\CaseStudy\01_Tutorial_1_KarambaToDynmoBIM_SingleTruss\01_Tutorial_1_KarambaToDynmoBIM_SingleTruss.3dm")
fromPath = FileObject(file_path)  # "File.FromPath"
# note: Convert Rhino Geometry to Design Script Geometry
get_RhinoFile = Interoperability.ReadRhino.OpenRhino3dmModel.Get_RhinoFile(fromPath)
get_RhinoLayerNames = Interoperability.ReadRhino.RhinoObject.Get_RhinoLayerNames(get_RhinoFile)
code_block = CodeBlock { 1; 2; 3; }
getItemAtIndex = List.GetItemAtIndex(list=get_RhinoLayerNames, index=code_block.out0)
# note: Specify Rhino Layer
get_RhinoObjectsByLayer = Interoperability.ReadRhino.RhinoObject.Get_RhinoObjectsByLayer(get_RhinoFile, getItemAtIndex)
rhino_LinesToDS = Interoperability.ReadRhino.RhinoTranslationToDS.Rhino_LinesToDS(get_RhinoObjectsByLayer)
explode = Geometry.Explode(rhino_LinesToDS)
levels = Levels("Level 1")
structural_framing_types = StructuralFramingTypes("RHSC 200x100x4")
# note: Create Structural Element in Revit
beamByCurve = StructuralFraming.BeamByCurve(explode, levels, structural_framing_types)
getItemAtIndex_2 = List.GetItemAtIndex(list=get_RhinoLayerNames, index=code_block.out2)
get_RhinoObjectsByLayer_2 = Interoperability.ReadRhino.RhinoObject.Get_RhinoObjectsByLayer(get_RhinoFile, getItemAtIndex_2)
rhino_LinesToDS_2 = Interoperability.ReadRhino.RhinoTranslationToDS.Rhino_LinesToDS(get_RhinoObjectsByLayer_2)
structural_framing_types_2 = StructuralFramingTypes("CHS 88.9x6.3")
beamByCurve_2 = StructuralFraming.BeamByCurve(rhino_LinesToDS_2, levels, structural_framing_types_2)
getItemAtIndex_3 = List.GetItemAtIndex(list=get_RhinoLayerNames, index=code_block.out1)
get_RhinoObjectsByLayer_3 = Interoperability.ReadRhino.RhinoObject.Get_RhinoObjectsByLayer(get_RhinoFile, getItemAtIndex_3)
rhino_LinesToDS_3 = Interoperability.ReadRhino.RhinoTranslationToDS.Rhino_LinesToDS(get_RhinoObjectsByLayer_3)
structural_framing_types_3 = StructuralFramingTypes("CHS 114.3x3")
beamByCurve_3 = StructuralFraming.BeamByCurve(rhino_LinesToDS_3, levels, structural_framing_types_3)
get_DocumentObjects = Interoperability.ReadRhino.RhinoObject.Get_DocumentObjects(get_RhinoFile)
