# Grasshopper definition KarambaToGGymToRevit.gh (Grasshopper 0.9.76)
# plug-ins: Karamba, ggGHKarambaGHA

# ----
# Requires ggRhinoIFC from http://www.geometrygym.com/downloads
# Assumes rhino documents have millimetre units
# Notes
# + You can use any units you like, but you need to scale the dimensions appropriately.
# + Recommended to change Grasshopper Display setting to "Draw Full Names" on Display Menu
# New Features to Implement (coming soon)
# + Ability to Export from Revit a Template with materials and families to use in Grasshopper
# Export Model From Grasshopper
# Double Click on ggRvt BakeToFile
# to export out to the IFC file.
# You should then use the Geometry
# Gym Revit plugin to import the IFC
# file into an open Revit Project
ggrvt_baketofile = GgRvtBaketoFile(Accurate=True, IFC4=True, Radians=True, RepMapExport="NONE")

# ----
# Attributes input is reserved for future
# improvements such as setting physical
# attributes of the material.
panel = Panel("S355JR")
ggrvt_material = GgRvtMaterial(Name=panel, Description="Steel", Class=8)

# ----
# Create Revit Material
# Right click on inputs such as Class
# for selection inputs
panel_2 = Panel("Concrete")
# If names for families and materials are
# set to be consistent with those loaded in
# the revit project at time of import, the
# existing attributes will be used.  The
# import plugin will create them if not, and
# they can be manually changed at a later date.
ggrvt_material_2 = GgRvtMaterial(Name=panel_2, Class=1)

# ----
# Generate a Material Layer
boolean_toggle = BooleanToggle(True)
ggrvt_materiallayer = GgRvtMaterialLayer(RvtMaterial=ggrvt_material_2, Thickness="0.2", Function=0, Wraps=boolean_toggle, Structural=Toggle(True), Variable=False)

# ----
# Create Revit Levels
panel_3 = Panel("""Basement
Ground Floor
Level 1""")
series = Series(Start=-2.7, Step=3.25, Count=3)
ggrvt_level = GgRvtLevel(
    Name=panel_3,
    Elevation=series,
    ComputationHeight=0,
    Structural=True,
    BuildingStory=True,
    ggIFC_ggIds="322184b7-b8bb-434b-8443-bd07b3581673;1G8gGmh_55bgoN6KzdEoVu;3CxyKuxLXEAeoNkBCFvIqJ;1xTKLrHv92EeI8NBg2yMyk")

unit_z = UnitZ(Factor=Slider(3, range=0..10))

# ----
# Create Revit Grids
series_2 = Series(Start=0, Step=5, Count=7)
series_3 = Series(Start=0, Step=5, Count=7)
construct_point = ConstructPoint(XCoordinate=series_2, YCoordinate="-1", ZCoordinate=0)
construct_point_2 = ConstructPoint(XCoordinate="-1", YCoordinate=series_3, ZCoordinate=0)
line_sdl = LineSDL(Start=construct_point_2, Direction=Vector(1, 0, 0), Length="35")
line_sdl_2 = LineSDL(Start=construct_point, Direction=Vector(0, 1, 0), Length="35")
list_length = ListLength(List=line_sdl)
list_length_2 = ListLength(List=line_sdl_2)
series_4 = Series(Start=1, Step=1, Count=list_length)
sequence = Sequence(Count=list_length_2, CharPool="ABCDEFGHIJKLMNOPQRSTUVWXYZ", Format="{0}")
integer = Integer(series_4)
ggifc_grid = GgIFCGrid(GridName=integer, Curve=line_sdl)
ggifc_grid_2 = GgIFCGrid(GridName=sequence, Curve=line_sdl_2, ggIFC_ggIds="4c3c1263-2152-429d-9fdd-b3a73ee943ad;3oHQefJkz8SOAqDbRJl0VN")

plane_surface = PlaneSurface(Plane=PlaneXY(0, 0, 0), XSize=Slider(10, range=0..10), YSize=Slider(5, range=0..10))
move = Move(Geometry=plane_surface, Motion=unit_z)  # -> Geometry, Transform
brep_edges = BrepEdges(Brep=move.Geometry)  # -> Naked, Interior, NonManifold
join_curves = JoinCurves(Curves=brep_edges.Naked, Preserve=False)
unit_z_2 = UnitZ(Factor="-0.2")
move_2 = Move(Geometry=join_curves, Motion=unit_z_2)  # -> Geometry, Transform

# ----
# Create Revit Floor
boolean_toggle_2 = BooleanToggle(False)
ggrvt_floor_type = GgRvtFloorFamily(
    Name="CompositeFloor",
    LayersCore=ggrvt_materiallayer,
    Interior=boolean_toggle_2,
    ggIFC_ggIds="050c6069-7f50-4b33-9917-911cb2b4d62a;2YN6LfoBf3jRCBwKuVtDSo")
ggrvt_floor = GgRvtFloor(
    RvtFloorFamily=ggrvt_floor_type,
    PlanarSlabPerimeterCurveOrFace=join_curves,
    Mark="Floor_A",
    ggIFC_ggIds="526f3a09-36af-48ac-99e0-116d33d78baf;0LounOREn9$9W8yDxf0qwB")

unit_z_3 = UnitZ(Factor=1)
reverse = Reverse(Vector=unit_z_3)

# ----
# Generate a Material Layer
boolean_toggle_3 = BooleanToggle(True)
ggrvt_materiallayer_2 = GgRvtMaterialLayer(
    RvtMaterial=ggrvt_material_2,
    Thickness="0.4",
    Function=0,
    Wraps=boolean_toggle_3,
    Structural=Toggle(True),
    Variable=False)

unit_z_4 = UnitZ(Factor=1)
number_slider = Slider(30, range=0..100)
number_slider_2 = Slider(30, range=0..100)
unit_z_5 = UnitZ(Factor="1.5")
unit_z_6 = UnitZ(Factor="-1.5")
cross_sections_karamba = CrossSectionsKaramba(ElementsIdentifiers="Floor", Heights_cm=Slider(20, range=0..100), mode="Shell")
cross_sections_karamba_2 = CrossSectionsKaramba(
    ElementsIdentifiers="Beams",
    Height_cm=Slider(40, range=0..100),
    UpperFlangeWidth_cm=number_slider,
    LowerFlangeWidth_cm=number_slider,
    mode="Trapezoid")
cross_sections_karamba_3 = CrossSectionsKaramba(
    ElementsIdentifiers="Columns",
    Height_cm=number_slider_2,
    UpperFlangeWidth_cm=number_slider_2,
    LowerFlangeWidth_cm=number_slider_2,
    mode="Trapezoid")
material_selection_karamba = MaterialSelectionKaramba(menu=[dropdown(2), dropdown(5)])
loads_karamba = LoadsKaramba(Vector=unit_z_6, LCase="0", mode="Gravity")

# ---- group: this gives all cross section the right eccentricity
disassemble = DisassembleCrossSectionKaramba(CroSec=cross_sections_karamba_2)  # -> CrossSection, TypeNameOfCrossSection, FamilyNameOfCrossSection, ElemIds, LocalEccentricity_cm, Heights_cm, PositionOfCenterOfGravity_cm, PositionOfCenterOfShear_cm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
neg = Negative(Value=disassemble.PositionOfCenterOfGravity_cm)
Z = UnitZ(Factor=neg)

# ---- group: this gives all cross section the right eccentricity / Eccentricities can be defined per cross section
eccent_crosec = EccentricityOnCrossSectionKaramba(CrossSection=disassemble.CrossSection, LocalEccentricity_cm=Z)  # -> flatten(CrossSection)

# ----
cross_section_karamba = CrossSectionKaramba(flatten([cross_sections_karamba_3, cross_sections_karamba, eccent_crosec]))
panel_4 = Panel("C:\Users\Junghwo\Favorites\MyFolder\Work\MyFolder\POINT ONE\Software Training\Grasshopper\Plugins_Tutorials\geometry gym examples\GeometryGymGrasshopperToRevit\GeometryGymGrasshopperToRevit.ifc")

# ----
# Create Revit Structrural Framing
number_slider_3 = Slider(0.4, range=0..1)
number_slider_4 = Slider(0.3, range=0..1)
ggrvt_rectangle_profile = GgRvtRectangleProfile(Depth=number_slider_3, Width=number_slider_4, Wall=0, OuterFillet=0, InnerFillet=0)
ggrvt_framing_family = GgRvtFramingFamily(
    Name="ConcreteBeam 40 x 30",
    RvtProfile=ggrvt_rectangle_profile,
    RvtMaterial=ggrvt_material,
    ggIFC_ggIds="034462a9-53ac-43e3-8636-fe2e6ab99a8c;1R1Ef0GRD1Iw5$kk7Qom$n")

division = Division(A=number_slider_4, B=Slider(2, range=0..10))
offset = Offset(Curve=move_2.Geometry, Distance=expr("-x", division), Plane=PlaneXY(0, 0, 0), Corners=1)
explode = Explode(Curve=offset, Recursive=True)  # -> Segments, Vertices
point_on_curve = PointOnCurve(explode.Segments, parameter=0.5)

ggrvt_framing = GgRvtFraming(
    Usage=0,
    RvtFramingType=ggrvt_framing_family,
    Mark="Beam_A",
    Axis=explode.Segments,
    Justification=7,
    RvtMaterial=ggrvt_material,
    ggIFC_ggIds="b6e5ef3b-1f7f-4da8-bbbd-6a332f18a263;0xXHUXvZD4N9WGz3AR4F3Y;16BR9p1ML2NR_Wf3SxU_8v;3JS1pgJ_51M8Cgv3m$SehQ;1MQNNxpc5BqvbOOiJn1m$2")

list_item = ListItem(List=point_on_curve, Index="0", Wrap=True)
list_item_2 = ListItem(List=point_on_curve, Index="2", Wrap=True)
line = Line(StartPoint=list_item, EndPoint=list_item_2)
line_sdl_3 = LineSDL(Start=explode.Vertices, Direction=reverse, Length=Slider(2.8, range=0..10))

# ----
# Create Revit Column
number_slider_5 = Slider(0.3, range=0..1)
ggrvt_rectangle_profile_2 = GgRvtRectangleProfile(Depth=number_slider_5, Width=Slider(0.3, range=0..1), Wall=0, OuterFillet=0, InnerFillet=0)
ggrvt_column_family = GgRvtColumnFamily(
    Name="ConcreteColumn 30 x 30",
    RvtProfile=ggrvt_rectangle_profile_2,
    RvtMaterial=ggrvt_material_2,
    Mark="Column_A",
    Structural=Toggle(True),
    ggIFC_ggIds="6e765eec-a2f0-4bb4-89fd-2cba1e23ef78;2QDlo2jhP9DBbERN1uG4Xd")
ggrvt_column = GgRvtColumn(
    RvtColumnType=ggrvt_column_family,
    Mark="Column_A",
    Axis=line_sdl_3,
    RvtMaterial=ggrvt_material_2,
    ggIFC_ggIds="e714239b-c4a7-4f26-9d1c-99a49addcffb;1GMp58e05BNv03qj0tvaDp;1qFcvRF1zA2Bi1Takg0bYh;1elLam0u52rvahd8IklShg;1OWErXKH57LhDUV0HGIOcM;0Jr6JYqRD6PO$q_RMZtYtL")

boundary_surfaces = BoundarySurfaces(Edges=explode.Segments)

# ----
# Create Revit Wall
boolean_toggle_4 = BooleanToggle(False)
ggrvt_wall_family = GgRvtWallFamily(
    Name="ConcreteWall",
    LayersCore=ggrvt_materiallayer_2,
    Interior=boolean_toggle_4,
    Mark="Wall_A",
    ggIFC_ggIds="cebfb9da-b196-4f4c-8714-7cf9c6dd040c;3mJr17APX6Re2$H0H7iA1A")
number_slider_6 = Slider(-2.8, range=-10..10)
ggrvt_wall = GgRvtWall(
    RvtWallType=ggrvt_wall_family,
    Offset=Slider(0.2, range=0..1),
    PositiveDirection=Toggle(False),
    PathOrPerimeter=line,
    WallHeight=number_slider_6,
    ggIFC_ggIds="63220d03-1c9f-47f0-bfa4-f9f6ae7bf03b;1vtRWEby56MOh6Q3zuwkMl")

unit_z_7 = UnitZ(Factor=number_slider_6)
extrude = Extrude(Base=line, Direction=unit_z_7)
move_3 = Move(Geometry=boundary_surfaces, Motion=unit_z_4)  # -> Geometry, Transform
area = Area(Geometry=move_3.Geometry)  # -> Area, Centroid

# ----
# Analytical Model
colour_swatch = ColourSwatch(SwatchColor=RGB(31, 233, 255))
custom_preview = CustomPreview(Geometry=[extrude, boundary_surfaces, line_sdl_3, explode.Segments], Shader=colour_swatch)

scale = Scale(Geometry=move_3.Geometry, Center=area.Centroid, Factor=Slider(2, range=0..10))  # -> Geometry, Transform
mesh_surface = MeshSurface(Surface=scale.Geometry, UCount=Slider(15, range=0..100), VCount=Slider(15, range=0..100), Overhang=True, Equalize=False)
mesh_surface_2 = MeshSurface(
    Surface=boundary_surfaces,
    UCount=Slider(15, range=0..100),
    VCount=Slider(15, range=0..100),
    Overhang=True,
    Equalize=False)

# ---- group: Beams
curve = Curve(explode.Segments)

# ---- group: Columns
curve_2 = Curve(line_sdl_3)

# ----
mesh_join = MeshJoin(Meshes=mesh_surface_2)
end_points = EndPoints(Curve=curve_2)  # -> Start, End
line_to_beam_karamba = LineToBeamKaramba(Line=curve_2, New=True, Remove=True, LimitDistance_m=0.005, BeamIdentifier="Columns")  # -> Points, Element, Info
line_to_beam_karamba_2 = LineToBeamKaramba(Line=curve, New=True, Remove=True, LimitDistance_m=0.005, BeamIdentifier="Beams")  # -> Points, Element, Info
support_karamba = SupportKaramba(PosInd=end_points.End, menu=[buttons(on, on, on, on, on, on)])
loads_karamba_2 = LoadsKaramba(Vector=unit_z_5, Mesh=mesh_surface, LCase="1", mode="Mesh Load", menu=[buttons(on, off, off), buttons(on, on)])
mesh_to_shell_karamba = MeshToShellKaramba(Mesh=mesh_join, LDist=0.005, Identifier="Floor")  # -> Point, Element, Info
support_karamba_2 = SupportKaramba(flatten(support_karamba))
load_karamba = LoadKaramba(flatten([loads_karamba_2, loads_karamba]))
element_karamba = ElementKaramba(flatten([mesh_to_shell_karamba.Element, line_to_beam_karamba.Element, line_to_beam_karamba_2.Element]))
assemble_model_karamba = AssembleModelKaramba(
    Elem=element_karamba,
    Support=support_karamba_2,
    Load=load_karamba,
    CrossSection=cross_section_karamba,
    Material=material_selection_karamba,
    LimitDistance_m=0.005)  # -> Model, Info, Mass_kg, CenterOfGravity
analyzethi_karamba = AnalyzeThIKaramba(Model=assemble_model_karamba.Model)  # -> CalculatedModel, MaximumDisplacement_m, ResultingForceOfGravity_kN, ElasticEnergy_kNm
model_view_karamba = ModelViewKaramba(Model=analyzethi_karamba.CalculatedModel, LoadCaseFactorsForLinearSuperposition=1, IndexIncrementOfVisibleLoadcase=0)  # -> Model, DeformedMesh, DeformedAxes, DeformedModel
ggkarambaexport = GgKarambaExport(Enabled=Toggle(True), Model=analyzethi_karamba.CalculatedModel, IFC4=True, FilePath=panel_4, Zip=False, Compliant=True)
panel_5 = Panel(ggkarambaexport)
shell_view_karamba = ShellViewKaramba(Model=model_view_karamba.Model)  # -> Model, MeshesOfRenderedShells, LegendColors, LegendTags
beam_view_karamba = BeamViewKaramba(Model=model_view_karamba.Model)  # -> Model, MeshesOfRenderedBeams, DeformedBeamAxes, LegendColors, LegendTags
