# Grasshopper definition Karamba+GGym_IrregularStructure.gh (Grasshopper 0.9.76)
# plug-ins: Karamba, ggGHKarambaGHA

domain_box = DomainBox(Base=PlaneXY(0, 0, 0), X=Slider(10, range=0..10), Y=Slider(6, range=0..10), Z=Slider(5, range=0..10))
populate_3d = Populate3D(Region=domain_box, Count=100, Seed=Slider(77, range=0..100))
remove_duplicate_points_karamba = RemoveDuplicatePointsKaramba(Point=populate_3d, LimitDistance=0.005)  # -> OutPoint, Info, Indexes
nearest_neighbors_karamba = NearestNeighborsKaramba(
    FromPoints=remove_duplicate_points_karamba.OutPoint,
    ToPoints=remove_duplicate_points_karamba.OutPoint,
    NumberOfNeighbors=Slider(4, range=0..10),
    LimitDistance=-1)  # -> flatten(Line), Connectivity, Points
deconstruct = Deconstruct(Point=nearest_neighbors_karamba.Points)  # -> XComponent, YComponent, ZComponent
smaller_than = SmallerThan(FirstNumber=deconstruct.ZComponent, SecondNumber=Slider(0.1, range=0..0.1))  # -> SmallerThan, OrEqualTo
dispatch = Dispatch(List=nearest_neighbors_karamba.Points, DispatchPattern=smaller_than.SmallerThan)  # -> ListA, ListB
point = Point(dispatch.ListA)
remove_duplicate_points_karamba_2 = RemoveDuplicatePointsKaramba(Point=point, LimitDistance=0.005)  # -> OutPoint, Info, Indexes
unit_z = UnitZ(Factor="-1")
unit_z_2 = UnitZ(Factor="-1")
line_to_beam_karamba = LineToBeamKaramba(Line=flatten(nearest_neighbors_karamba.Line), New=True, Remove=True, LimitDistance_m=0.005)  # -> Points, Element, Info
support_karamba = SupportKaramba(PosInd=remove_duplicate_points_karamba_2.OutPoint, menu=[buttons(on, on, on, on, on, on)])
loads_karamba = LoadsKaramba(Vector=unit_z, LCase="1", mode="Uniform Line", menu=[buttons(off, on, off)])
loads_karamba_2 = LoadsKaramba(Vector=unit_z_2, LCase="0", mode="Gravity")
cross_section_range_selector_karamba = CrossSectionRangeSelectorKaramba(MaximumHeight_cm=-1, MaximumWidth_cm=-1, menu=[dropdown(2), dropdown(3), dropdown(1)])
list_item = ListItem(List=cross_section_range_selector_karamba, Index=0, Wrap=True)
assemble_model_karamba = AssembleModelKaramba(
    Elem=line_to_beam_karamba.Element,
    Support=support_karamba,
    Load=[loads_karamba_2, loads_karamba],
    CrossSection=list_item,
    LimitDistance_m=0.005)  # -> Model, Info, Mass_kg, CenterOfGravity
optimize_cross_section_karamba = OptimizeCrossSectionKaramba(
    Model=assemble_model_karamba.Model,
    CrossSections=flatten(cross_section_range_selector_karamba),
    MaximumUtilization=1,
    MaximumDisplacement_m=-1,
    UltimateLimitStateIterations=Slider(100, range=0..100),
    DisplacementIterations=5,
    NumberOfSamplePoints=3,
    ElasticDesign=True,
    GammaM0=1,
    GammaM1=1)  # -> ModelWithOptimizedCrossSections, Info, Mass_kg, MaximumDisplacement_m, ElasticEnergy_kNm
analyzethi_karamba = AnalyzeThIKaramba(Model=optimize_cross_section_karamba.ModelWithOptimizedCrossSections)  # -> CalculatedModel, MaximumDisplacement_m, ResultingForceOfGravity_kN, ElasticEnergy_kNm
model_view_karamba = ModelViewKaramba(Model=analyzethi_karamba.CalculatedModel, LoadCaseFactorsForLinearSuperposition=1, IndexIncrementOfVisibleLoadcase=0)  # -> Model, DeformedMesh, DeformedAxes, DeformedModel
beam_view_karamba = BeamViewKaramba(Model=model_view_karamba.Model)  # -> Model, MeshesOfRenderedBeams, DeformedBeamAxes, LegendColors, LegendTags
panel = Panel("C:\Users\Junghwo\Favorites\MyFolder\Work\MyFolder\POINT ONE\working\065_A_Karamba\Drawings\Rhino\VideoTutorial_Examples\Tutorials\CaseStudy\03_Tutorial_3_Karamba+GGym_IrregularStructure\03_Tutorial_3_Karamba+GGym_IrregularStructure.ifc")
panel_2 = Panel(beam_view_karamba.Model)
ggkarambaexport = GgKarambaExport(Enabled=Toggle(True), Model=beam_view_karamba.Model, IFC4=True, FilePath=panel, Zip=False, Compliant=True)
panel_3 = Panel(ggkarambaexport)
