# Dynamo graph RevitToKaramba.dyn (Dynamo 0.8.2.2392)

code_block = CodeBlock { 0; 10; }
structure_length = DoubleSlider(1, range=1..10 step 0.1)
number_sequence = NumberSeq(code_block.out0, code_block.out1, structure_length, lacing=Longest)
gutter_level = DoubleSlider(3, range=1..10 step 1)

# group: 1
byCartesianCoordinates = Point.ByCartesianCoordinates(arg1=number_sequence, arg3=gutter_level)

YAxis = Vector.YAxis()
structure_width = DoubleSlider(6, range=1..10 step 1)

# group: 3
translate = Geometry.Translate(geometry=byCartesianCoordinates, direction=YAxis, distance=structure_width)

byStartPointEndPoint = Line.ByStartPointEndPoint(startPoint=byCartesianCoordinates, endPoint=translate)
code_block_2 = CodeBlock { 0.5; }
pointAtParameter = Curve.PointAtParameter(curve=byStartPointEndPoint, param=code_block_2)
ZAxis = Vector.ZAxis()
roof_ridge_height = DoubleSlider(2, range=1..10 step 1)

# group: 2
translate_2 = Geometry.Translate(geometry=pointAtParameter, direction=ZAxis, distance=roof_ridge_height)

byPoints = PolyCurve.ByPoints(points=translate_2)

# group: Roof Ridge Beam
explode = Geometry.Explode(byPoints)

byPoints_2 = PolyCurve.ByPoints(points=byCartesianCoordinates)
byPoints_3 = PolyCurve.ByPoints(points=translate)

# group: Rafter Beam
explode_2 = Geometry.Explode(byPoints_2)
explode_3 = Geometry.Explode(byPoints_3)

code_block_3 = CodeBlock { 3; 1; }
takeEveryNthItem = List.TakeEveryNthItem(byCartesianCoordinates, code_block_3.out0, code_block_3.out1)
code_block_4 = CodeBlock { 3; 1; }
takeEveryNthItem_2 = List.TakeEveryNthItem(translate, code_block_4.out0, code_block_4.out1)
create = List.Create(takeEveryNthItem, takeEveryNthItem_2)
ZAxis_2 = Vector.ZAxis()
code_block_5 = CodeBlock { -1; }
mul = gutter_level * code_block_5

# group: Column
byStartPointDirectionLength = Line.ByStartPointDirectionLength(startPoint=create, direction=ZAxis_2, length=mul)

create_2 = List.Create(byCartesianCoordinates, translate_2, translate)
transpose = List.Transpose(create_2)
byPoints_4 = PolyCurve.ByPoints(points=transpose)
code_block_6 = CodeBlock { 0.25; 0.75; }
parameterSplit = Curve.ParameterSplit(byPoints_4, code_block_6.out0)
parameterSplit_2 = Curve.ParameterSplit(byPoints_4, code_block_6.out1)
create_3 = List.Create(parameterSplit, parameterSplit_2)

# group: Top Chord
flatten = Flatten(create_3)

explode_4 = Geometry.Explode(flatten)
code_block_7 = CodeBlock { 1; }
flatten_2 = List.Flatten(list=explode_4, amt=code_block_7)
sort = List.Sort(flatten_2)
length = Curve.Length(sort)
code_block_8 = CodeBlock { 1.803; }
gt = length > code_block_8
filterByBoolMask = List.FilterByBoolMask(list=sort, mask=gt)
pointAtParameter_2 = Curve.PointAtParameter(curve=byPoints_4, param=code_block_6.out0)
byStartPointEndPoint_2 = Line.ByStartPointEndPoint(startPoint=pointAtParameter, endPoint=pointAtParameter_2)
pointAtParameter_3 = Curve.PointAtParameter(curve=byPoints_4, param=code_block_6.out1)
byStartPointEndPoint_3 = Line.ByStartPointEndPoint(startPoint=pointAtParameter, endPoint=pointAtParameter_3)

# group: Web
join = List.Join(byStartPointEndPoint_2, byStartPointEndPoint_3)

# group: Post
byStartPointEndPoint_4 = Line.ByStartPointEndPoint(startPoint=pointAtParameter, endPoint=translate_2)

parameterSplit_3 = Curve.ParameterSplit(byStartPointEndPoint, code_block_2)

# group: Bottom Chord
flatten_3 = Flatten(parameterSplit_3)

create_4 = List.Create(explode, explode_2, explode_3, byStartPointDirectionLength, filterByBoolMask.out, join, byStartPointEndPoint_4, flatten_3)
flatten_4 = Flatten(create_4)

# group: Dynamo To Karamba
byCurve = ModelCurve.ByCurve(flatten_4)

create_5 = List.Create(explode_2, explode_3)
levels = Levels("Level 1")
structural_framing_types = StructuralFramingTypes("SHSH 120x120x6.3")

# group: Rafter Beam
beamByCurve = StructuralFraming.BeamByCurve(create_5, levels, structural_framing_types)

structural_framing_types_2 = StructuralFramingTypes("SHSH 25x25x3")

# group: Web
braceByCurve = StructuralFraming.BraceByCurve(join, levels, structural_framing_types_2)

structural_framing_types_3 = StructuralFramingTypes("SHSH 60x60x5")

# group: Roof Ridge Beam
beamByCurve_2 = StructuralFraming.BeamByCurve(explode, levels, structural_framing_types_3)

reverse = Curve.Reverse(byStartPointDirectionLength)
levels_2 = Levels("Ground Floor")
structural_column_types = StructuralColumnTypes("SHSH 120x120x10")

# group: Column
columnByCurve = StructuralFraming.ColumnByCurve(reverse, levels_2, structural_column_types)

structural_framing_types_4 = StructuralFramingTypes("SHSH 25x25x2.5")

# group: Post
beamByCurve_3 = StructuralFraming.BeamByCurve(byStartPointEndPoint_4, levels, structural_framing_types_4)

structural_framing_types_5 = StructuralFramingTypes("SHSH 70x70x6")

# group: Bottom Chord
beamByCurve_4 = StructuralFraming.BeamByCurve(flatten_3, levels, structural_framing_types_5)

structural_framing_types_6 = StructuralFramingTypes("SHSH 60x60x8")

# group: Top Chord
beamByCurve_5 = StructuralFraming.BeamByCurve(filterByBoolMask.out, levels, structural_framing_types_6)
