# Grasshopper definition RevitToKaramba.gh (Grasshopper 0.9.76)
# plug-ins: Karamba

geometry_pipeline = GeometryPipeline(
    GroupByLayer=False,
    GroupByType=False,
    IncludeHidden=True,
    IncludeLocked=True,
    LayerFilter="Roof Ridge Beam",
    NameFilter="*",
    TypeFilter=4)
geometry_pipeline_2 = GeometryPipeline(
    GroupByLayer=False,
    GroupByType=False,
    IncludeHidden=True,
    IncludeLocked=True,
    LayerFilter="Rafter Beam",
    NameFilter="*",
    TypeFilter=4)
geometry_pipeline_3 = GeometryPipeline(
    GroupByLayer=False,
    GroupByType=False,
    IncludeHidden=True,
    IncludeLocked=True,
    LayerFilter="Column",
    NameFilter="*",
    TypeFilter=4)
geometry_pipeline_4 = GeometryPipeline(
    GroupByLayer=False,
    GroupByType=False,
    IncludeHidden=True,
    IncludeLocked=True,
    LayerFilter="Web",
    NameFilter="*",
    TypeFilter=4)
geometry_pipeline_5 = GeometryPipeline(
    GroupByLayer=False,
    GroupByType=False,
    IncludeHidden=True,
    IncludeLocked=True,
    LayerFilter="Post",
    NameFilter="*",
    TypeFilter=4)
geometry_pipeline_6 = GeometryPipeline(
    GroupByLayer=False,
    GroupByType=False,
    IncludeHidden=True,
    IncludeLocked=True,
    LayerFilter="Top Chord",
    NameFilter="*",
    TypeFilter=4)
geometry_pipeline_7 = GeometryPipeline(
    GroupByLayer=False,
    GroupByType=False,
    IncludeHidden=True,
    IncludeLocked=True,
    LayerFilter="Bottom Chord",
    NameFilter="*",
    TypeFilter=4)
line_to_beam_karamba = LineToBeamKaramba(Line=geometry_pipeline, New=True, Remove=True, LimitDistance_m=0.005, BeamIdentifier="Roof Ridge Beam")  # -> Points, Element, Info
line_to_beam_karamba_2 = LineToBeamKaramba(Line=geometry_pipeline_2, New=True, Remove=True, LimitDistance_m=0.005, BeamIdentifier="Rafter Beam")  # -> Points, Element, Info
line_to_beam_karamba_3 = LineToBeamKaramba(Line=geometry_pipeline_3, New=True, Remove=True, LimitDistance_m=0.005, BeamIdentifier="Column")  # -> Points, Element, Info
line_to_beam_karamba_4 = LineToBeamKaramba(Line=geometry_pipeline_4, New=True, Remove=True, LimitDistance_m=0.005, BeamIdentifier="Web")  # -> Points, Element, Info
line_to_beam_karamba_5 = LineToBeamKaramba(Line=geometry_pipeline_5, New=True, Remove=True, LimitDistance_m=0.005, BeamIdentifier="Post")  # -> Points, Element, Info
line_to_beam_karamba_6 = LineToBeamKaramba(Line=geometry_pipeline_6, New=True, Remove=True, LimitDistance_m=0.005, BeamIdentifier="Top Chord")  # -> Points, Element, Info
line_to_beam_karamba_7 = LineToBeamKaramba(Line=geometry_pipeline_7, New=True, Remove=True, LimitDistance_m=0.005, BeamIdentifier="Bottom Chord")  # -> Points, Element, Info
number_slider = Slider(7, range=0..100)
construct_domain = ConstructDomain(DomainStart=expr("-x", number_slider), DomainEnd=number_slider)
yz_plane = YZPlane(Origin=Point(0, 0, 0))
construct_domain_2 = ConstructDomain(DomainStart=expr("-x", number_slider), DomainEnd=number_slider)
deconstruct = Deconstruct(Point=line_to_beam_karamba_3.Points)  # -> XComponent, YComponent, ZComponent
rectangle = Rectangle(Plane=yz_plane, XSize=construct_domain, YSize=construct_domain_2, Radius=0)  # -> Rectangle, Length
smaller_than = SmallerThan(FirstNumber=deconstruct.ZComponent, SecondNumber=Slider(0.001, range=0..0.001))  # -> SmallerThan, OrEqualTo
boundary_surfaces = BoundarySurfaces(Edges=rectangle.Rectangle)
cull_pattern = CullPattern(List=line_to_beam_karamba_3.Points, CullPattern=smaller_than.SmallerThan)
unit_x = UnitX(Factor=Slider(1, range=1..3))
mesh_breps = MeshBreps(
    Brep=boundary_surfaces,
    MeshResolution=Slider(0.64, range=0.01..1),
    EdgeRefinementFactor=0.67,
    PointReduction=False,
    SmoothingStepSize=0,
    SmoothingIterations=5)  # -> Mesh, Info
unit_z = UnitZ(Factor="-1")
unit_z_2 = UnitZ(Factor="-1")
support_karamba = SupportKaramba(PosInd=cull_pattern, menu=[buttons(on, on, on, on, on, on)])
loads_karamba = LoadsKaramba(Vector=unit_x, Mesh=mesh_breps.Mesh, LCase="1", mode="Mesh Load", menu=[buttons(off, on, off), buttons(on, on)])
loads_karamba_2 = LoadsKaramba(Vector=unit_z, LCase="0", mode="Gravity")
loads_karamba_3 = LoadsKaramba(Vector=unit_z_2, LCase="2", mode="Uniform Line", menu=[buttons(off, on, off)])
cross_section_range_selector_karamba = CrossSectionRangeSelectorKaramba(MaximumHeight_cm=-1, MaximumWidth_cm=-1, menu=[dropdown(2), dropdown(3), dropdown(1)])
list_item = ListItem(List=cross_section_range_selector_karamba, Index=0, Wrap=True)
element_karamba = ElementKaramba(flatten([line_to_beam_karamba_2.Element, line_to_beam_karamba.Element, line_to_beam_karamba_3.Element, line_to_beam_karamba_4.Element, line_to_beam_karamba_5.Element, line_to_beam_karamba_6.Element, line_to_beam_karamba_7.Element]))
load_karamba = LoadKaramba(flatten([loads_karamba_2, loads_karamba, loads_karamba_3]))
assemble_model_karamba = AssembleModelKaramba(Elem=element_karamba, Support=support_karamba, Load=load_karamba, CrossSection=list_item, LimitDistance_m=0.005)  # -> Model, Info, Mass_kg, CenterOfGravity
optimize_cross_section_karamba = OptimizeCrossSectionKaramba(
    Model=assemble_model_karamba.Model,
    GroupIdentifiers=["Roof Ridge Beam", "Rafter Beam", "Column", "Top Chord", "Bottom Chord", "Web", "Post"],
    CrossSections=cross_section_range_selector_karamba,
    MaximumUtilization=1,
    MaximumDisplacement_m=-1,
    UltimateLimitStateIterations=Slider(5, range=0..10),
    DisplacementIterations=5,
    NumberOfSamplePoints=3,
    ElasticDesign=True,
    GammaM0=1,
    GammaM1=1)  # -> ModelWithOptimizedCrossSections, Info, Mass_kg, MaximumDisplacement_m, ElasticEnergy_kNm
analyzethi_karamba = AnalyzeThIKaramba(Model=optimize_cross_section_karamba.ModelWithOptimizedCrossSections)  # -> CalculatedModel, MaximumDisplacement_m, ResultingForceOfGravity_kN, ElasticEnergy_kNm
model_view_karamba = ModelViewKaramba(Model=analyzethi_karamba.CalculatedModel, LoadCaseFactorsForLinearSuperposition=1, IndexIncrementOfVisibleLoadcase=0)  # -> Model, DeformedMesh, DeformedAxes, DeformedModel
beam_view_karamba = BeamViewKaramba(Model=model_view_karamba.Model)  # -> Model, MeshesOfRenderedBeams, DeformedBeamAxes, LegendColors, LegendTags
legend = Legend(
    Colour=beam_view_karamba.LegendColors,
    Tags=beam_view_karamba.LegendTags,
    Rectangle={Plane=PlaneXY(10.61493272, -0.07331689276, 0), Size=Domain2(u=0..2.683323215, v=0..6.95167496)},
    LegendType=1)
