# Grasshopper definition BasicShellFormFinding.gh (Grasshopper 0.9.76)
# plug-ins: Karamba

# ----
# Starting Surface
number_slider = Slider(6, range=0..10)
pt = ConstructPoint(XCoordinate=number_slider, YCoordinate=Slider(6, range=0..10), ZCoordinate=0)
pt_2 = ConstructPoint(XCoordinate=0, YCoordinate=0, ZCoordinate=0)
rec_2pt = Rectangle2Pt(Plane=PlaneXY(0, 0, 0), PointA=pt_2, PointB=pt, Radius=0)  # -> Rectangle, Length
boundary = BoundarySurfaces(Edges=rec_2pt.Rectangle)

number_slider_2 = Slider(20, range=0..100)

# ----
# Anchors/Supports
md_slider = MDSlider(slider_value=Point(0, 0, 0.5), SliderMode=0, x_domain=Domain(0, 1), y_domain=Domain(0, 1), z_domain=Domain(0, 1))
md_slider_2 = MDSlider(slider_value=Point(1, 0, 0.5), SliderMode=0, x_domain=Domain(0, 1), y_domain=Domain(0, 1), z_domain=Domain(0, 1))
md_slider_3 = MDSlider(slider_value=Point(0, 1, 0.5), SliderMode=0, x_domain=Domain(0, 1), y_domain=Domain(0, 1), z_domain=Domain(0, 1))
md_slider_4 = MDSlider(slider_value=Point(1, 1, 0.5), SliderMode=0, x_domain=Domain(0, 1), y_domain=Domain(0, 1), z_domain=Domain(0, 1))
evalsrf = EvaluateSurface(Surface=reparameterize(boundary), Point=md_slider)  # -> Point, Normal, Frame
evalsrf_2 = EvaluateSurface(Surface=reparameterize(boundary), Point=md_slider_2)  # -> Point, Normal, Frame
evalsrf_3 = EvaluateSurface(Surface=reparameterize(boundary), Point=md_slider_4)  # -> Point, Normal, Frame
evalsrf_4 = EvaluateSurface(Surface=reparameterize(boundary), Point=md_slider_3)  # -> Point, Normal, Frame
supp = SupportKaramba(PosInd=evalsrf.Point, menu=[buttons(on, on, on, on, on, on)])
supp_2 = SupportKaramba(PosInd=evalsrf_2.Point, menu=[buttons(on, on, on, on, on, on)])
supp_3 = SupportKaramba(PosInd=evalsrf_3.Point, menu=[buttons(on, on, on, on, on, on)])
supp_4 = SupportKaramba(PosInd=evalsrf_4.Point, menu=[buttons(on, on, on, on, on, on)])

# ---- group: controls resolution
mesh_uv = MeshSurface(Surface=boundary, UCount=number_slider_2, VCount=number_slider_2, Overhang=True, Equalize=False)

# ----
# Structure
meshtoshell = MeshToShellKaramba(Mesh=mesh_uv, LDist=0.005)  # -> Point, Element, Info

# ----
# Point Loads
# (Ver 1.1.0 and above have generic  'Loads' component
# rather than separate 'Point Loads' component)
md_slider_5 = MDSlider(
    slider_value=Point(0.4097557998, 0.159023378, 0.5),
    SliderMode=0,
    x_domain=Domain(0, 1),
    y_domain=Domain(0, 1),
    z_domain=Domain(0, 1))
md_slider_6 = MDSlider(
    slider_value=Point(0.8024385034, 1, 0.5),
    SliderMode=0,
    x_domain=Domain(0, 1),
    y_domain=Domain(0, 1),
    z_domain=Domain(0, 1))
evalsrf_5 = EvaluateSurface(Surface=reparameterize(boundary), Point=md_slider_5)  # -> Point, Normal, Frame
evalsrf_6 = EvaluateSurface(Surface=reparameterize(boundary), Point=md_slider_6)  # -> Point, Normal, Frame
Z = UnitZ(Factor=Slider(1.9, range=0..5))
cp = ClosestPoint(Point=evalsrf_5.Point, Cloud=meshtoshell.Point)  # -> ClosestPoint, CPIndex, Distance
Z_2 = UnitZ(Factor=Slider(3.9, range=0..5))
cp_2 = ClosestPoint(Point=evalsrf_6.Point, Cloud=meshtoshell.Point)  # -> ClosestPoint, CPIndex, Distance
line = LineSDL(Start=cp.ClosestPoint, Direction=Z, Length=Slider(3, range=0..10))
line_2 = LineSDL(Start=cp_2.ClosestPoint, Direction=Z_2, Length=Slider(5, range=0..10))
loads = LoadsKaramba(ForceVector=Z, Local=True, PosInd=cp.ClosestPoint, LCase=0, mode="Point")
loads_2 = LoadsKaramba(ForceVector=Z_2, Local=True, PosInd=cp_2.ClosestPoint, LCase=0, mode="Point")

assemble = AssembleModelKaramba(
    Point=meshtoshell.Point,
    Elem=meshtoshell.Element,
    Support=[supp, supp_2, supp_3, supp_4],
    Load=[loads, loads_2],
    LimitDistance_m=0.005)  # -> Model, Info, Mass_kg, CenterOfGravity
analyzethi = AnalyzeThIKaramba(Model=assemble.Model)  # -> CalculatedModel, MaximumDisplacement_m, ResultingForceOfGravity_kN, ElasticEnergy_kNm
modelview = ModelViewKaramba(Model=analyzethi.CalculatedModel, LoadCaseFactorsForLinearSuperposition=1, IndexIncrementOfVisibleLoadcase=0)  # -> Model, DeformedMesh, DeformedAxes, DeformedModel
shellview = ShellViewKaramba(Model=modelview.Model)  # -> Model, MeshesOfRenderedShells, LegendColors, LegendTags
