# Grasshopper definition TU_Intro_BeamGrid.gh (Grasshopper 0.9.76)
# plug-ins: Karamba

crv = Curve([<curve referenced from the Rhino model> x3])
number_slider = Slider(16, range=1..20)
explode = Explode(Curve=crv, Recursive=True)  # -> flatten(Segments), Vertices
srf = Surface(<surface referenced from the Rhino model>)
readcstable = ReadCrossSectionTableFromFileKaramba()  # -> CrossSection, Info
llinter = LineLineIntersectionKaramba(Line=explode.Segments, LengthTolerance=0.01)  # -> IntersectionPoints, flatten(LineSubSegements)
mesh_uv = MeshSurface(Surface=srf, UCount=number_slider, VCount=number_slider, Overhang=True, Equalize=False)
Z = UnitZ(Factor="-1")
Z_2 = UnitZ(Factor="-0.125")
panel = Panel("""2
1
6
5""")
panel_2 = Panel("""8
9""")
pt = Point([Point(61.20720716, -7.831098794, 0), Point(96.07888278, -7.831098794, 0), Point(96.07888278, -51.6542397, 0), Point(61.20720716, -51.6542397, 0)])
linetobeam = LineToBeamKaramba(Line=llinter.LineSubSegements, New=True, Remove=True, LimitDistance_m=0.005, BeamIdentifier="beam 1")  # -> Points, Element, Info
supp = SupportKaramba(PosInd=pt, menu=[buttons(on, on, on, off, on, off)])
loads = LoadsKaramba(ForceVector=Z, Local=True, PosInd=panel, LCase=0, mode="Point")
loads_2 = LoadsKaramba(Vector=Z, BeamIdentifierS=panel_2, LCase=0, mode="Uniform Line", menu=[buttons(on, off, off)])
loads_3 = LoadsKaramba(Vector=Z_2, Mesh=mesh_uv, LCase=0, mode="Mesh Load", menu=[buttons(off, on, off), buttons(on, on)])
crosecselect = CrossSectionSelectorKaramba(NameOrListIndexOfCrossSection=Slider(475, range=369..1046), CrossSections=readcstable.CrossSection)  # -> CrossSection, Info
panel_3 = Panel(readcstable.CrossSection)
panel_4 = Panel(loads)
panel_5 = Panel(loads_2)
panel_6 = Panel(crosecselect.CrossSection)
panel_7 = Panel(loads_3)
assemble = AssembleModelKaramba(Elem=linetobeam.Element, Support=supp, Load=loads_3, CrossSection=crosecselect.CrossSection, LimitDistance_m=0.005)  # -> Model, Info, Mass_kg, CenterOfGravity
readcstable_2 = ReadCrossSectionTableFromFileKaramba()  # -> CrossSection, Info
opticrosec = OptimizeCrossSectionKaramba(
    Model=assemble.Model,
    GroupIdentifiers="beam 1",
    CrossSections=readcstable_2.CrossSection,
    MaximumUtilization=1,
    MaximumDisplacement_m="0.6",
    UltimateLimitStateIterations=5,
    DisplacementIterations=5,
    NumberOfSamplePoints=3,
    ElasticDesign=True,
    GammaM0=1,
    GammaM1=1)  # -> ModelWithOptimizedCrossSections, Info, Mass_kg, MaximumDisplacement_m, ElasticEnergy_kNm
analyzethi = AnalyzeThIKaramba(Model=opticrosec.ModelWithOptimizedCrossSections)  # -> CalculatedModel, MaximumDisplacement_m, ResultingForceOfGravity_kN, ElasticEnergy_kNm
panel_8 = Panel(opticrosec.MaximumDisplacement_m)
panel_9 = Panel(analyzethi.MaximumDisplacement_m)
beamdisp = BeamDisplacementsKaramba(AnalyzedModel=analyzethi.CalculatedModel, LoadCase=-1, MaximumDistanceBetweenResults_m=-1, NumberOfResultsPerElement="3")  # -> AnalyzedModel, simplify(Translations_m), Rotations_rad
modelview = ModelViewKaramba(Model=analyzethi.CalculatedModel, LoadCaseFactorsForLinearSuperposition=1, IndexIncrementOfVisibleLoadcase=0)  # -> Model, DeformedMesh, DeformedAxes, DeformedModel
b_forces = BeamForcesKaramba(
    AnalyzedModel=analyzethi.CalculatedModel,
    LCase=-1,
    MaximumDistanceBetweenResults_m=-1,
    NumberOfResultsPerBeamElement="3")  # -> AnalyzedModel, NormalForce_kN, simplify(ShearForceVz_kN), ShearForceVy_kN, BendingMomentMt_kNm, simplify(BendingMomentMy_kNm), BendingMomentMz_kNm
beamview = BeamViewKaramba(Model=modelview.Model)  # -> Model, MeshesOfRenderedBeams, DeformedBeamAxes, LegendColors, LegendTags
panel_10 = Panel(b_forces.BendingMomentMy_kNm)
panel_11 = Panel(b_forces.ShearForceVz_kN)
panel_12 = Panel(beamdisp.Translations_m)
