# Grasshopper definition karamba setup_01_simple parametric beam.gh (Grasshopper 0.9.76)
# plug-ins: Karamba

vec = VectorXYZ(XComponent=[Slider(1.3, range=0..10), Slider(5.6, range=0..10)], YComponent=0, ZComponent=0)  # -> Vector, Length
readcstable = ReadCrossSectionTableFromFileKaramba()  # -> CrossSection, Info
Z = UnitZ(Factor=Slider(-4.667, range=-5..5.001))
id = Panel("beam_1")
id_2 = Panel("beam_1")
pline = PolyLine(Vertices=vec.Vector, Closed=False)
supp = SupportKaramba(PosInd="0", menu=[buttons(on, on, on, on, on, on)])
crosecselect = CrossSectionSelectorKaramba(ElementsIdentifiers=id, NameOrListIndexOfCrossSection="HEA100", CrossSections=readcstable.CrossSection)  # -> CrossSection, Info
loads = LoadsKaramba(ForceVector=Z, Local=False, PosInd="1", LCase=0, mode="Point")
linetobeam = LineToBeamKaramba(Line=pline, New=True, Remove=True, LDist=0.005, Identifier=id_2)  # -> Points, Element, Info
assemble = AssembleModelKaramba(
    Point=linetobeam.Points,
    Elem=linetobeam.Element,
    Support=supp,
    Load=loads,
    CrossSection=crosecselect.CrossSection,
    LimitDistance_m=0.005)  # -> Model, Info, Mass_kg, CenterOfGravity
analyze = AnalyzeKaramba(Model=assemble.Model)  # -> ModelWithDisplacements, MaximumDisplacement, ResultingForceOfGravity, ElasticEnergy
modelview = ModelViewKaramba(Model=analyze.ModelWithDisplacements, LoadCaseFactorsForLinearSuperposition=1, IndexIncrementOfVisibleLoadcase=0)  # -> Model, MeshOfRendering, DeformedStructure, DeformedModel
beamview = BeamViewKaramba(Model=modelview.Model)  # -> Model, MeshOfRendering, DeformedBeamAxes, LegendColors, LegendTags
