# Grasshopper definition karamba setup_02_simple parametric truss.gh (Grasshopper 0.9.76)
# plug-ins: Karamba

dom = Domain(DomainStart=Slider(0.2, range=0..30), DomainEnd=Slider(10.8, range=0..30))
panel = Panel("""1
-1""")
range = Range(Domain=dom, Steps=Slider(10, range=0..20))
multiplication = Multiplication(A=Slider(0.363, range=0..1), B=panel)
vec = VectorXYZ(XComponent=range, YComponent=0, ZComponent=graft(multiplication))  # -> Vector, Length
bang = ExplodeTree(Data=vec.Vector)  # -> Branch0, Branch1
panel_2 = Panel("""0
1""")
cull = CullPattern(List=bang.Branch1, CullPattern=invert(panel_2))  # -> flatten(List)
cull_2 = CullPattern(List=bang.Branch0, CullPattern=panel_2)  # -> flatten(List)
item = ListItem(List=bang.Branch0, Index=0, Wrap=True)  # -> flatten(Item1), flatten(Item)
weave = Weave(Pattern=reverse(panel_2), Stream0=cull_2, Stream1=cull, NullGaps=False)  # -> flatten(Weave)
pline = PolyLine(Vertices=[item.Item, cull_2, item.Item1], Closed=False)
pline_2 = PolyLine(Vertices=[item.Item, weave, item.Item1], Closed=False)
pline_3 = PolyLine(Vertices=cull, Closed=False)
explode = Explode(Curve=pline, Recursive=True)  # -> Segments, Vertices
explode_2 = Explode(Curve=pline_2, Recursive=True)  # -> Segments, Vertices
explode_3 = Explode(Curve=pline_3, Recursive=True)  # -> Segments, Vertices
flatten = FlattenTree(Data=explode.Segments, Path="0")
flatten_2 = FlattenTree(Data=explode_2.Segments, Path="2")
flatten_3 = FlattenTree(Data=explode_3.Segments, Path="1")
merge = Merge(Data1=flatten, Data2=flatten_2, Data3=flatten_3)
id = Panel("""upper
lower
mid""")
rdpoints = RemoveDuplicatePointsKaramba(Point=[explode.Vertices, explode_2.Vertices, explode_3.Vertices], LDist=0.005)  # -> OutPoint, Info, Indexes
end = EndPoints(Curve=pline_3)  # -> Start, End
readcstable = ReadCrossSectionTableFromFileKaramba()  # -> CrossSection, Info
readcstable_2 = ReadCrossSectionTableFromFileKaramba()  # -> CrossSection, Info
id_2 = Panel("""upper
lower""")
id_3 = Panel("mid")
Z = UnitZ(Factor=Slider(-5, range=-5..5.001))
crosecselect = CrossSectionSelectorKaramba(ElementsIdentifiers=id_2, NameOrListIndexOfCrossSection="HEA160", CrossSections=readcstable_2.CrossSection)  # -> CrossSection, Info
crosecselect_2 = CrossSectionSelectorKaramba(ElementsIdentifiers=id_3, NameOrListIndexOfCrossSection="HEA100", CrossSections=readcstable.CrossSection)  # -> CrossSection, Info
linetobeam = LineToBeamKaramba(Points=rdpoints.OutPoint, Line=merge, New=True, Remove=True, LDist=0.005, Identifier=graft(id))  # -> Points, Element, Info
loads = LoadsKaramba(Vector=Z, BeamIdentifierS="upper", LCase=0, mode="Uniform Line", menu=[buttons(on, off, off)])
supp = SupportKaramba(PosInd=end.End, menu=[buttons(off, on, on, on, off, off)])
supp_2 = SupportKaramba(PosInd=end.Start, menu=[buttons(on, on, on, on, off, off)])
assemble = AssembleModelKaramba(
    Point=rdpoints.OutPoint,
    Elem=flatten(linetobeam.Element),
    Support=[supp_2, supp],
    Load=loads,
    CrossSection=[crosecselect.CrossSection, crosecselect_2.CrossSection],
    LimitDistance_m=0.005)  # -> Model, Info, Mass_kg, CenterOfGravity
analyzethi = AnalyzeThIKaramba(Model=assemble.Model)  # -> CalculatedModel, MaximumDisplacement_m, ResultingForceOfGravity_kN, ElasticEnergy_kNm
modelview = ModelViewKaramba(Model=analyzethi.CalculatedModel, LoadCaseFactorsForLinearSuperposition=1, IndexIncrementOfVisibleLoadcase=0)  # -> Model, MeshOfRendering, DeformedStructure, DeformedModel
beamview = BeamViewKaramba(Model=modelview.Model)  # -> Model, MeshOfRendering, DeformedBeamAxes, LegendColors, LegendTags
