# Grasshopper definition test.gh (Grasshopper 1.0.7)
# Copyright: © 2017-2018 Pierre Cuvilliers, Caitlin Mueller, Massachusetts Institute of Technology

python = GhPythonScript()  # -> loop, x, y, z, w
# ---------- python: Python ----------
__author__ = "Kim"
__version__ = "2018.11.07"
                
import rhinoscriptsyntax as rs
import csv
import scriptcontext
import rpyc
import sys
np = scriptcontext.sticky['numpy']
rpy = scriptcontext.sticky['rpy']

np.random.seed(1)

size = 10

X = np.random.rand(size*3) * 10
w_1 = np.zeros(size)
loop_1 = np.arange(size) + 1

x = []
y = []
z = []
w = []
loop = []

for i in range(size):
    loop.append(float(loop_1[i]))
    x.append(float(X[i]-5))
    y.append(float(X[i+size]-5))
    z.append(float(X[i+size*2]-5))
    w.append(float(w_1[i]))

                
#f_1 = open('output.csv', 'r')
#lines = csv.reader(f_1)
                
#for line in lines:
#    print(line)
#    loop = line[0]
#    x = line[1]
#    y = line[2]
#    z = line[3]
#    w = line[4]
#                
#f_1.close()
#
# ---------- end python ----------
panel = Panel(python.loop)
panel_2 = Panel(python.x)
panel_3 = Panel(python.y)
panel_4 = Panel(python.w)
panel_5 = Panel(python.z)
pythonremote = GHPythonRemote(location="C:\Users\Kim\Anaconda3\envs\rhinoremote", run=Toggle(True), modules="numpy")  # -> out, linked_modules, rpy, import_statements
panel_6 = Panel(pythonremote.rpy)
panel_7 = Panel(pythonremote.linked_modules)
panel_8 = Panel(pythonremote.out)
panel_9 = Panel(pythonremote.import_statements)
vec = VectorXYZ(XComponent=panel_2, YComponent=panel_3, ZComponent=panel_5)  # -> Vector, Length
pt = Point(<point referenced from the Rhino model>)
pt_2 = Point(<point referenced from the Rhino model>)
pt_3 = Point(<point referenced from the Rhino model>)
pt_4 = Point(<point referenced from the Rhino model>)
pt_5 = Point(<point referenced from the Rhino model>)
pt_6 = Point(<point referenced from the Rhino model>)
pt_7 = Point(<point referenced from the Rhino model>)
pt_8 = Point(<point referenced from the Rhino model>)
vec2pt = Vector2Pt(PointA=pt_3, PointB=vec.Vector, Unitize=False)  # -> Vector, Length
vec2pt_2 = Vector2Pt(PointA=pt_2, PointB=vec.Vector, Unitize=False)  # -> Vector, Length
vec2pt_3 = Vector2Pt(PointA=pt_8, PointB=vec.Vector, Unitize=False)  # -> Vector, Length
vec2pt_4 = Vector2Pt(PointA=pt_4, PointB=vec.Vector, Unitize=False)  # -> Vector, Length
vec2pt_5 = Vector2Pt(PointA=pt, PointB=vec.Vector, Unitize=False)  # -> Vector, Length
vec2pt_6 = Vector2Pt(PointA=pt_7, PointB=vec.Vector, Unitize=False)  # -> Vector, Length
vec2pt_7 = Vector2Pt(PointA=pt_6, PointB=vec.Vector, Unitize=False)  # -> Vector, Length
vec2pt_8 = Vector2Pt(PointA=pt_5, PointB=vec.Vector, Unitize=False)  # -> Vector, Length
panel_10 = Panel(vec2pt.Length)
panel_11 = Panel(vec2pt_4.Length)
panel_12 = Panel(vec2pt.Vector)
panel_13 = Panel(vec2pt_2.Length)
panel_14 = Panel(vec2pt_5.Vector)
panel_15 = Panel(vec2pt_4.Vector)
panel_16 = Panel(vec2pt_2.Vector)
panel_17 = Panel(vec2pt_5.Length)
pt_9 = Point(vec.Vector)
panel_18 = Panel(vec2pt_8.Vector)
panel_19 = Panel(vec2pt_8.Length)
panel_20 = Panel(vec2pt_7.Vector)
panel_21 = Panel(vec2pt_6.Vector)
panel_22 = Panel(vec2pt_3.Vector)
panel_23 = Panel(vec2pt_3.Length)
panel_24 = Panel(vec2pt_7.Length)
panel_25 = Panel(vec2pt_6.Length)
python_2 = GhPythonScript()  # -> out, x, y, z
# ---------- python_2: Python ----------
import rhinoscriptsyntax as rs
import csv
import scriptcontext
import rpyc
import sys
np = scriptcontext.sticky['numpy']
rpy = scriptcontext.sticky['rpy']

f_1 = open('output_learning.csv', 'r')
lines = csv.reader(f_1)

x = []
y = []
z = []
                
for line in lines:
    x.append(line[0])
    y.append(line[1])
    z.append(line[2])
                
f_1.close()
# ---------- end python_2 ----------
addition = Addition(A=panel_19, B=panel_24)
addition_2 = Addition(A=panel_25, B=panel_23)
multiplication = Multiplication(A=vec2pt_8.Length, B=vec2pt_8.Length)
panel_26 = Panel(python_2.z)
panel_27 = Panel(python_2.y)
panel_28 = Panel(python_2.x)
addition_3 = Addition(A=panel_17, B=panel_11)
addition_4 = Addition(A=panel_13, B=panel_10)
addition_5 = Addition(A=addition, B=addition_2)
addition_6 = Addition(A=addition_3, B=addition_4)
addition_7 = Addition(A=addition_5, B=addition_6)
python_3 = GhPythonScript(loop=panel, x=panel_2, y=panel_3, z=panel_5, sum=addition_7)  # -> out
# ---------- python_3: Python ----------
__author__ = "Kim"
__version__ = "2018.11.07"
                
import rhinoscriptsyntax as rs
import csv
import scriptcontext
import rpyc
import sys
np = scriptcontext.sticky['numpy']
rpy = scriptcontext.sticky['rpy']
## = scriptcontext.sticky['execnet']
                
# Do some numpy stuff
#a = np.arange(15).reshape(3, 5)
#print(a)
                
print(loop)
                
f = open('output.csv', 'a')
wr = csv.writer(f)
wr.writerow([loop, x, y, z, sum])
f.close()
                
f_1 = open('output.csv', 'r')
lines = csv.reader(f_1)
                
#for line in lines:
#    print(line)
                
f_1.close()
# ---------- end python_3 ----------
vec_2 = VectorXYZ(XComponent=panel_28, YComponent=panel_27, ZComponent=panel_26)  # -> Vector, Length
panel_29 = Panel(python_3)
pt_10 = Point(vec_2.Vector)
ln = Line(StartPoint=flatten([pt_9, pt_10]), EndPoint=graft([pt_8, pt_7, pt_6, pt_5]))

# ==== cluster GHPythonRemote: Connects the Grasshopper Python component to an external Python instance.
python = PythonScript()  # -> gh_parent_doc_dir
# ---------- python: Python ----------
from os import path

gh_parent_doc_dir = path.abspath(path.dirname(ghenv.Component.OnPingDocument().Owner.OnPingDocument().FilePath))
# ---------- end python ----------
# GH to python remote example.
# Pierre Cuvilliers, 2017-2018
# Released under the MIT license
# github.com/pilcru/ghpythonremote
# Runs and connects to an external python engine, and
# assigns imported modules to scriptcontext.sticky variables.
# 
# Arguments:
#       code (str): Path to the GH_to_python_sticky.py code file.
#       location (str): Path to a python executable, or to a folder
#             containing `python.exe`, or the name of a conda-created
#             virtual environment prefixed by `conda://` (`conda://env_name`).
#             If empty, finds python from your windows %PATH%.
#       run (boolean): Creates the connection, and imports new
#             modules, when turned to True. Kills the connection,
#             and deletes the references to the imports, when turned
#             to False.
#       modules (str list): List of module names to import in the
#             remote python. They will be added to the
#             scriptcontext.sticky dictionary, allowing them to be
#             reused from other python components in the same
#             Grasshopper document. Submodules (for example
#             `numpy.linalg` have to be added explicitly to this list
#             to be available later.
#       log_level (str from ['NOTSET', 'DEBUG', 'INFO', 'WARNING', 'ERROR', 'CRITICAL']):
#             Logging level to use for the local IronPython and the
#             remote python instance.
#       working_dir (str): Working directory for the remote python
#             instance.
# 
# Returns:
#       out (str): Console output with DEBUG information.
#       linked_modules (str list): list of imported module names.
#       rpy (rpyc connection object): The object representing the
#             remote Python interpreter.
location = ClusterInput()  # location (str): Path to a python executable, or to a folder containing `python.exe`, or the name of a conda-created virtual environment prefixed by `conda://` (`conda://env_name`). If empty, finds python from your windows %PATH%.
run = ClusterInput()  # run (boolean): Creates the connection, and imports new modules, when turned to True. Kills the connection,and deletes the references to the imports, when turned to False.
modules = ClusterInput()  # modules (str list): List of module names to import in the remote python. They will be added to the scriptcontext.sticky dictionary, allowing them to be reused from other python components in the same Grasshopper document. Submodules (for example `numpy.linalg` have to be added explicitly to this list to be available later.
list = ValueList({"CRITICAL", "ERROR", "WARNING", "INFO", "DEBUG", "NOTSET"}, selected="DEBUG")
panel = Panel(python)
ghpythonremote = GHPythonRemote(location=location, run=run, modules=modules, log_level=list, working_dir=panel)  # -> out, linked_modules, rpy; inputs run: Boolean, modules: list
# ---------- ghpythonremote: Python ----------
import sys
import scriptcontext
import logging
import inspect
import ghpythonremote
from ghpythonremote.connectors import GrasshopperToPythonRemote
from os import path
from time import sleep

local_log_level = getattr(logging, log_level, logging.WARNING)
logger = logging.getLogger('ghpythonremote')
logger.setLevel(local_log_level)
ch = logging.StreamHandler()
ch.setLevel(local_log_level)
formatter = logging.Formatter('%(levelname)s: %(name)s:\n%(message)s')
ch.setFormatter(formatter)
logger.handlers = []
logger.addHandler(ch)
logger = logging.getLogger('ghpythonremote.GH_to_python_sticky')

ROOT = path.abspath(path.dirname(inspect.getfile(ghpythonremote)))
rpyc_server_py = path.join(ROOT, 'pythonservice.py')

# Set connection to CLOSED if this is the first run
# and initialize set of linked modules
try:
    remote_python_status
except NameError:
    remote_python_status = 'CLOSED'
    lkd_modules = set()

# Wait for connection to connect or terminate
timer = 0
while remote_python_status == 'CONNECTING' or remote_python_status == 'CLOSING':
    sleep(1)
    timer += 1
    if timer == 10:
        try:
            gh2py_manager.__exit__(*sys.exc_info())
        except Exception:
            pass
        remote_python_status = 'CLOSED'
        lkd_modules = set()
        raise RuntimeError("Connection left in an inconsistent state and not returning. Reset everything.")

if run:
    if not remote_python_status == 'OPEN':
        remote_python_status = 'CONNECTING'
        gh2py_manager = GrasshopperToPythonRemote(rpyc_server_py, location=location, timeout=10,
                                                  port=None, log_level=log_level, working_dir=working_dir)
        gh2py = gh2py_manager.__enter__()
        remote_python_status = 'OPEN'

    # Stuff that we can reach
    rpymod = gh2py.py_remote_modules  # A getter function for a named python module
    rpy = gh2py.connection  # Represents the remote instance root object
    scriptcontext.sticky['rpy'] = rpy
    # Add modules
    for mod in modules:
        try:
            scriptcontext.sticky[mod] = rpymod(mod)
            lkd_modules.add(mod)
        except ImportError:
            gh2py_manager.__exit__(*sys.exc_info())
            raise

elif not remote_python_status == 'CLOSED':
    remote_python_status = 'CLOSING'
    # Remove linked modules
    for mod in lkd_modules:
        del scriptcontext.sticky[mod]
    del scriptcontext.sticky['rpy']
    gh2py_manager.__exit__(*sys.exc_info())
    lkd_modules = set()
    remote_python_status = 'CLOSED'

# Change variable name because ghpython resets outputs to None before each run
linked_modules = lkd_modules

logger.info('GH to python connection is {}'.format(remote_python_status))
# ---------- end ghpythonremote ----------
python_2 = PythonScript(module_names=ghpythonremote.linked_modules)  # -> import_statements; inputs module_names: list
# ---------- python_2: Python ----------
import_statements = ["import scriptcontext as sc"]
for module_name in module_names:
    import_statements.append("{0} = sc.sticky['{0}']".format(module_name))

if len(module_names) == 0:
    import_statements = []
# ---------- end python_2 ----------
out = ClusterOutput(ghpythonremote.out)  # Console output.
linked_modules = ClusterOutput(ghpythonremote.linked_modules)  # Names of modules that were successfully added to the scriptcontext.sticky dictionary.
rpy = ClusterOutput(ghpythonremote.rpy)  # The object representing the remote python instance
import_statements = ClusterOutput(python_2)  # Useful import statements to use the imported modules in your scripts.
